# Dynamo graph Indexed Family Instances.dyn

number = DoubleInput(1)
family_type_selector = FamilyTypeSelector(index=16)
string = StringInput("increment")
Family_Instance_Creator_Indexed_Offset_x = Output(family_type_selector, string)  # "Family Instance Creator - Indexed - Offset - xyz"
number_2 = DoubleInput(1)
number_slider = DoubleSliderInput(20, range=0..20)
number_3 = DoubleInput(1)
number_sequence = BuildSeq(number_2, number_slider, number_3)
map = Map(Family_Instance_Creator_Indexed_Offset_x, number_sequence)
