# Dynamo graph 4. form from curve selection.dyn

boolean = BoolSelector(true)
curves_by_selection = CurvesBySelection()
curves_by_selection_2 = CurvesBySelection()
list = NewList(index0=curves_by_selection, index1=curves_by_selection_2)
loft_form = LoftForm(boolean, list)
