# Dynamo graph Arc.dyn

arc = Arc()
xyz_basisz = XYZBasisZ()
xyz_zero = XYZZero()
plane = Plane(xyz_basisz, xyz_zero)
sketch_plane = SketchPlane(plane)
model_curve = ModelCurve(arc, sketch_plane)
point_by_selection = PointBySelection()  # 1 picked in the model
point_by_selection_2 = PointBySelection()  # 1 picked in the model
point_by_selection_3 = PointBySelection()  # 1 picked in the model
