# Dynamo graph 3. divide selected curve.dyn

curve_by_selection = CurvesBySelection()
number = DoubleInput(21)
xyz_array_along_curve = XYZArrayAlongCurve(curve_by_selection, number)
reference_point = ReferencePointByXYZ(xyz_array_along_curve)
