# Dynamo graph 5.2 scalable graph function.dyn

number_slider = DoubleSliderInput(10, range=0..10)
number = DoubleInput(-1)
π = Pi()
multiplication = Multiplication(number, π)
multiplication_2 = Multiplication(number_slider, multiplication)
multiplication_3 = Multiplication(π, number_slider)
number_2 = DoubleInput(8)
division = Division(π, number_2)
number_slider_2 = DoubleSliderInput(0.2631578947, range=0..1)
multiplication_4 = Multiplication(number_slider, number_slider_2)
number_3 = DoubleInput(1)
division_2 = Division(number_3, number_slider)
sine = Sin()
C_f_dx = Output(multiplication_4, division_2, sine)  # "C*f(dx)"
GraphFunction = Output(multiplication_2, multiplication_3, division, C_f_dx)
reference_point = ReferencePointByXYZ(GraphFunction)
ConnectPoints = Output(reference_point)
