# Dynamo custom node Parse List of Lists.dyf
# category: Scripting.Custom Nodes

list = Input()
length = Length(list)
number = DoubleInput(2)
lt = LessThan(length, number)
empty = Empty()
multiplier = Input()
number_2 = DoubleInput(0)
first = First(list)
string = StringInput("%2c")
split_string = SplitString(first, string)
get = GetFromList(number_2, split_string)
string_number = String2Num(get)
multiplication = Multiplication(multiplier, string_number)
number_3 = DoubleInput(1)
get_2 = GetFromList(number_3, split_string)
string_number_2 = String2Num(get_2)
multiplication_2 = Multiplication(multiplier, string_number_2)
number_4 = DoubleInput(2)
get_3 = GetFromList(number_4, split_string)
string_number_3 = String2Num(get_3)
multiplication_3 = Multiplication(multiplier, string_number_3)
XYZ = XYZ(multiplication, multiplication_2, multiplication_3)
rest = Rest(list)
parse_list_of_lists = Custom[Parse List of Lists](list=rest, multiplier=multiplier)
cons = List(XYZ, parse_list_of_lists)
if_ = Conditional(lt, empty, cons)
xyz = Output(if_)
