# Dynamo custom node Solar Radiation Optimizer.dyf
# category: Scripting.Custom Nodes

famInst = Input()
parameter = Input()
increment = Input()
max = Input()
number = DoubleInput(1)
list = NewList(item_s=number, index1=number)
path = Input()
watch_file = FileWatcher(path)
solarradopt = Custom[solarradopt](fI=famInst, p=parameter, i=increment, max=max, amt=number, acc=list, path=path, fw=watch_file)
solarradupdate = Custom[solarradupdate](fi=famInst, p=parameter, result=solarradopt)
