# Dynamo graph Autodesk.DesignScript.Geometry.CoordinateSystem.Scale2D.dyn (Dynamo 1.1.0.2093)

number_slider = DoubleSlider(6.6, range=0..15 step 0.1)
code_block = CodeBlock(x=number_slider) { Point.ByCoordinates(4,1,0); Vector.ByCoordinates(4,1,0); Point.ByCoordinates(1,2,0); Point.ByCoordinates(3,x,0); }
byOriginNormal = Plane.ByOriginNormal(origin=code_block.out0, normal=code_block.out1)
XY = Plane.XY()
scale2D = CoordinateSystem.Scale2D(byOriginNormal, XY, code_block.out2, code_block.out3)
watch = Watch(scale2D)
