# Dynamo graph Autodesk.DesignScript.Geometry.CoordinateSystem.Translate(xTranslation, yTranslation, zTranslation).dyn (Dynamo 1.1.0.2093)

byOrigin = CoordinateSystem.ByOrigin()
number_slider = DoubleSlider(3.8, range=0..5 step 0.1)
number_slider_2 = DoubleSlider(2.7, range=0..5 step 0.1)
number_slider_3 = DoubleSlider(0.8, range=0..4 step 0.1)
translate = CoordinateSystem.Translate(byOrigin, number_slider, number_slider_2, number_slider_3)
byRadiusHeight = Cylinder.ByRadiusHeight(translate)
code_block = CodeBlock(geometry=byRadiusHeight) { color = Color.ByARGB(100,141,198,217); Display.ByGeometryColor(geometry, color); }
