# Dynamo graph Autodesk.DesignScript.Geometry.Curve.Offset.dyn "Offset" (Dynamo 2.0.1.5055)

code_block = CodeBlock { 6; }
randomList = Math.RandomList(amount=code_block)
code_block_2 = CodeBlock(x=randomList) { x*10; }
randomList_2 = Math.RandomList(amount=code_block)
code_block_3 = CodeBlock(x=randomList_2) { x*10; }
byCoordinates = Point.ByCoordinates(x=code_block_2, y=code_block_3)
byControlPoints = NurbsCurve.ByControlPoints(points=byCoordinates)
number_slider = DoubleSlider(-0.71, range=-1..1 step 0.01)  # graph input
offset = Curve.Offset(curve=byControlPoints, distance=number_slider)
