# Dynamo graph Autodesk.DesignScript.Geometry.Point.BySphericalCoordinates.dyn (Dynamo 1.0.1.1167)

code_block = CodeBlock { 1; 5; 1; }
byCoordinates = Point.ByCoordinates(x=code_block.out0, y=code_block.out1, z=code_block.out2)
byOrigin = CoordinateSystem.ByOrigin(byCoordinates)
number_slider = DoubleSlider(210, range=0..360 step 30)
number_slider_2 = DoubleSlider(150, range=0..180 step 10)
code_block_2 = CodeBlock(a=number_slider, b=number_slider_2) { 0..a..10; 0..b..10; }
number_slider_3 = DoubleSlider(8, range=0..10 step 1)
bySphericalCoordinates = Point.BySphericalCoordinates(byOrigin, code_block_2.out0, code_block_2.out1, number_slider_3, lacing=CrossProduct)
