# Dynamo graph Autodesk.DesignScript.Geometry.PolyCurve.ByJoinedCurves.dyn (Dynamo 2.17.0.3255)

code_block = CodeBlock { 1; 3; }
byCoordinates = Point.ByCoordinates(x=code_block.out0, y=code_block.out1)
number = DoubleInput(5)  # graph input
byCenterPointRadius = Circle.ByCenterPointRadius(centerPoint=byCoordinates, radius=number)
regularPolygon = Polygon.RegularPolygon(circle=byCenterPointRadius, numberSides=number)
explode = Geometry.Explode(geometry=regularPolygon)
byJoinedCurves = PolyCurve.ByJoinedCurves(curves=explode)
