# Dynamo graph CoreNodeModels.ColorRange.dyn "CoreNodeModels.ColorRange_img" (Dynamo 2.17.0.3255)

color_palette = ColorPalette({R: 220, G: 20, B: 60, A: 255})
color_palette_2 = ColorPalette({R: 100, G: 149, B: 237, A: 255})
list_create = List.Create(item0=color_palette, item1=color_palette_2)
code_block = CodeBlock { 0..1..#10; }
color_range = ColorRange(colors=list_create, value=code_block)  # unwired: indices
