# Dynamo graph CoreNodeModels.DefineData.dyn (Dynamo 3.2.1.5376)

code_block = CodeBlock { 21.1; "The quick brown fox jumps over the lazy dog"; [1,2,3,4,5]; 1; false; Point.ByCoordinates(0,0,0); }

# group: Auto-detect mode is off
# The node warns if data doesn't match the type set.
defineData = DefineData("", code_block.out0, IsAutoMode=false, IsList=false, DisplayValue="Number")
defineData_2 = DefineData("", code_block.out1, IsAutoMode=false, IsList=false, DisplayValue="Number")

# group: Auto-detect mode is on
# The node will automatically set the matching data type.
defineData_3 = DefineData("", code_block.out2, IsAutoMode=true, IsList=true, DisplayValue="Integer")
