# Dynamo graph CoreNodeModels.HigherOrder.Filter.dyn "Filter" (Dynamo 2.0.2.6826)

code_block = CodeBlock { 1..5; }
code_block_2 = CodeBlock { 1; }
eq = _ == code_block_2  # unwired: x
filter = List.Filter(list=code_block, condition=eq)
