# Dynamo graph CoreNodeModels.HigherOrder.Map.dyn "Map" (Dynamo 2.0.2.6826)

code_block = CodeBlock { [1..5]; }
n1 = Custom[+1]()  # Increments a value by 1; unwired: dbl
map = List.Map(list=code_block, f_x=n1)
