# Dynamo graph DSCore.Math.EvaluateFormula.dyn (Dynamo 2.17.0.3255)

string = StringInput("a*(b+c)")
code_block = CodeBlock { "a".."c"; }
code_block_2 = CodeBlock { 1..3; }
evaluateFormula = Math.EvaluateFormula(formulaString=string, parameters=code_block, arguments=code_block_2)
