# Dynamo graph DSCore.Thread.Pause.dyn (Dynamo 1.1.0.2093)

byCenterPointRadius = Circle.ByCenterPointRadius()
code_block = CodeBlock { 5000; }
pause = Thread.Pause(byCenterPointRadius, code_block)
extrude = Curve.Extrude(curve=pause)
