# Dynamo graph Autodesk.DesignScript.Geometry.Solid.Repair.dyn (Dynamo 3.4.1.7055)

file_path = Filename(".\invalid.sat")
importFromSATWithUnits = Geometry.ImportFromSATWithUnits(file_filePath=file_path)
file_path_2 = Filename(".\cut-tools.sat")
importFromSATWithUnits_2 = Geometry.ImportFromSATWithUnits(file_filePath=file_path_2)
differenceAll = Solid.DifferenceAll(solid=importFromSATWithUnits, others=importFromSATWithUnits_2)
repair = Solid.Repair(solid=importFromSATWithUnits)
differenceAll_2 = Solid.DifferenceAll(solid=repair, others=importFromSATWithUnits_2)
