# Dynamo graph GV5KUSHDGL7YVBZAR4HEGY5NIXFIG3XTV6ZQPHC5MWWGEVOSRJ4Q.dyn (Dynamo 3.5.0.8077)

# group: Input
limits = CodeBlock { 0; 10; 20; }
count = DoubleSlider(80, range=10..100 step 1)
height_z_coorrdinates = DoubleSlider(20, range=0..100 step 0.1)

curve_mapper = CurveMapperNodeModel(x_MinLimit=limits.out0, x_MaxLimit=limits.out2, y_MinLimit=limits.out0, y_MaxLimit=limits.out1, count=count, LinearCurveControlPointData1={X: 0, Y: 240, Tag: ""}, LinearCurveControlPointData2={X: 240, Y: 0, Tag: ""}, BezierCurveControlPointData1={X: 0, Y: 240, Tag: ""}, BezierCurveControlPointData2={X: 240, Y: 240, Tag: ""}, BezierCurveControlPointData3={X: 48, Y: 48, Tag: ""}, BezierCurveControlPointData4={X: 192, Y: 48, Tag: ""}, SineWaveControlPointData1={X: 33.979963, Y: 142.0971303, Tag: ""}, SineWaveControlPointData2={X: 70.56108285, Y: 48.98690993, Tag: ""}, CosineWaveControlPointData1={X: 0, Y: 0, Tag: ""}, CosineWaveControlPointData2={X: 14.93856961, Y: 180.0924918, Tag: ""}, ParabolicCurveControlPointData1={X: 120, Y: 24, Tag: ""}, ParabolicCurveControlPointData2={X: 240, Y: 240, Tag: ""}, PerlinNoiseControlPointData1={X: 120, Y: 0, Tag: ""}, PerlinNoiseControlPointData2={X: 0, Y: 240, Tag: ""}, PerlinNoiseControlPointData3={X: 120, Y: 120, Tag: ""}, PowerCurveControlPointData1={X: 120, Y: 120, Tag: ""}, SquareRootCurveControlPointData1={X: 0, Y: 240, Tag: ""}, SquareRootCurveControlPointData2={X: 120, Y: 120, Tag: ""}, GaussianCurveControlPointData1={X: 0, Y: 192, Tag: ""}, GaussianCurveControlPointData2={X: 120, Y: 120, Tag: "GaussianCurveControlPointData2"}, GaussianCurveControlPointData3={X: 96, Y: 240, Tag: "GaussianCurveControlPointData3"}, GaussianCurveControlPointData4={X: 144, Y: 240, Tag: "GaussianCurveControlPointData4"}, MinLimitX=0, MaxLimitX=20, MinLimitY=0, MaxLimitY=10, PointsCount=80, DynamicCanvasSize=240, SelectedGraphType="SineWave")
code_block = CodeBlock(height=height_z_coorrdinates) { [0,height/2,height]; }
byCoordinates = Point.ByCoordinates(x=curve_mapper.y_Values@L2, y=curve_mapper.x_Values@L2, z=code_block@L1, lacing=Longest)
transpose = List.Transpose(lists=byCoordinates)
byPoints = PolyCurve.ByPoints(points=transpose)
