# Dynamo graph divide selected curve.dyn

select_curve = CurvesBySelection()
number = DoubleInput(21)
xyz_array_on_curve = XYZArrayAlongCurve(select_curve, number)
ref_point = ReferencePointByXYZ(xyz_array_on_curve)
