# Dynamo graph form from curve selection.dyn

boolean = BoolSelector(true)
curves_by_selection = CurvesBySelection()  # 1 picked in the model
curves_by_selection_2 = CurvesBySelection()  # 1 picked in the model
list = NewList(item_s=curves_by_selection, index1=curves_by_selection_2)
boolean_2 = BoolSelector(true)
loft_form = LoftForm(boolean, list, boolean_2)
