# Dynamo graph graph function and connect points.dyn

number = DoubleInput(-1)
pi = Pi()
multiply = Multiplication(number, pi, lacing=Longest)
number_2 = DoubleInput(32)
divide = Division(pi, number_2, lacing=Longest)
sine = Sin(lacing=Longest)
graphFunction = Custom[GraphFunction](x_start=multiply, x_end=pi, x_step=divide, y=sine)
reference_point = ReferencePointByXYZ(graphFunction, lacing=Longest)
watch = Watch(reference_point)
connectPoints = Custom[ConnectPoints](refPts=reference_point)
