# Dynamo graph graph function.dyn (Dynamo 0.6.2.14024)

number = DoubleInput(-1)
pi = Pi()
multiply = Multiplication(number, pi, lacing=Longest)
number_2 = DoubleInput(32)
number_3 = DoubleInput(start..end..#amount, multiply, pi, number_2, lacing=Longest)
formula = Formula("sin(x)", x=number_3, lacing=Longest)
XYZ = Xyz(number_3, formula, lacing=Longest)
reference_point = ReferencePointByXyz(XYZ, lacing=Longest)
