# Dynamo graph connect two point arrays.dyn (Dynamo 0.7.0.28037)

select_model_element = DSModelElementSelection()  # 1 picked in the model
curve = CurveElement.Curve(select_model_element)
double_slider = DoubleSlider(3.53, range=0..20)
code_block = CodeBlock(x=double_slider) { 0..1..#x; }
pointAtParameter = Curve.PointAtParameter(curve, code_block, lacing=CrossProduct)
byPoint = ReferencePoint.ByPoint(pointAtParameter, lacing=Longest)
select_model_element_2 = DSModelElementSelection()  # 1 picked in the model
curve_2 = CurveElement.Curve(select_model_element_2)
code_block_2 = CodeBlock(x=double_slider) { 0..1..#x; }
pointAtParameter_2 = Curve.PointAtParameter(curve_2, code_block_2, lacing=CrossProduct)
byPoint_2 = ReferencePoint.ByPoint(pointAtParameter_2, lacing=Longest)
python_script = Python(IN[0]=byPoint, IN[1]=byPoint_2, IN[2]=double_slider)
# ---------- python_script.python (21 lines) ----------
import clr
import sys
sys.path.append(r"C:\\Users\\Ian\\Documents\\GitHub\\Dynamo\\bin\\AnyCPU\\Debug\\")
clr.AddReference("RevitNodes.dll")
clr.AddReference('ProtoGeometry')
from Revit.Elements import *
from Autodesk.DesignScript.Geometry import *

#The inputs to this node will be stored as a list in the IN variable.
dataEnteringNode = IN

leftPts = IN[0]
righPts = IN[1]

lines = []
for count in range(0,len(leftPts)):
	line = Line.ByStartPointEndPoint(leftPts[count].Point, righPts[count].Point)
	crv = ModelCurve.ByCurve(line)
	lines.append(crv)

OUT = lines
# ----------------------------------------
watch = Watch(python_script)
