# Dynamo graph create sine wave from selected curve.dyn

curve_by_selection = CurvesBySelection()  # 1 picked in the model
python_script = Python(curve_by_selection)
# ---------- python_script.python (22 lines) ----------
#derived from Nathan Miller's example http://theprovingground.wikidot.com/revit-api-py-curves

import math

doc = __revit__.ActiveUIDocument.Document
app = __revit__.Application

crv = IN
crvRef = crv.GeometryCurve
refptarr = ReferencePointArray()

#use for loop to create a series of points
steps = 20
for i in range(0,steps+1):
    pt = crvRef.Evaluate(float(i)/steps,1) # returns and XYZ
    x = pt.X
    y = pt.Y
    z = pt.Z + math.sin(i)*steps 
    myXYZ = XYZ(x,y,z)
    refPt = doc.FamilyCreate.NewReferencePoint(myXYZ)
    refptarr.Append(refPt)
crv2 = doc.FamilyCreate.NewCurveByPoints(refptarr)
# ----------------------------------------
transaction = Transaction(python_script)
