# Dynamo graph create sine wave from selected points.dyn

point_by_selection = PointBySelection()  # 1 picked in the model
# note: Select two points.
# note: Create a list.
point_by_selection_2 = PointBySelection()  # 1 picked in the model
list = NewList(item_s=point_by_selection, index1=point_by_selection_2)
# note: Make a python script.
python_script = Python(list)
# ---------- python_script.python (27 lines) ----------
#derived from Nathan Miller's example http://theprovingground.wikidot.com/revit-api-py-curves

import math

doc = __revit__.ActiveUIDocument.Document
app = __revit__.Application

beginPoint = IN[0]
endPoint = IN[1]
lineRefPointArray = ReferencePointArray()
lineRefPointArray.Append(beginPoint)
lineRefPointArray.Append(endPoint)
crv = doc.FamilyCreate.NewCurveByPoints(lineRefPointArray)
crvRef = crv.GeometryCurve
refptarr = ReferencePointArray()

#use for loop to create a series of points
steps = 20
for i in range(0,steps+1):
    pt = crvRef.Evaluate(float(i)/steps,1) # returns and XYZ
    x = pt.X
    y = pt.Y
    z = pt.Z + math.sin(i)*steps 
    myXYZ = XYZ(x,y,z)
    refPt = doc.FamilyCreate.NewReferencePoint(myXYZ)
    refptarr.Append(refPt)
crv2 = doc.FamilyCreate.NewCurveByPoints(refptarr)
# ----------------------------------------
# note: Create a transaction to wrap the python script.
transaction = Transaction(python_script)
