# Dynamo graph inst param.dyn

select_family_instance = FamilyInstanceCreatorSelection()  # 1 picked in the model
select_fam_inst_param = FamilyInstanceParameterSelector(select_family_instance)
get_instance_parameter = FamilyInstanceParameterGetter(select_family_instance, select_fam_inst_param, lacing=Longest)
watch = Watch(get_instance_parameter)
