# Dynamo graph DynamicMobius.dyn

filename = StringFilename("No file selected.")
read_file = FileReader(filename)
number_slider = DoubleSliderInput(2.730337079, range=0..3)
python_script_from_string = PythonString(read_file, number_slider)
transaction = Transaction(python_script_from_string)
watch = Watch(python_script_from_string)
