# Dynamo graph Attractor Logic_End.dyn (Dynamo 0.7.0.15504)

number = DoubleInput(15)
number_2 = DoubleInput(1)
number_3 = DoubleInput(0)
number_4 = DoubleInput(2)
# note: XYZ Point Grid
xyz_grid = ReferencePtGrid(number, number, number_2, number_3, number_3, number_3, number_4, number_4, number_4, lacing=Longest)
number_slider = DoubleSliderInput(16.567, range=0..30)
number_slider_2 = DoubleSliderInput(20.373, range=0..30)
number_5 = DoubleInput(0)
# note: 'Attractor' Point
XYZ = Xyz(number_slider, number_slider_2, number_5, lacing=Longest)
# note: Create a distance-based
# relationship with a single point.
xyz_distance = XyzDistance(xyz_grid, XYZ, lacing=Longest)
number_6 = DoubleInput(30)
divide = Division(xyz_distance, number_6, lacing=Longest)
# note: Circle with variable radii
circle = Circle(xyz_grid, divide, lacing=Longest)
watch_3d = Watch3D(circle)
# note: Make Revit Stuff
reference_curve = ReferenceCurve(circle, lacing=Longest)
