# Dynamo graph Indexed Family Instances.dyn
# Copyright David Wood 2012. Derived from http://revitator.blogspot.co.uk/2012/10/dynamo-indexed-family-instances.html
# Licensed under the Apache License, Version 2.0 (the "License");
# you may not use this file except in compliance with the License.
# You may obtain a copy of the License at
# http://www.apache.org/licenses/LICENSE-2.0
# Unless required by applicable law or agreed to in writing, software
# distributed under the License is distributed on an "AS IS" BASIS,
# WITHOUT WARRANTIES OR CONDITIONS OF ANY KIND, either express or implied.
# See the License for the specific language governing permissions and
# limitations under the License.

family_type_selector = FamilyTypeSelector(index=14)
string = StringInput("increment")
family_instance_creator_indexed = Function(family_type_selector, string)
number = DoubleInput(1)
number_slider = DoubleSliderInput(20, range=0..20)
number_2 = DoubleInput(1)
number_sequence = BuildSeq(number, number_slider, number_2)
map = Map(family_instance_creator_indexed, number_sequence)
