# Dynamo graph Arc from Ref Points.dyn (Dynamo 0.6.2.14024)

select_reference_point = PointBySelection()  # 1 picked in the model
select_reference_point_2 = PointBySelection()  # 1 picked in the model
select_reference_point_3 = PointBySelection()  # 1 picked in the model
arc_by_start_middle_end = ArcStartMiddleEnd(select_reference_point, select_reference_point_2, select_reference_point_3, lacing=Longest)
model_curve = ModelCurve(arc_by_start_middle_end, lacing=Longest)
watch = Watch(model_curve)
watch_3d = Watch3D(arc_by_start_middle_end)
