# Dynamo graph Arc.dyn (Dynamo 0.6.2.14024)

select_reference_point = PointBySelection()
xyz_from_reference_point = XyzFromReferencePoint(select_reference_point, lacing=Longest)
select_reference_point_2 = PointBySelection()
xyz_from_reference_point_2 = XyzFromReferencePoint(select_reference_point_2, lacing=Longest)
select_reference_point_3 = PointBySelection()
xyz_from_reference_point_3 = XyzFromReferencePoint(select_reference_point_3, lacing=Longest)
arc_by_start_middle_end = ArcStartMiddleEnd(xyz_from_reference_point, xyz_from_reference_point_2, xyz_from_reference_point_3, lacing=Longest)
model_curve = ModelCurve(arc_by_start_middle_end, lacing=Longest)
watch = Watch(model_curve)
watch_3d = Watch3D(arc_by_start_middle_end)
