# Dynamo graph circle.dyn (Dynamo 0.6.2.14024)

number_slider = DoubleSliderInput(0, range=0..100)
number = DoubleInput(0)
XYZ = Xyz(number_slider, number, number, lacing=Longest)
number_slider_2 = DoubleSliderInput(40.909, range=0..100)
circle = Circle(XYZ, number_slider_2, lacing=Longest)
model_curve = ModelCurve(circle, lacing=Longest)
select_curve = CurvesBySelection()
geometry_curve_from_model_curve = CurveFromModelCurve(select_curve, lacing=Longest)
list = NewList(index0=geometry_curve_from_model_curve, index1=circle)
watch_3d = Watch3D(list)
