# Dynamo graph helix.dyn

number_slider = DoubleSliderInput(26.12359551, range=0..100)
python_script = Python(number_slider)
# ---------- python_script.python (29 lines) ----------
# adapted from Nathan Miller's Proving Ground Blog
# http://wiki.theprovingground.org/revit-api-py-curves

import clr
import math
 
doc = __revit__.ActiveUIDocument.Document
app = __revit__.Application

scale = IN

xyzs = []
output = []

#use for loop to create a series of points
for i in range(0,20):
    x = math.sin(i)*scale
    y = math.cos(i)*scale
    z = i*scale/2
 
    myXYZ = XYZ(x,y,z)
    xyzs.append(myXYZ)

#create hermite spline
hs = app.Create.NewHermiteSpline(xyzs, False)
output.append(hs)
output.append(xyzs)

OUT = output;
# ----------------------------------------
watch_3d = Watch3D(python_script)
watch = Watch(python_script)
