# Dynamo graph CSV to Stuff.dyn

family_type_selector = FamilyTypeSelector(index=5)
# note: connect Watch 3d to these
# to make Revit Stuff
family_instance_creator = FamilyInstanceCreatorXYZ(arg1=family_type_selector, lacing=Longest)
reference_point = ReferencePointByXYZ(lacing=Longest)
filename = StringFilename("C:\Users\kronz\Documents\GitHub\Dynamo\doc\distrib\Samples\15 CSV to Points\helix_smaller.csv")
read_file = FileReader(filename)
string = StringInput("%0a")
split_string = SplitString(read_file, string)
parse_list_of_lists = Custom[Parse List of Lists](list=split_string)
# note: Readfile, String, Split String, and Parse List of Lists
# Can be made into a single file.  See 02 file.
number_slider = DoubleSliderInput(1.638784852, range=0..20)
scale_xyz = XYZScale(parse_list_of_lists, number_slider, lacing=Longest)
watch_3d = Watch3D(scale_xyz)
