# Dynamo graph CSV to Stuff.dyn

# note: Pick a loaded family from the
# dropdown to place
family_type_selector = FamilyTypeSelector()
# note: Connect to Watch 3d to place families
family_instance_creator = FamilyInstanceCreatorXYZ(arg1=family_type_selector, lacing=Longest)
# note: connect Watch 3d to make Revit
# Reference Points
reference_point = ReferencePointByXYZ(lacing=Longest)
# note: Browse a CSV file that has numbers
# in x, y, and z coordinate space
filename = StringFilename("C:\Users\kronz\Documents\GitHub\Dynamo\doc\distrib\Samples\15 CSV to Points\helix_smaller.csv")
read_file = FileReader(filename)
# note: Split the String on
# A carriage return <enter>
string = StringInput("%0a")
split_string = SplitString(read_file, string)
# note: Custom Node.
# Double click to look inside
parse_list_of_lists = Custom[Parse List of Lists](list=split_string)
number_slider = DoubleSliderInput(1.638784852, range=0..20)
# note: Adjust the overall distribution
# of the coordinate points
scale_xyz = XYZScale(parse_list_of_lists, number_slider, lacing=Longest)
# note: Visualize XYZs in the Watch 3d
# before making Revit Elements
watch_3d = Watch3D(scale_xyz)
