# Dynamo graph 2dDomain.dyn (Dynamo 0.6.2.14024)

number = DoubleInput(0.5)
UV = Uv(number, number, lacing=Longest)
number_2 = DoubleInput(1)
UV_2 = Uv(number_2, number_2, lacing=Longest)
uv_domain = Domain2D(UV, UV_2)
number_slider = DoubleSliderInput(24.023, range=0..40)
uv_random = UvRandom(uv_domain, number_slider, number_slider)
number_3 = DoubleInput(2)
UV_3 = Uv(number, number_3, lacing=Longest)
uv_domain_2 = Domain2D(UV_2, UV_3)
formula = Formula("x/2", x=number_slider, lacing=Longest)
uv_grid = UvGrid(uv_domain_2, formula, formula)
list = NewList(index0=uv_random, index1=uv_grid)
flatten_completely = FlattenList(list)
select_face = FormElementBySelection()  # 1 picked in the model
evaluate_surface = XyzEvaluate(flatten_completely, select_face, lacing=Longest)
watch_3d = Watch3D(evaluate_surface)
