# Dynamo graph tesselation with coincident grids.dyn (Dynamo 0.6.2.14024)

select_face = FormElementBySelection()  # 1 picked in the model
get_surface_domain = SurfaceDomain(select_face, lacing=Longest)
number_slider = DoubleSliderInput(10.13614286, range=0..20)
uv_grid = UvGrid(get_surface_domain, number_slider, number_slider)
evaluate_surface = XyzEvaluate(uv_grid, select_face, lacing=Longest)
# note: Wiggle Sliders
# for Awesome
number_slider_2 = DoubleSliderInput(6.515, range=0..20)
uv_grid_2 = UvGrid(get_surface_domain, number_slider_2, number_slider_2)
join_lists = Append(uv_grid_2, uv_grid)
voronoi_on_face = VoronoiOnFace(join_lists, select_face, lacing=Longest)
list = NewList(index0=evaluate_surface, index1=voronoi_on_face)
watch_3d = Watch3D(list)
model_curve = ModelCurve(lacing=Longest)
