# Dynamo graph tesselation.dyn

face_by_selection = FormElementBySelection()  # 1 picked in the model
surface_domain = SurfaceDomain(face_by_selection)
number_slider = DoubleSliderInput(13.98071625, range=0..40)
uv_random_distribution = UVRandom(surface_domain, number_slider, number_slider)
uv_grid = UVGrid(surface_domain, number_slider, number_slider)
# note: Swap these connections
# For different patterning
delaunay_tessellation = DelaunayTessellation(uv_grid, face_by_selection)
watch_3d = dyn3DPreview(delaunay_tessellation)
# note: Connect these to
# make Revit Stuff
curve_by_points_by_line = CurveByPointsByLine()
