# Dynamo graph Translate and Rotate sequence.dyn

xyz_zero = XYZZero()
line = LineBound(xyz_zero)
transform_point = TransformPoint()
xyz_basisz = XYZBasisZ()
transform_rotation = TransformRotation(xyz_zero, xyz_basisz)
number = DoubleInput(0.1)
number_slider = DoubleSliderInput(6.24, range=0..6.24)
number_2 = DoubleInput(0.25)
number_sequence = BuildSeq(number, number_slider, number_2)
map = Map(transform_rotation, number_sequence)
xyz_basisx = XYZBasisX()
xyz_scale = XYZScale(xyz_basisx)
map_2 = Map(xyz_scale, number_sequence)
combine = Combine(transform_point, map, map_2)
map_3 = Map(line, combine)
watch_3d = dyn3DPreview(map_3)
