# Dynamo graph Translate and Rotate.dyn

xyz_zero = XYZZero()
xyz_basisz = XYZBasisZ()
number_slider = DoubleSliderInput(0, range=0..6.24)
transform_rotation = TransformRotation(xyz_zero, xyz_basisz, number_slider)
xyz_basisx = XYZBasisX()
number_slider_2 = DoubleSliderInput(1.878787879, range=0..10)
xyz_scale = XYZScale(xyz_basisx, number_slider_2)
transform_point = TransformPoint(transform_rotation, xyz_scale)
line = LineBound(xyz_zero, transform_point)
watch_3d = dyn3DPreview(line)
