# Dynamo graph Adaptive Component Placement.dyn

list = NewList()
select_curve = CurvesBySelection()  # 1 picked in the model
number_slider = DoubleSliderInput(8.995561104, range=0..20)
xyz_array_on_curve = XYZArrayAlongCurve(select_curve, number_slider, lacing=Longest)
select_curve_2 = CurvesBySelection()  # 1 picked in the model
xyz_array_on_curve_2 = XYZArrayAlongCurve(select_curve_2, number_slider, lacing=Longest)
select_curve_3 = CurvesBySelection()  # 1 picked in the model
xyz_array_on_curve_3 = XYZArrayAlongCurve(select_curve_3, number_slider, lacing=Longest)
combine = Combine(list, xyz_array_on_curve, xyz_array_on_curve_2, xyz_array_on_curve_3)
select_fam = FamilyTypeSelector(index=5)
adaptive_component_by_points = AdaptiveComponentByPoints(combine, select_fam, lacing=Longest)
watch_3d = Watch3D(combine)
