# Dynamo graph DataToFamilies.dyn (Dynamo 0.6.2.14024)

# note: Select all the Families on a Divided Surface
select_divided_surface_families = DividedSurfaceBySelection()  # 1 picked in the model
flatten_completely = FlattenList(select_divided_surface_families)
string = StringInput("opening")
# note: Simple Number Sequence
number = DoubleInput(.1..0.4..#100)
set_family_instance_parameter = FamilyInstanceParameterSetter(flatten_completely, string, number, lacing=Longest)
# note: Data from an Image
file_path = StringFilename("C:\Users\kronz\Documents\GitHub\Dynamo\doc\distrib\Samples\20 Panel Manipulations\gradient.bmp")
number_2 = DoubleInput(10)
read_image_file = ImageFileReader(file_path, number_2, number_2)
color_brightness = ColorBrightness(read_image_file, lacing=Longest)
formula = Formula("x*.4", x=color_brightness, lacing=Longest)
# note: Get Coincident points with Curtain panels
select_face = FormElementBySelection()  # 1 picked in the model
get_surface_domain = SurfaceDomain(select_face, lacing=Longest)
number_3 = DoubleInput(10)
uv_grid = UvGrid(get_surface_domain, number_3, number_3)
evaluate_surface = XyzEvaluate(uv_grid, select_face, lacing=Longest)
# note: Data From Sun Orientation
sunpath_direction = SunPathDirection()  # 1 picked in the model
add_xyz = XyzAdd(evaluate_surface, sunpath_direction, lacing=Longest)
direction_to_xyz = XyzStartEndVector(evaluate_surface, add_xyz, lacing=Longest)
surface_normal = NormalEvaluate(uv_grid, select_face, lacing=Longest)
xyz_distance = XyzDistance(direction_to_xyz, surface_normal, lacing=Longest)
formula_2 = Formula("x/4", x=xyz_distance, lacing=Longest)
# note: Data From Excel
file_path_2 = StringFilename("C:\Users\kronz\Documents\GitHub\Dynamo\doc\distrib\Samples\20 Panel Manipulations\dataStream.xlsx")
open_excel_workbook = ReadExcelFile(file_path_2)
string_2 = StringInput("Sheet1")
get_excel_worksheet_by_name = GetExcelWorksheetByName(open_excel_workbook, string_2)
get_data_from_excel_worksheet = GetDataFromExcelWorksheet(get_excel_worksheet_by_name)
flatten_completely_2 = FlattenList(get_data_from_excel_worksheet)
number_4 = DoubleInput(3)
build_sublists = Sublists("2", flatten_completely_2, number_4, lacing=Longest)
flatten_completely_3 = FlattenList(build_sublists)
