# Dynamo graph Daylighting and Analysis Display.dyn (Dynamo 0.6.3.5248)

string = StringInput("{3D}")
export_render_data = ExportDocumentRenderData(string)
transaction = Transaction(export_render_data)
upload_render_data = UploadRenderData(transaction)
number = DoubleInput(150)
number_2 = DoubleInput(-100)
number_3 = DoubleInput(-100)
number_4 = DoubleInput(3)
XYZ = Xyz(number_2, number_3, number_4, lacing=Longest)
number_5 = DoubleInput(100)
number_6 = DoubleInput(-100)
number_7 = DoubleInput(3)
XYZ_2 = Xyz(number_5, number_6, number_7, lacing=Longest)
number_8 = DoubleInput(-100)
number_9 = DoubleInput(100)
number_10 = DoubleInput(3)
XYZ_3 = Xyz(number_8, number_9, number_10, lacing=Longest)
skymodel_type = SkymodelType(index=0)
daylighting_skymodel = MakeDaylightingSkyModel(skymodel_type, lacing=Longest)
number_11 = DoubleInput(72)
number_12 = DoubleInput(40)
dateTime = MakeDateTime(lacing=Longest)
daylighting_environment = MakeDaylightingEnvironmentData(daylighting_skymodel, number_11, number_12, dateTime, lacing=Longest)
cloud_daylighting_job = CloudDaylightingJob(string, number, number, XYZ, XYZ_2, XYZ_3, daylighting_environment, lacing=Longest)
boolean = BoolSelector(false)
cloud_render = CloudRender(upload_render_data, cloud_daylighting_job, boolean)
parse_daylighting_file = ParseSDF(cloud_render, lacing=Longest)
number_13 = DoubleInput(0)
get_daylighting_grid_image = GetDaylightingForegroundImage(parse_daylighting_file, number_13, lacing=Longest)
first_of_list = First(get_daylighting_grid_image)
watch_image = WatchImage(first_of_list)
select_face = FormElementBySelection()  # 1 picked in the model
watch_3d = Watch3D(select_face)
get_daylighting_grid_positions = GetDaylightingPositions(parse_daylighting_file, number_13, lacing=Longest)
first_of_list_2 = First(get_daylighting_grid_positions)
get_daylighting_grid_illuminance = GetDaylightingIlluminanceValues(parse_daylighting_file, number_13, lacing=Longest)  # "Get Daylighting Grid Illuminance Values"
first_of_list_3 = First(get_daylighting_grid_illuminance)
illuminance_to_srgb = IlluminanceToSRGB(first_of_list_3, lacing=Longest)
display_lighting_data_on_surface = Custom[Display Lighting Data On Surface](face=select_face, xyz_sample_points=first_of_list_2, data=illuminance_to_srgb)
transaction_2 = Transaction(display_lighting_data_on_surface)
