# Dynamo graph OpenXMLImport_Data From Excel.dyn (Dynamo 3.1.0.3411)
# author: Dynamo Team
# A sample graph showing how to import data from Excel file.

# group: Initial inputs
# 1. The filepath to the Excel file.
# 2. The name of the Worksheet
file_path = Filename("..\..\Data\helix.xlsx")
string = StringInput("helix")

# group: Extracts data from Excel
# note: Read data from Excel
openXMLImportExcel = Data.OpenXMLImportExcel(filePath=file_path, sheetName=string)

# group: Parse the data from Excel
# 'Parsing' data is the process of manipulating a data sourse in such a way as to make it native to the evnironment before using it.
# note: Transpose the list (flip the matrix). Columns will become row, and rows - columns.
transpose = List.Transpose(lists=openXMLImportExcel)
# note: first list
number = DoubleInput(0)
# note: second list
number_2 = DoubleInput(1)
# note: third list
number_3 = DoubleInput(2)

# group: Create the helix
# note: X coordinate
getItemAtIndex = List.GetItemAtIndex(list=transpose, index=number)
# note: Y coordinate
getItemAtIndex_2 = List.GetItemAtIndex(list=transpose, index=number_2)
# note: Z coordinate
getItemAtIndex_3 = List.GetItemAtIndex(list=transpose, index=number_3)
byCoordinates = Point.ByCoordinates(x=getItemAtIndex, y=getItemAtIndex_2, z=getItemAtIndex_3, lacing=Longest)
