# Dynamo graph Basics_Basic02.dyn (Dynamo 2.13.0.3265)
# author: Dynamo Team
# Dynamo Basic Sample

byCoordinates = Point.ByCoordinates()
# note: Geometric Data can be visualized as either textual information or in 3d space
watch = Watch(byCoordinates)
# note: You can toggle between 3d navigation and node navigation with the Geom/Node Butttons in the top right of the screen.  Background Preview can also be turned on and off in the View Menu
number = DoubleInput(2)  # graph input
number_slider = DoubleSlider(4.43, range=0..10 step 0.1)  # graph input
byCoordinates_2 = Point.ByCoordinates(x=number, z=number_slider)
byStartPointEndPoint = Line.ByStartPointEndPoint(startPoint=byCoordinates_2, endPoint=byCoordinates)
watch_3d = Watch3D(byStartPointEndPoint)
