# Dynamo graph Basics_Basic03.dyn (Dynamo 0.8.0.684)

# note: Lists of Data can be generated with sequences and ranges.  These lists can be reorganized with many other nodes for specific purposes
number = DoubleInput(0)
number_2 = DoubleInput(9)
number_3 = DoubleInput(1)
byRange = ByRange(number, number_2, number_3, lacing=Longest)
watch = Watch(byRange)
number_4 = DoubleInput(3)
chop = List.Chop(byRange, number_4)
watch_2 = Watch(chop)
lastItem = List.LastItem(byRange)
watch_3 = Watch(lastItem)
