# Dynamo graph Core_ListAtLevel.dyn (Dynamo 1.2.1.3083)

# note: The lists exist at different levels, with L1 being the lowest level. This particular node produces a list containing 10 lists, each containing 5 points, resulting in a total of 50 points as shown at the bottom right.
# note: This node produces a list containing 10 lists, each having 12 points, resulting in a total of 120 points.

code_block = CodeBlock { 0..30..#10; -10..-34..#12; }
byCoordinates = Point.ByCoordinates(x=code_block.out0, y=code_block.out1, lacing=CrossProduct)
code_block_2 = CodeBlock { {1..10}; }
# note: In this example, we select the second level of the lists resulted from the Point.ByCoordinates node. For each list in the second level, we select a point from it. The index of the point to be selected is determined from the code block.
# The point with index 1 is selected from the first list, the point with index 2 is selected from the second list, and so on. There are a total of 10 lists, hence 10 points are selected.
getItemAtIndex = List.GetItemAtIndex(list=byCoordinates@L2, index=code_block_2@L1)
ZAxis = Vector.ZAxis()
code_block_3 = CodeBlock { x = 0..180..#10; 7 + 5*Math.Cos(x); }
# note: Translate the selected points upwards, each having a different height.
translate = Geometry.Translate(geometry=getItemAtIndex, direction=ZAxis, distance=code_block_3.out1)
create = List.Create(getItemAtIndex, translate)
number = DoubleInput(1.5)
byCenterPointRadius = Circle.ByCenterPointRadius(centerPoint=create, radius=number)
transpose = List.Transpose(byCenterPointRadius)
byLoft = Surface.ByLoft(transpose)
patch = Curve.Patch(transpose)
# note: LIST@LEVEL
# The List@Level feature is an alternative to List.Map, which allows you to directly select the level of list you want to work with.
code_block_4 = CodeBlock { 0..30..#10; 12..0..#5; }
byCoordinates_2 = Point.ByCoordinates(x=code_block_4.out0, y=code_block_4.out1, lacing=CrossProduct)
code_block_5 = CodeBlock { {1,2}; }
# note: To change the list level you want to work with, click the arrow beside the list input port and enable the 'Use levels' option.
# By default, the list at the highest level is selected to be worked with.
# note: In this example, if L3 is selected, the lists (of points) at indexes 1 and 2 are returned. If L2 is selected, the points at indexes 1 and 2 of each of the 10 lists are returned.
getItemAtIndex_2 = List.GetItemAtIndex(list=byCoordinates_2@L3, index=code_block_5)
ZAxis_2 = Vector.ZAxis()
number_2 = DoubleInput(5)
byStartPointDirectionLength = Line.ByStartPointDirectionLength(startPoint=getItemAtIndex_2, direction=ZAxis_2, length=number_2)
translate_2 = Geometry.Translate(geometry=getItemAtIndex_2, zTranslation=number_2)

# group: Comparing List@Level with List.Map
getItemAtIndex_3 = List.GetItemAtIndex(index=code_block_5)  # unwired: list
# note: In the previous version of Dynamo, List.Map is used to obtain the inner levels of lists. This functionality is resolved by the List@Level feature, which helps to reduce the number of nodes used.
# This List.Map node produces the same result as the List.GetItemAtIndex node above, when you change the level from L3 to L2.
map = List.Map(list=byCoordinates_2, f_x=getItemAtIndex_3)
