# Dynamo graph Core_Strings.dyn (Dynamo 2.0.0.2821)

byCoordinates = Point.ByCoordinates()
code_block = CodeBlock { 5; }
byCenterPointRadius = Circle.ByCenterPointRadius(centerPoint=byCoordinates, radius=code_block)
# note: Convert an object to a string decription of itself.
string_from_object = FromObject(obj=byCenterPointRadius)
watch = Watch(string_from_object)
code_block_2 = CodeBlock { "("; ")"; " "; "="; ","; }
# note: Divide a string into pieces by specifying one or more separater characters.
split = String.Split(str=watch, separater0=code_block_2.out0, separater1=code_block_2.out1, separater2=code_block_2.out2, separater3=code_block_2.out3, separater4=code_block_2.out4)
watch_2 = Watch(split)
code_block_3 = CodeBlock { "."; }
# note: Find whether a string contains another string.
contains = String.Contains(str=watch_2, searchFor=code_block_3)
watch_3 = Watch(contains)
# note: Specify a string in a Code Block with "" marks or in a string node.
# note: STRINGS
# This set of examples shows some of the available functionality for dealing with strings.  More can be found in the Core/String library.
code_block_4 = CodeBlock { "Few things are harder to put up with than a good example."; }
string = StringInput(" - Mark Twain")
# note: Change the case of a string
toUpper = String.ToUpper(str=string)
watch_4 = Watch(toUpper)
# note: Attaching two strings together to make one is called "concatenating," or "concat" for short.
concat = String.Concat(string0=code_block_4, string1=watch_4)
watch_5 = Watch(concat)
code_block_5 = CodeBlock { "put"; }
code_block_6 = CodeBlock { "come"; }
# note: Replace instances of a string inside a larger string.
replace = String.Replace(str=watch_5, searchFor=code_block_5, replaceWith=code_block_6)
watch_6 = Watch(replace)
code_block_7 = CodeBlock { " to"; }
# note: Find where a particular string occurse in a larger string.
indexOf = String.IndexOf(str=watch_6, searchFor=code_block_7)
watch_7 = Watch(indexOf)
# note: Find the total number of characters in a string.
length = String.Length(str=watch_6)
watch_8 = Watch(length)
sub = watch_8 - watch_7
# note: Remove a certain number of characters from a string.
remove = String.Remove(str=watch_6, startIndex=watch_7, count=sub)
watch_9 = Watch(remove)
code_block_8 = CodeBlock { "ar"; }
# note: Count the occurances of a string inside a longer string.
countOccurrences = String.CountOccurrences(str=watch_9, searchFor=code_block_8)
watch_10 = Watch(countOccurrences)
