# Dynamo graph ImportExport_CSV to Stuff.dyn (Dynamo 0.8.0.706)

# note: Browse a CSV file that has numbers
# in x, y, and z coordinate space
file_path = Filename("C:\ProgramData\Dynamo\1.0\samples\Data\helix.csv")
fromPath = FileObject(file_path)  # "File.FromPath"
readText = File.ReadText(fromPath)
string = StringInput("\n")
# note: Split the String on
# A carriage return <enter>
split = String.Split(readText, string)
string_2 = StringInput(",")
# note: Split the String on Comma
split_2 = String.Split(split, string_2)
# note: CSV files supply Strings, not numbers
toNumber = String.ToNumber(split_2)
# note: Group X, Y, & Z components
transpose = List.Transpose(toNumber)
firstItem = List.FirstItem(transpose)
code_block = CodeBlock { 1; }
getItemAtIndex = List.GetItemAtIndex(list=transpose, index=code_block)
lastItem = List.LastItem(transpose)
byCoordinates = Point.ByCoordinates(x=firstItem, y=getItemAtIndex, z=lastItem)
number_slider = DoubleSlider(2.337, range=0..20 step 0.1)
# note: Adjust the overall distribution
# of the coordinate points
scale = Geometry.Scale(geometry=byCoordinates, amount=number_slider, lacing=Longest)
