# Dynamo graph ImportExport_Excel to Dynamo.dyn (Dynamo 0.8.0.706)

file_path = Filename("C:\ProgramData\Dynamo\0.8\samples\Data\helix.xlsx")
fromPath = FileObject(file_path)  # "File.FromPath"
string = StringInput("helix")
readFromFile = Excel.ReadFromFile(fromPath, string)
transpose = List.Transpose(readFromFile)
number = DoubleInput(0)
getItemAtIndex = List.GetItemAtIndex(list=transpose, index=number)
number_2 = DoubleInput(1)
getItemAtIndex_2 = List.GetItemAtIndex(list=transpose, index=number_2)
number_3 = DoubleInput(2)
getItemAtIndex_3 = List.GetItemAtIndex(list=transpose, index=number_3)
byCoordinates = Point.ByCoordinates(x=getItemAtIndex, y=getItemAtIndex_2, z=getItemAtIndex_3, lacing=Longest)
