# Dynamo graph Revit_Adaptive Component Placement.dyn (Dynamo 0.8.0.760)

# note: Model Lines have been  pre-selected from Revit, Element IDs saved with the Dynamo file
# note: Run this graph the DynamoSample.rvt file in the Samples folder located with your Dynamo installation
# C:\ProgramData\Dynamo\Dynamo Revit\(Your Dynamo Version)\samples\Revit
# note: Place Adaptive Components relative to some elements selected in a Revit file
select_model_element = DSModelElementSelection()  # 1 picked in the model
select_model_element_2 = DSModelElementSelection()  # 1 picked in the model
select_model_element_3 = DSModelElementSelection()  # 1 picked in the model
create_list = List.Create(select_model_element, select_model_element_2, select_model_element_3)
geometry = Element.Geometry(create_list)
flatten = Flatten(geometry)
integer_slider = IntegerSlider(9, range=2..10 step 1)
code_block = CodeBlock(x=integer_slider) { 0..1..#x; }
pointAtParameter = Curve.PointAtParameter(curve=flatten, param=code_block, lacing=CrossProduct)
transpose = Transpose(pointAtParameter)
family_types = FamilyTypes("3PointAC_SquareTruss:3PointAC_SquareTruss")
byPoints = AdaptiveComponent.ByPoints(transpose, family_types)
byPoints_2 = PolyCurve.ByPoints(points=transpose)
