# Dynamo graph Revit_Color.dyn (Dynamo 2.0.1.4357)

# note: Get Walls
# note: Run this graph the DynamoSample.rvt file in the Samples folder located with your Dynamo installation
# C:\ProgramData\Dynamo\Dynamo Revit\(Your Dynamo Version)\samples\Revit
# note: Color Revit Elements based on some measurable criteria
select_model_elements = DSModelElementsSelection()  # 10 picked in the model
number = DoubleInput(0)
number_2 = DoubleInput(255)
byARGB = Color.ByARGB(a=number, r=number, g=number_2, b=number, lacing=Longest)
number_3 = DoubleInput(0)
number_4 = DoubleInput(255)
byARGB_2 = Color.ByARGB(a=number_3, r=number_4, g=number_3, b=number_3, lacing=Longest)
create = List.Create(item0=byARGB, item1=byARGB_2)
code_block = CodeBlock { [0,1]; }
geometry = Element.Geometry(element=select_model_elements)
flatten = List.Flatten(list=geometry)
# note: Extract Surface Area of Geometry
area = Solid.Area(solid=flatten)
# note: normalize at highest value
maximumItem = List.MaximumItem(list=area)
div = area / maximumItem
color_range = ColorRange(colors=create, indices=code_block, value=div)
# note: set color range
overrideColorInView = Element.OverrideColorInView(element=select_model_elements, color=color_range, lacing=Longest)
number_5 = DoubleInput(50)
# note: get highest value
# note: identify areas within a tolerance
# note: or
formula = Formula("if(x>y,1,0)", x=area, y=number_5, lacing=Longest)
