# Dynamo graph Revit_GeometryCreation_Curves.dyn (Dynamo 2.13.0.3270)

byCoordinates = Point.ByCoordinates()
number = DoubleInput(5)
byCoordinates_2 = Point.ByCoordinates(y=number)
# note: Multiple creation methods exist for most curves.
byStartPointEndPoint = Line.ByStartPointEndPoint(startPoint=byCoordinates, endPoint=byCoordinates_2)
length = Curve.Length(curve=byStartPointEndPoint)
number_2 = DoubleInput(10)
byCoordinates_3 = Point.ByCoordinates(x=number_2, y=number_2)
number_3 = DoubleInput(15)
byCoordinates_4 = Point.ByCoordinates(x=number_3)
create = List.Create(item0=byCoordinates, item1=byCoordinates_2, item2=byCoordinates_3, item3=byCoordinates_4)
boolean = BoolSelector(true)
byControlPoints = NurbsCurve.ByControlPoints(points=create, closeCurve=boolean)
byPoints = PolyCurve.ByPoints(points=create)
code_block = CodeBlock { 0..1..#20; }
# note: Curves, Polycurves (collections of Curves), Nurbs, and Lines all derive from "Curves", and so all Curve "Actions" and "Queries" can be done to all of them
pointAtParameter = Curve.PointAtParameter(curve=byPoints, param=code_block)
byPoints_2 = NurbsCurve.ByPoints(points=create)
# note: Pass any curve element to Revit Elements that are driven by Lines or other Curves to create them
byCurve = ModelCurve.ByCurve(curve=byPoints_2)
