# Dynamo graph Revit_PlaceFamiliesByLevel_Set Parameters.dyn (Dynamo 2.0.1.4357)

# note: Run this graph the DynamoSample.rvt file in the Samples folder located with your Dynamo installation
# C:\ProgramData\Dynamo\Dynamo Revit\(Your Dynamo Version)\samples\Revit
# note: Place a number of Solar panels and write unique numbers to their Mark Parameter
family_types = FamilyTypes(index=41)
code_block = CodeBlock { -10; 10; 2.5; }
range = Range(start=code_block.out0, end=code_block.out1, step=code_block.out2, lacing=Longest)
code_block_2 = CodeBlock { -10..-15..#3; }
byCoordinates = Point.ByCoordinates(x=range, y=code_block_2, lacing=CrossProduct)
flatten = List.Flatten(list=byCoordinates)
levels = Levels(index=3)
# note: Place Family Instances
# Most Families Can also be placed by Point location.  Adaptive Components can be placed with multiple points, Structural Framing is placed with Curves
byPointAndLevel = FamilyInstance.ByPointAndLevel(familyType=family_types, point=flatten, level=levels)
string = StringInput("Mark")
number = DoubleInput(1)
count = List.Count(list=byPointAndLevel)
sequence = Sequence(start=number, amount=count, step=number, lacing=Longest)
string_from_object = FromObject(obj=sequence)
# note: Set each Family instance parameter.  Using the same model, parameters can also be read, using an Element.GetParameterByName
setParameterByName = Element.SetParameterByName(element=byPointAndLevel, parameterName=string, value=string_from_object)
