# Dynamo graph Basics_Basic03.dyn (Dynamo 2.19.3.6543)
# author: Dynamo Team
# Create a simple list

# group: Inputs
# note: Lists of Data can be generated with sequences and ranges. These lists can be reorganized with many other nodes for specific purposes
number = DoubleInput(0)  # graph input
number_2 = DoubleInput(9)  # graph input
number_3 = DoubleInput(1)  # graph input

# note: Create a sequence of numbers, starting from Start to End, with a given Step
range = Range(start=number, end=number_2, step=number_3, lacing=Longest)
watch = Watch(range)
number_4 = DoubleInput(3)  # graph input
# note: Slice the list in lengths of 3
chop = List.Chop(list=range, lengths=number_4)
# note: Preview the result and observe the list structure with the help of a Watch node
watch_2 = Watch(chop)
# note: Get the last item in a list
lastItem = List.LastItem(list=range)
watch_3 = Watch(lastItem)
