# Dynamo graph form from curve selection.dyn (Dynamo 0.7.0.38229)

boolean = BoolSelector(false)
# note: Select Curve from Revit
select_model_element = DSModelElementSelection()
select_model_element_2 = DSModelElementSelection()
create_list = List.Create(select_model_element, select_model_element_2)
byLoftCrossSections = Form.ByLoftCrossSections(create_list)
