# Dynamo graph Nested Lists.dyn (Dynamo 0.7.0.29588)

integer_slider = IntegerSlider(10, range=0..10)
integer_slider_2 = IntegerSlider(6, range=0..10)
code_block = CodeBlock(x=integer_slider, y=integer_slider_2) { 0..x..1; 0..y..1; 0; }
# note: 'Flat' 2D grid of XYZ coordinates
byCoordinates = Point.ByCoordinates(code_block.out0, code_block.out1, code_block.out2, lacing=CrossProduct)
# note: XYZ grid list
watch_3d = Watch3D(byCoordinates)
# note: Flips the Nesting of the List
transpose = Transpose(byCoordinates)
code_block_2 = CodeBlock { 0; }
getItemAtIndex = List.GetItemAtIndex(transpose, code_block_2)
code_block_3 = CodeBlock { 0.5; }
byCenterPointRadius = Circle.ByCenterPointRadius(getItemAtIndex, code_block_3, lacing=Longest)
# note: Pulls out the first row.
watch_3d_2 = Watch3D(byCenterPointRadius)
# note: Flipped List of Lists
watch = Watch(transpose)
code_block_4 = CodeBlock { 0; }
getItemAtIndex_2 = List.GetItemAtIndex(byCoordinates, code_block_4)
code_block_5 = CodeBlock { 0.5; }
byCenterPointRadius_2 = Circle.ByCenterPointRadius(getItemAtIndex_2, code_block_5, lacing=Longest)
# note: Pulls out the first column.
watch_3d_3 = Watch3D(byCenterPointRadius_2)
watch_2 = Watch(transpose)
watch_3 = Watch(byCoordinates)
