# Dynamo graph Basics_Basic02.dyn (Dynamo 0.7.0.11908)

# note: You can toggle between 3d navigation and node navigation with the Geom/Node Butttons in the lower right of the screen.  Background Preview can also be turned on and off in the View Menu
number = DoubleInput(2)
double_slider = DoubleSlider(4.429878857, range=0..10)
byCoordinates = Point.ByCoordinates(number, arg2=double_slider)
# note: Geometric Data can be visualized as either textual information or in 3d space
watch = Watch(byCoordinates)
byCoordinates_2 = Point.ByCoordinates()
byStartPointEndPoint = Line.ByStartPointEndPoint(byCoordinates, byCoordinates_2)
watch_3d = Watch3D(byStartPointEndPoint)
