# Dynamo graph Import & Export Workflow.dyn "Arbeitsablauf zum Importieren und Exportieren" (Dynamo 4.0.0.3076)
# author: Dynamo
# Dieses Dokument hilft Ihnen, sich mit den verschiedenen Methoden zum Importieren und Exportieren von Excel- und CSV-Dateien vertraut zu machen.

# group: Diagramminformationen
# Metadaten, Farbcodelegende, Benennungsregeln
# note: DYNAMO-PROJEKT
# Arbeitsablauf zum Importieren und Exportieren
# note: DYNAMO-VERSION
# 4.2.0
# note: VERSION DER HOST-ANWENDUNG
# n. z.
# note: VERKNÜPFTE DATEI(EN)
# n. z.
# note: ERFORDERLICHE DYNAMO-PAKETE
# n. z.
# note: AUTOR(EN)/ERSTELLUNGSDATUM
# Archilizer for Dynamo Team/Feb. 4 2026
# note: ZUSÄTZLICHE KOMMENTARE
# n. z.
# note: BESCHREIBUNG
# Dieses Dokument hilft Ihnen, sich mit den verschiedenen Methoden zum Importieren und Exportieren von Excel- und CSV-Dateien vertraut zu machen.
# Es darf jeweils nur eine Eingabemethode verwendet werden. Frieren Sie nicht verwendete Skripte ein.

# group: Überprüfung
# FEHLERSUCHE- UND PRÜFAUSGABEN, DIE ZUR ÜBERPRÜFUNG DER ERGEBNISSE OHNE BEEINTRÄCHTIGUNG DER HAUPTAUSGABEN VERWENDET WERDEN
# note: VERWENDUNG: Von Menschen lesbare Prüfungen, mit denen Sie überprüfen können, ob das Diagramm die erwarteten Funktionen erfüllt, ohne Ergebnisse zu ändern, z. B. Watch-Blöcke, List.Count, Zusammenfassungszeichenfolgen, PASS-/FAIL-Flags, Fehlerlisten, Geometrievorschau (Watch3D) und Beispielausgaben.

# group: Beschriftungen
# note: VERWENDUNG:
# FÜR KOMMENTARE UND SKRIPTINFORMATIONEN.

# group: Ausgaben
# VOM DIAGRAMM ERZEUGTE ENDERGEBNISSE, BEREIT FÜR DEN EXPORT ODER DIE NACHFOLGENDE VERWENDUNG
# note: VERWENDUNG: Endergebnisse, die nachfolgend verwendet werden sollen (exportieren, in ein anderes Diagramm einfügen), z. B. endgültige Listen, formatierte Zeichenfolgen, berechnete Werte, Wörterbücher/Tabellen und exportfähige Daten.

# group: Eingaben
# BENUTZERGESTEUERTE WERTE, DIE DIE ZIELDATEN UND EINSTELLUNGEN DEFINIEREN, BEVOR EINE VERARBEITUNG STATTFINDET
# note: VERWENDUNG: Alle vom Benutzer gesteuerten Werte, die definieren, was das Diagramm verarbeitet und wie es sich verhalten soll,
# z. B. Zahlen-Schieberegler, Zeichenfolgen, Dateipfade, boolesche Umschalter, Dropdown-Listen und anfängliche Listen.

# group: Aktionen
# KERNVORGÄNGE, DIE DIE EINGABEN VERARBEITEN
# note: VERWENDUNG: Hauptverarbeitungs-Pipeline, die Eingaben in Ergebnisse umwandelt. Hier findet die eigentliche Arbeit statt, z. B. Listenbereinigung, Zuordnung, Filterung, Zeichenfolgenlogik, Geometrievorgänge, Formatierung und Konvertierungen.

# group: CSV-Import/-Export
# Dieses Skript importiert CSV-Daten, analysiert und strukturiert sie basierend auf definierten Benennungsregeln um und sondert gültige bzw. ungültige Einträge zur Überprüfung und Korrektur ab. In diesem Arbeitsablauf wird eine Liste von Namen mithilfe einer regelbasierten Validierungslogik verarbeitet, nach Namenskonventionen sortiert und in gültige bzw. ungültige Gruppen klassifiziert. Die gültigen Namen werden für die nachgelagerte Verwendung wie Koordination und Berichterstellung exportiert
# note: Tipps: Fügen Sie nach der Eingabe einen Watch-Block hinzu, um zu überprüfen, wie die Datei importiert wird

# group: Excel-Import/-Export > Excel-Import
# Importieren Sie Daten aus einer Excel-Datei (.xlsx) in Dynamo, und konvertieren Sie Tabellenzeilen und -spalten in strukturierte Listen zur Verarbeitung, Validierung und Bearbeitung. Häufige Verwendungsmöglichkeiten sind Bauteillisten, Parameter und Mengen für nachgelagerte Arbeitsabläufe
# note: Klicken Sie auf Durchsuchen, und wählen Sie Ihre eigene Excel-Datei (.xlsx) aus, bevor Sie dieses Diagramm ausführen.
file_path = Filename("Keine Datei ausgewählt.")
string = StringInput("sheet1")
# note: Legen Sie diesen Wert beim Lesen von Zahlen auf False fest.
# Legen Sie diesen Wert beim Lesen von Text auf True fest.
boolean = BoolSelector(false)
openXMLImportExcel = Data.OpenXMLImportExcel(filePath=file_path, sheetName=string, readAsString=boolean)
# note: Verwenden Sie List.Transpose zum Lesen der Spalten Ihrer Liste.
# Stellen Sie die Liste zum Lesen der Zeilen nicht um.
transpose = List.Transpose()  # unwired: lists

# group: Excel-Import/-Export > Datenstrukturierung für Excel
# entfernt Null-/leere Einträge und Kopfzeilen
# note: Kopfzeilen abrufen
deconstruct = List.Deconstruct(list=openXMLImportExcel)
boolesch = BoolSelector(false)
clean = List.Clean(list=deconstruct.rest, preserveIndices=boolesch)

# group: Excel-Import/-Export > Nach Ähnlichkeit gruppieren
# Beispiel für die Datenbearbeitung in Excel
transpose_2 = List.Transpose(lists=clean)
codeblock_spaltenindex = CodeBlock { 1; }
# note: Wird nur zum Extrahieren einer einzelnen Schlüsselspalte verwendet
getItemAtIndex = List.GetItemAtIndex(list=transpose_2, index=codeblock_spaltenindex)
number = DoubleInput(0)
boolean_2 = BoolSelector(false)
groupBySimilarity = List.GroupBySimilarity(list=getItemAtIndex, tolerance=number, considerAdjacency=boolean_2)

# group: Excel-Import/-Export > Extraktion von Geschossdeckenspalten
# Bestätigt den Spaltenindex
watch = Watch(getItemAtIndex)

# group: CSV-Import/-Export > CSV-Import
# Importiert CSV-Daten in Dynamo und strukturiert sie für regelbasierte Validierungs-, Sortier- und Klassifizierungsarbeitsabläufe
# note: Klicken Sie auf Durchsuchen, und wählen Sie Ihre eigene CSV-Datei (.csv) aus, bevor Sie dieses Diagramm ausführen.
file_path_2 = Filename("Keine Datei ausgewählt.")
boolean_3 = BoolSelector(true)
# note: stellen Sie die Liste um, wenn Sie die Spalten lesen möchten.
# Stellen Sie die Liste nicht um, wenn Sie die Zeilen lesen möchten
importCSV = Data.ImportCSV(filePath=file_path_2, transpose=boolean_3)

# group: CSV-Import/-Export > Datenstrukturierung für CSV
# Datenstrukturierung: Führt Eingaben zusammen und bereinigt diese, sodass nachgelagerte Regeln immer eine konsistente Liste von Zeichenfolgen erhalten (keine Nullen, keine verschachtelten Listen, sauberes Format).
deconstruct_2 = List.Deconstruct(list=importCSV)
transpose_3 = List.Transpose(lists=deconstruct_2.rest)
codeblock_index_der_zu_lesenden = CodeBlock { 0; }  # "Codeblock (Index der zu lesenden Spalte)"
getItemAtIndex_2 = List.GetItemAtIndex(list=transpose_3, index=codeblock_index_der_zu_lesenden)
boolean_4 = BoolSelector(false)
clean_2 = List.Clean(list=getItemAtIndex_2, preserveIndices=boolean_4)

# group: CSV-Import/-Export > Überprüfung
# Extraktion von Kopfzeilen prüfen
watch_kopfzeilen = Watch(deconstruct_2.first)

# group: CSV-Import/-Export > Definitionen von Schlüsselwörtern
# Vom Benutzer bearbeitbare Einstellungen, die die von den Prüfungen verwendeten Bürobenennungsregeln definieren (Großbuchstaben, Schlüsselwörter und erforderliches Trennzeichen). Aktualisieren Sie diese, um sie an Ihr Projekt oder Ihren Bürostandard anzupassen
# note: Diese Liste entsprechend den Benennungskonventionen des Büros bearbeiten
toUpper = String.ToUpper(string=clean_2)
code_block = CodeBlock { "-"; }
code_block_2 = CodeBlock()
# ---------- code_block_2.designscript (2 lines) ----------
// eine Ausgabeliste
["GA","DET","STRUCT"];
# ----------------------------------------
code_block_3 = CodeBlock { 0; }
code_block_4 = CodeBlock { 1; }
code_block_5 = CodeBlock { 2; }

# group: CSV-Import/-Export > Regelprüfungen (Großbuchstaben + Trennzeichen)
# generiert Ausgaben mit booleschen Regeln pro Name. Prüft, ob die einzelnen Namen in Großbuchstaben geschrieben sind und ob sie die erforderliche Trennzeichenfolge enthalten
eq = clean_2 == toUpper
contains = String.Contains(string=clean_2, searchFor=code_block)

# group: CSV-Import/-Export > Schlüsselwortprüfung (enthält ein beliebiges Schlüsselwort)
# prüft, ob die einzelnen Namen mindestens ein genehmigtes Schlüsselwort enthalten. Gibt eine boolesche Liste aus, in der jedes Element dem übereinstimmenden Namen entspricht.
getItemAtIndex_3 = List.GetItemAtIndex(list=code_block_2, index=code_block_3)
contains_2 = String.Contains(string=clean_2, searchFor=getItemAtIndex_3)
getItemAtIndex_4 = List.GetItemAtIndex(list=code_block_2, index=code_block_4)
contains_3 = String.Contains(string=clean_2, searchFor=getItemAtIndex_4)
or_ = Or(bool0=contains_2, bool1=contains_3)
getItemAtIndex_5 = List.GetItemAtIndex(list=code_block_2, index=code_block_5)
contains_4 = String.Contains(string=clean_2, searchFor=getItemAtIndex_5)
or_2 = Or(bool0=or_, bool1=contains_4)

# group: CSV-Import/-Export > Überprüfungen in endgültiger Maske kombinieren
# kombiniert alle Regelausgaben zu einer endgültigen booleschen Maske mithilfe von AND-Logik. Diese Maske definiert, ob die einzelnen Namen gültig oder ungültig sind.
and_ = And(bool0=eq, bool1=contains)
and_2 = And(bool0=and_, bool1=or_2)

# group: CSV-Import/-Export > Gültige und ungültige Namen
# Ausgaben: Unterteilt die Liste der Eingabenamen basierend auf der endgültigen Maske in gültige und ungültige Ergebnisse
filterByBoolMask = List.FilterByBoolMask(list=clean_2, mask=and_2)

# group: CSV-Import/-Export > Fehlersuche und Zusammenfassung
# Visuelle Prüfungen zur Bestätigung von Eingaben, Regeln und Ausgaben
gültige_namen = Watch(filterByBoolMask.in)
ungültige_namen = Watch(filterByBoolMask.out)

# group: CSV-Import/-Export > Als CSV exportieren
# exportiert die gültigen Namenssätze
file_path_3 = Filename("Keine Datei ausgewählt.")
exportCSV = Data.ExportCSV(filePath=file_path_3, data=filterByBoolMask.in)

# group: Excel-Import/-Export > Gruppierte Geschossdecke überprüfen
# Vorschau der gruppierten Geschossdeckenwerte nach dem Clustering von Ähnlichkeiten. Wird verwendet, um die korrekte Gruppierung und Benennungskonsistenz zu überprüfen
watch_2 = Watch(groupBySimilarity.groupedValues)

# group: Excel-Import/-Export > Gruppierte Geschossdecke überprüfen
# Vorschau der gruppierten Geschossdeckenwerte nach dem Clustering von Ähnlichkeiten. Wird verwendet, um die korrekte Gruppierung und Benennungskonsistenz zu überprüfen
watch_3 = Watch(groupBySimilarity.groupedIndices)

# group: Excel-Import/-Export
# Dieses Skript importiert strukturierte Daten aus Excel, verarbeitet und organisiert sie basierend auf definierten Regeln neu und exportiert das transformierte Ergebnis zur externen Verwendung. In diesem Arbeitsablauf wird eine Liste von Räumen importiert, analysiert und nach Standort neu angeordnet. Dabei werden Räume basierend auf Raumkriterien in strukturierten Listen gruppiert. Die verarbeiteten Daten werden dann für die Koordination und Berichterstellung exportiert.
integer_slider = IntegerSlider(1, range=0..2 step 1)

# group: Excel-Import/-Export > Kopfzeilen vor dem Export einfügen (optional)
# Fügt eine Kopfzeile am Anfang der exportierten Daten ein.
# note: Verwendet GroupedIndices zum Abrufen der ursprünglichen Zeilen
getItemAtIndex_6 = List.GetItemAtIndex(list=clean, index=groupBySimilarity.groupedIndices)
flatten = List.Flatten(list=getItemAtIndex_6, amount=integer_slider)
integer_slider_2 = IntegerSlider(0, range=0..2 step 1)
# note: Fügt vor dem Export bei Index 0 Kopfzeilen ein
insert = List.Insert(list=flatten, element=deconstruct.first, index=integer_slider_2)

# group: Excel-Import/-Export > Struktur von gruppierten Zeilen überprüfen
# Überprüft die Struktur verschachtelter Zeilen vor dem Vereinfachen und Exportieren
watch_4 = Watch(insert)

# group: Excel-Import/-Export > Nach Excel exportieren
# Exportiert strukturierte Dynamo-Daten in eine Excel-Datei (.xlsx). Unterstützt Ausgaben für die externe Überprüfung und Integration mit anderen Werkzeugen
# note: Der Exportdateiname muss mit .xlsx enden
# Wenn bereits eine Datei mit demselben Namen vorhanden ist und Überschreiben auf False gesetzt ist, schlägt der Export fehl, und es wird keine neue Datei erstellt.
# Um eine vorhandene Datei zu ersetzen, muss Überschreiben aktiviert sein.
dateipfad = Filename("Keine Datei ausgewählt.")
string_2 = StringInput("\"Export sheet\"")
integer_slider_3 = IntegerSlider(0, range=0..100 step 1)
boolesch_2 = BoolSelector(true)
openXMLExportExcel = Data.OpenXMLExportExcel(filePath=dateipfad, sheetName=string_2, data=insert, startRow=integer_slider_3, startColumn=integer_slider_3, writeAsString=boolesch_2)

# group: Geometrie-Import/-Export > Geometrie-Import
# Importiert Geometrie aus einer SAT-Datei in Dynamo und konvertiert sie für Transformationsarbeitsabläufe in bearbeitbare Kurven, Oberflächen und Volumenkörper
# note: Klicken Sie auf Durchsuchen, und wählen Sie Ihre eigene SAT-Datei (.sat) aus, bevor Sie dieses Diagramm ausführen.
file_path_4 = Filename("Keine Datei ausgewählt.")
datei_aus_pfad = FileObject(path=file_path_4)
einheiten = Units("Meters")
# note: Importiert die Datei als Dynamo-Volumenkörper/-Oberflächen/-Kurven
importFromSATWithUnits = Geometry.ImportFromSATWithUnits(file_filePath=datei_aus_pfad, dynamoUnit=einheiten)
watch_3d_vorschau_der = Watch3D(importFromSATWithUnits)  # "Watch 3D (Vorschau der importierten Geometrie)"

# group: Geometrie-Import/-Export > Gruppe Fehlersuche/Lernen
# Zeigt den von Dynamo vermuteten Typ der einzelnen Elemente an (Volumenkörper, Oberfläche, Kurve usw.).
# Nützlich, wenn sich Importe unerwartet verhalten.
type = Object.Type(object=importFromSATWithUnits)
watch_5 = Watch(type)

# group: Geometrie-Import/-Export > Transformieren
# Skaliert importierte Geometrie um einen einheitlichen Faktor
XY = Plane.XY()
code_block_6 = CodeBlock { 5; }
scale = Geometry.Scale(geometry=importFromSATWithUnits, plane=XY, xamount=code_block_6, yamount=code_block_6, zamount=code_block_6)

# group: Geometrie-Import/-Export > In SAT exportieren
# Exportieren Sie die aktualisierte Geometrie als SAT-Datei. Die SAT-Datei kann in AutoCAD, Revit usw. importiert werden.
file_path_5 = Filename("Keine Datei ausgewählt.")
exportToSAT = Geometry.ExportToSAT(geometry=scale, filePath=file_path_5)
watch_3d_vorschau_der_skalierten = Watch3D(scale)  # "Watch 3D (Vorschau der skalierten Geometrie)"
