# Dynamo graph Import & Export Workflow.dyn "Flujo de trabajo de importación y exportación" (Dynamo 4.0.0.3076)
# author: Dynamo
# Este documento le ayudará a familiarizarse con las diferentes formas de importar y exportar archivos Excel y CSV.

# group: Información del gráfico
# metadatos, leyenda de código de color, reglas de asignación de nombres
# note: PROYECTO DE DYNAMO
# Flujo de trabajo de importación y exportación
# note: VERSIÓN DE DYNAMO
# 4.2.0
# note: VERSIÓN DE LA APLICACIÓN HOST
# N/D
# note: ARCHIVO(S) ASOCIADO(S)
# N/D
# note: PAQUETES DE DYNAMO NECESARIOS
# N/D
# note: AUTOR(ES)/FECHA DE CREACIÓN
# Archilizer for Dynamo Team/4 de febrero de 2026
# note: COMENTARIOS ADICIONALES
# N/D
# note: DESCRIPCIÓN
# Este documento le ayudará a familiarizarse con las diferentes formas de importar y exportar archivos Excel y CSV.
# Solo se debe utilizar un método de entrada cada vez. Inutilice las secuencias de comandos que no se estén utilizando.

# group: Revisar
# DEPURA Y COMPRUEBA LAS SALIDAS, QUE SE UTILIZAN PARA VERIFICAR LOS RESULTADOS SIN QUE ELLO AFECTE A LAS SALIDAS PRINCIPALES
# note: USO: Comprobaciones legibles para que pueda verificar que el gráfico funciona según lo esperado, sin cambiar resultados como nodos Watch, List.Count, cadenas de resumen, indicadores "PASS/FAIL", listas de errores, geometría de vista previa (Watch3D) y salidas de muestra.

# group: Anotaciones
# note: USO:
# PARA COMENTARIOS E INFORMACIÓN DE LA SECUENCIA DE COMANDOS.

# group: Salidas
# RESULTADOS FINALES GENERADOS POR EL GRÁFICO, LISTOS PARA LA EXPORTACIÓN O EL USO POSTERIOR
# note: USO: Resultados finales que se utilizarán posteriormente (exportados o insertados en otro gráfico), como listas finales, cadenas con formato, valores calculados, diccionarios/tablas y datos listos para exportar.

# group: Entradas
# VALORES CONTROLADOS POR EL USUARIO QUE DEFINEN LOS DATOS Y LA CONFIGURACIÓN DE DESTINO ANTES DE QUE SE PRODUZCA NINGÚN PROCESAMIENTO
# note: USO: Todos los valores controlados por el usuario que definen lo que procesará el gráfico y cómo debe comportarse.
# Por ejemplo, controles deslizantes de número, cadenas, rutas de archivos, conmutadores booleanos, menús desplegables y listas iniciales.

# group: Acciones
# OPERACIONES PRINCIPALES QUE PROCESAN LAS ENTRADAS
# note: USO: El canal de procesamiento principal que transforma las entradas en resultados. Aquí es donde se realiza el "trabajo", como la limpieza de listas, la asignación, el filtrado, la lógica de cadenas, las operaciones geométricas, la aplicación de formato y las conversiones.

# group: Importación/exportación de CSV
# Esta secuencia de comandos importa datos en formato CSV, los analiza y reestructura según las reglas de nomenclatura definidas y separa las entradas válidas de las no válidas para su revisión y corrección. En este flujo de trabajo, se procesa una lista de nombres mediante una lógica de validación basada en reglas, se ordena según las convenciones de nomenclatura y se clasifica en grupos válidos y no válidos. Los nombres válidos se exportan para su uso posterior, como la coordinación y la elaboración de informes.
# note: Sugerencias : Añada un nodo Watch después de la entrada para comprobar cómo se importa el archivo.

# group: Importación/exportación en Excel > Importación a Excel
# Importe datos desde un archivo de Excel (xlsx) a Dynamo, convirtiendo las filas y columnas de la hoja de cálculo en listas estructuradas para su procesamiento, validación y manipulación. Entre sus usos más habituales se incluyen tablas de planificación, parámetros y cantidades para flujos de trabajo posteriores.
# note: Haga clic en Examinar y seleccione su propio archivo de Excel (.xlsx) antes de ejecutar este gráfico
file_path = Filename("No hay ningún archivo seleccionado.")
string = StringInput("plano1")
# note: Se establece en "false" (falso) al leer números.
# Se establece en "true" (verdadero) al leer texto.
boolean = BoolSelector(false)
openXMLImportExcel = Data.OpenXMLImportExcel(filePath=file_path, sheetName=string, readAsString=boolean)
# note: Utilice List.Transpose para leer las columnas de la lista.
# No aplique la transposición para leer las filas de la lista.
transpose = List.Transpose()  # unwired: lists

# group: Importación/exportación en Excel > Estructuración de datos para Excel
# Elimina las entradas nulas/vacías y quita los encabezados.
# note: Recuperar encabezados
deconstruct = List.Deconstruct(lista=openXMLImportExcel)
booleano = BoolSelector(false)
clean = List.Clean(lista=deconstruct.rest, preserveIndices=booleano)

# group: Importación/exportación en Excel > Agrupar por similitud
# Ejemplo de manipulación de datos de Excel.
transpose_2 = List.Transpose(listas=clean)
code_block_índice_de_columna = CodeBlock { 1; }
# note: Se utiliza solo para extraer una única columna de clave
getItemAtIndex = List.GetItemAtIndex(lista=transpose_2, índice=code_block_índice_de_columna)
number = DoubleInput(0)
boolean_2 = BoolSelector(false)
groupBySimilarity = List.GroupBySimilarity(list=getItemAtIndex, tolerance=number, considerAdjacency=boolean_2)

# group: Importación/exportación en Excel > Extracción de pilar de suelo
# Confirma el índice de pilar.
watch = Watch(getItemAtIndex)

# group: Importación/exportación de CSV > Importación de CSV
# Importa datos de CSV a Dynamo y los organiza para flujos de trabajo de validación, clasificación y ordenación basados en reglas.
# note: Haga clic en Examinar y seleccione su propio archivo CSV (.csv) antes de ejecutar este gráfico
file_path_2 = Filename("No hay ningún archivo seleccionado.")
boolean_3 = BoolSelector(true)
# note: Aplique la transposición a la lista si desea leer las columnas.
# No aplique la transposición a la lista si desea leer las filas.
importCSV = Data.ImportCSV(filePath=file_path_2, transpose=boolean_3)

# group: Importación/exportación de CSV > Estructuración de datos para CSV
# Estructuración de datos: fusiona y limpia la entrada para que las reglas posteriores siempre reciban una lista coherente de cadenas (sin valores nulos, sin listas anidadas, formato limpio).
deconstruct_2 = List.Deconstruct(list=importCSV)
transpose_3 = List.Transpose(lists=deconstruct_2.rest)
code_block_índice_de_columna_2 = CodeBlock { 0; }  # "Code Block (índice de columna para leer)"
getItemAtIndex_2 = List.GetItemAtIndex(list=transpose_3, index=code_block_índice_de_columna_2)
boolean_4 = BoolSelector(false)
clean_2 = List.Clean(lista=getItemAtIndex_2, preserveIndices=boolean_4)

# group: Importación/exportación de CSV > Revisar
# Compruebe la extracción de encabezados.
watch_encabezados = Watch(deconstruct_2.first)

# group: Importación/exportación de CSV > Definiciones de palabras clave
# Configuración editable por el usuario que define las reglas de nomenclatura de la oficina utilizadas por las comprobaciones (mayúsculas, palabras clave y separador necesario). Actualícelas para que se ajusten a su proyecto o a las normas de la oficina.
# note: Editar esta lista para que coincida con las convenciones de nomenclatura de oficina
toUpper = String.ToUpper(string=clean_2)
code_block = CodeBlock { "-"; }
code_block_2 = CodeBlock()
# ---------- code_block_2.designscript (2 lines) ----------
// una lista de salida
["GA","DET","STRUCT"];
# ----------------------------------------
code_block_3 = CodeBlock { 0; }
code_block_4 = CodeBlock { 1; }
code_block_5 = CodeBlock { 2; }

# group: Importación/exportación de CSV > Comprobaciones de reglas (mayúsculas + separador)
# Genera resultados de reglas booleanas por nombre. Comprueba si cada nombre está en mayúsculas y si contiene la cadena separadora necesaria.
eq = clean_2 == toUpper
contains = String.Contains(string=clean_2, searchFor=code_block)

# group: Importación/exportación de CSV > Comprobación de palabras clave (contiene cualquier palabra clave)
# Comprueba si cada nombre contiene al menos una palabra clave aprobada. Genera una lista booleana en la que cada elemento se corresponde con el nombre coincidente.
getItemAtIndex_3 = List.GetItemAtIndex(list=code_block_2, index=code_block_3)
contains_2 = String.Contains(string=clean_2, searchFor=getItemAtIndex_3)
getItemAtIndex_4 = List.GetItemAtIndex(list=code_block_2, index=code_block_4)
contains_3 = String.Contains(string=clean_2, searchFor=getItemAtIndex_4)
or_ = Or(bool0=contains_2, bool1=contains_3)
getItemAtIndex_5 = List.GetItemAtIndex(list=code_block_2, index=code_block_5)
contains_4 = String.Contains(cadena=clean_2, searchFor=getItemAtIndex_5)
or_2 = Or(bool0=or_, bool1=contains_4)

# group: Importación/exportación de CSV > Combinar comprobaciones en la máscara final
# Combina todos los resultados de las reglas en una máscara booleana final utilizando la lógica "and". Esta máscara define si cada nombre es válido o no.
and_ = And(bool0=eq, bool1=contains)
and_2 = And(bool0=and_, bool1=or_2)

# group: Importación/exportación de CSV > Nombres válidos frente a no válidos
# Salidas: divide la lista de nombres de entrada en resultados válidos e inválidos en función de la máscara final.
filterByBoolMask = List.FilterByBoolMask(list=clean_2, mask=and_2)

# group: Importación/exportación de CSV > Depuración y resumen
# Comprobaciones visuales para confirmar entradas, reglas y salidas.
nombres_válidos = Watch(filterByBoolMask.in)
nombres_no_válidos = Watch(filterByBoolMask.out)

# group: Importación/exportación de CSV > Exportar a CSV
# Exporta los conjuntos válidos de nombres.
file_path_3 = Filename("No hay ningún archivo seleccionado.")
exportCSV = Data.ExportCSV(filePath=file_path_3, data=filterByBoolMask.in)

# group: Importación/exportación en Excel > Revisar/suelo agrupado
# Vista previa de los valores agrupados de suelo tras la agrupación por similitud en clúster. Se utiliza para verificar la correcta agrupación y la coherencia en la nomenclatura.
watch_2 = Watch(groupBySimilarity.groupedValues)

# group: Importación/exportación en Excel > Revisar/suelo agrupado
# Vista previa de los valores agrupados de suelo tras la agrupación por similitud en clúster. Se utiliza para verificar la correcta agrupación y la coherencia en la nomenclatura.
watch_3 = Watch(groupBySimilarity.groupedIndices)

# group: Importación/exportación en Excel
# Esta secuencia de comandos importa datos estructurados desde Excel, los procesa y reorganiza según reglas definidas y exporta el resultado transformado para su uso externo. En este flujo de trabajo, se importa una lista de habitaciones, se analiza y se reorganiza por ubicación, agrupando las habitaciones en listas estructuradas según criterios espaciales. A continuación, los datos procesados se exportan para su uso en la coordinación y la elaboración de informes.
integer_slider = IntegerSlider(1, range=0..2 step 1)

# group: Importación/exportación en Excel > Insertar encabezados antes de exportar (opcional)
# Inserta una fila de encabezado al principio de los datos exportados.
# note: Utiliza ClusteredIndices para extraer las filas originales
getItemAtIndex_6 = List.GetItemAtIndex(lista=clean, index=groupBySimilarity.groupedIndices)
flatten = List.Flatten(list=getItemAtIndex_6, amount=integer_slider)
integer_slider_2 = IntegerSlider(0, range=0..2 step 1)
# note: Inserta los encabezados en el índice 0 antes de la exportación
insert = List.Insert(list=flatten, element=deconstruct.primer, index=integer_slider_2)

# group: Importación/exportación en Excel > Revisar/estructura de filas agrupadas
# Comprueba la estructura de filas anidadas antes de aplanar y exportar.
watch_4 = Watch(insert)

# group: Importación/exportación en Excel > Exportar a Excel
# Exporta datos estructurados de Dynamo a Excel (.xlsx). Admite salidas para revisión externa e integración con otras herramientas.
# note: El nombre del archivo de exportación debe terminar por .xlsx
# Si ya existe un archivo con el mismo nombre y "Overwrite" se ha establecido en "false" (falso), la exportación fallará y no se creará ningún archivo nuevo.
# Para reemplazar un archivo existente, la opción "Overwrite" debe estar activada.
ruta_de_archivo = Filename("No hay ningún archivo seleccionado.")
string_2 = StringInput("\"Exportar plano\"")
integer_slider_3 = IntegerSlider(0, range=0..100 step 1)
booleano_2 = BoolSelector(true)
openXMLExportExcel = Data.OpenXMLExportExcel(filePath=ruta_de_archivo, sheetName=string_2, data=insert, startRow=integer_slider_3, startColumn=integer_slider_3, writeAsString=booleano_2)

# group: Importación/exportación de geometría > Importación de geometría
# Importa geometría desde un archivo SAT a Dynamo y la convierte en curvas, superficies y sólidos editables para flujos de trabajo de transformación.
# note: Haga clic en Examinar y seleccione su propio archivo SAT (.sat) antes de ejecutar este gráfico
file_path_4 = Filename("No hay ningún archivo seleccionado.")
archivo_desde_ruta = FileObject(path=file_path_4)
unidades = Units("Meters")
# note: Importa el archivo como sólidos/superficies/curvas de Dynamo
importFromSATWithUnits = Geometry.ImportFromSATWithUnits(file_filePath=archivo_desde_ruta, dynamoUnit=unidades)
watch_3d_vista_previa_de = Watch3D(importFromSATWithUnits)  # "Watch 3D (vista previa de geometría importada)"

# group: Importación/exportación de geometría > Depuración/grupo de aprendizaje
# Muestra lo que Dynamo cree que es cada elemento (sólido, superficie, curva, etc.).
# Resulta útil si las importaciones se comportan de forma inesperada.
type = Object.Type(object=importFromSATWithUnits)
watch_5 = Watch(type)

# group: Importación/exportación de geometría > Transformar
# Ajusta la escala de la geometría importada según un factor uniforme.
XY = Plane.XY()
code_block_6 = CodeBlock { 5; }
scale = Geometry.Scale(geometry=importFromSATWithUnits, plane=XY, xamount=code_block_6, yamount=code_block_6, zamount=code_block_6)

# group: Importación/exportación de geometría > Exportar a SAT
# Exporte la geometría actualizada como un archivo SAT, que se puede importar a AutoCAD, Revit, etc.
file_path_5 = Filename("No hay ningún archivo seleccionado.")
exportToSAT = Geometry.ExportToSAT(geometry=scale, filePath=file_path_5)
watch_3d_vista_previa_de_2 = Watch3D(scale)  # "Watch 3D (vista previa de geometría a escala)"
