# Dynamo graph Import & Export Workflow.dyn "Proces roboczy importowania i eksportowania" (Dynamo 4.0.0.3076)
# author: Dynamo
# Ten dokument pomaga zapoznać się ze sposobami importowania i eksportowania plików programu Excel oraz CSV.

# group: Informacje o wykresie
# Metadane, legenda znaczenia kolorów, reguły nazewnictwa
# note: PROJEKT DODATKU DYNAMO
# Proces roboczy importowania i eksportowania
# note: WERSJA DODATKU DYNAMO
# 4.2.0
# note: WERSJA APLIKACJI HOSTA
# Brak
# note: SKOJARZONE PLIKI
# Brak
# note: WYMAGANE PAKIETY DODATKU DYNAMO
# Brak
# note: AUTORZY / DATA UTWORZENIA
# Archilizer for Dynamo Team / 4 lutego 2026 r.
# note: UWAGI DODATKOWE
# Brak
# note: OPIS
# Ten dokument pomaga zapoznać się ze sposobami importowania i eksportowania plików programu Excel i CSV.
# W danym momencie należy używać tylko jednej metody wprowadzania danych. Wstrzymaj skrypty, które nie są używane.

# group: Przegląd
# DEBUGOWANIE I SPRAWDZANIE DANYCH WEJŚCIOWYCH; WERYFIKACJA WYNIKÓW BEZ WPŁYWANIA NA GŁÓWNE DANE WYJŚCIOWE
# note: ZASTOSOWANIE: kontrole czytelne dla człowieka, dzięki którym można sprawdzić, czy wykres działa zgodnie z oczekiwaniami, bez zmieniania wyników. Obejmuje to między innymi węzły obserwacyjne, węzeł List.Count, ciągi podsumowania, flagi „PASS/FAIL”, listy błędów, geometrię podglądu (Watch3D) i przykładowe dane wyjściowe.

# group: Opisy
# note: ZASTOSOWANIE:
# POZWALA UZYSKAĆ KOMENTARZE I INFORMACJE O SKRYPCIE.

# group: Dane wyjściowe
# KOŃCOWE WYNIKI WYTWARZANE PRZEZ WYKRES, GOTOWE DO EKSPORTU LUB PÓŹNIEJSZEGO UŻYCIA
# note: ZASTOSOWANIE: wyniki końcowe przeznaczone do dalszego użycia (eksportowania, podłączenia do innego wykresu), takie jak listy końcowe, sformatowane ciągi, obliczone wartości, słowniki/tabele, dane gotowe do wyeksportowania

# group: Dane wejściowe
# WARTOŚCI KONTROLOWANE PRZEZ UŻYTKOWNIKA, KTÓRE DEFINIUJĄ DANE DOCELOWE I USTAWIENIA PRZED ROZPOCZĘCIEM PRZETWARZANIA
# note: ZASTOSOWANIE: wszystkie wartości kontrolowane przez użytkownika, które definiują, co wykres będzie przetwarzał i jak powinien się zachowywać.
# Obejmuje to na przykład suwaki liczb, ciągi, ścieżki plików, przełączniki logiczne, listy rozwijane i listy początkowe.

# group: Działania
# OPERACJE PODSTAWOWE, KTÓRE PRZETWARZAJĄ DANE WEJŚCIOWE
# note: ZASTOSOWANIE: główny proces organizacji produkcji, który przekształca dane wejściowe w wyniki. W tym miejscu odbywa się rzeczywista praca, taka jak czyszczenie list, odwzorowywanie, filtrowanie, obliczanie logiki ciągów, wykonywanie operacji na geometrii, formatowanie, konwersja.

# group: Import/eksport plików CSV
# Ten skrypt importuje dane CSV, analizuje je, modyfikuje ich strukturę na podstawie zdefiniowanych reguł nazewnictwa oraz oddziela prawidłowe i nieprawidłowe wpisy w celu przejrzenia i poprawienia. W tym procesie roboczym lista nazw jest przetwarzana przy użyciu logiki sprawdzania poprawności opartej na regułach, sortowana zgodnie z konwencjami nazewnictwa i klasyfikowana na grupy prawidłowych/nieprawidłowych wartości. Prawidłowe nazwy są eksportowane do późniejszego użycia — na przykład w celu koordynacji czy raportowania.
# note: Wskazówki: dodaj węzeł obserwacyjny po wprowadzeniu danych wejściowych, aby sprawdzić, w jaki sposób plik jest importowany.

# group: Importowanie/eksportowanie plików programu Excel > Importuj z programu Excel
# Importuje dane z pliku programu Excel (XLSX) do dodatku Dynamo, przekształcając wiersze i kolumny arkuszy kalkulacyjnych w listy o określonej strukturze na potrzeby przetwarzania, sprawdzania poprawności i manipulowania. Typowe zastosowania obejmują przygotowywanie zestawień, parametrów i ilości dla następczych procesów roboczych.
# note: Przed uruchomieniem tego wykresu kliknij przycisk Przeglądaj i wybierz własny plik programu Excel (.xlsx)
file_path = Filename("Nie wybrano pliku.")
string = StringInput("Arkusz1")
# note: W przypadku odczytywania liczb należy ustawić wartość false.
# Podczas czytania tekstu należy ustawić wartość true.
boolean = BoolSelector(false)
openXMLImportExcel = Data.OpenXMLImportExcel(filePath=file_path, sheetName=string, readAsString=boolean)
# note: Aby odczytać kolumny listy, użyj węzła List.Transpose.
# Aby odczytać wiersze listy, nie transponuj danych.
transpose = List.Transpose()  # unwired: lists

# group: Importowanie/eksportowanie plików programu Excel > Strukturyzacja danych dla programu Excel
# Usuwa wpisy puste i zaziwerające wartości null, a także nagłówki.
# note: Pobierz nagłówki
deconstruct = List.Deconstruct(list=openXMLImportExcel)
boolean_2 = BoolSelector(false)
clean = List.Clean(list=deconstruct.rest, preserveIndices=boolean_2)

# group: Importowanie/eksportowanie plików programu Excel > Grupuj wg podobieństwa
# Przykład manipulacji danymi w programie Excel
transpose_2 = List.Transpose(lists=clean)
blok_kodu_indeks_kolumny = CodeBlock { 1; }
# note: Służy tylko do wyodrębnienia pojedynczej kolumny kluczowej.
getItemAtIndex = List.GetItemAtIndex(list=transpose_2, indeks=blok_kodu_indeks_kolumny)
number = DoubleInput(0)
boolean_3 = BoolSelector(false)
groupBySimilarity = List.GroupBySimilarity(list=getItemAtIndex, tolerance=number, considerAdjacency=boolean_3)

# group: Importowanie/eksportowanie plików programu Excel > Wyodrębnianie słupa kondygnacji
# Potwierdza indeks kolumny.
obserwacja = Watch(getItemAtIndex)

# group: Import/eksport plików CSV > Import CSV
# Importuje dane CSV do dodatku Dynamo i strukturyzuje je na potrzeby opartych na regułach procesów roboczych sprawdzania, sortowania i klasyfikacji.
# note: Przed uruchomieniem tego wykresu kliknij przycisk Przeglądaj i wybierz własny plik CSV (.csv)
file_path_2 = Filename("Nie wybrano pliku.")
boolean_4 = BoolSelector(true)
# note: Aby odczytać kolumny, należy przetransponować listę.
# Jeśli mają być odczytywane wiersze, nie należy transponować listy.
importCSV = Data.ImportCSV(filePath=file_path_2, transpose=boolean_4)

# group: Import/eksport plików CSV > Strukturyzacja danych w pliku CSV
# Strukturyzacja danych: scala i czyści dane wejściowe, dzięki czemu dalsze reguły zawsze otrzymują spójną listę ciągów (bez wartości zerowych i list zagnieżdżonych, w czystym formacie).
deconstruct_2 = List.Deconstruct(list=importCSV)
transpose_3 = List.Transpose(lists=deconstruct_2.rest)
blok_kodu_indeks_kolumny_do = CodeBlock { 0; }  # "Blok kodu (indeks kolumny do odczytu)"
getItemAtIndex_2 = List.GetItemAtIndex(list=transpose_3, index=blok_kodu_indeks_kolumny_do)
boolean_5 = BoolSelector(false)
clean_2 = List.Clean(list=getItemAtIndex_2, preserveIndices=boolean_5)

# group: Import/eksport plików CSV > Przegląd
# Kontroluje wyodrębnianie nagłówków.
obserwacja_nagłówki = Watch(deconstruct_2.first)

# group: Import/eksport plików CSV > Definicje słów kluczowych
# Ustawienia edytowalne przez użytkownika, które definiują reguły nazewnictwa biur używane podczas kontroli (wielkie litery, słowa kluczowe i wymagany separator). Zaktualizuj je, aby były zgodne ze standardem obowiązującym w projekcie lub biurze.
# note: Edytuj tę listę, aby dopasować ją do konwencji nazewnictwa obowiązujących w biurze.
toUpper = String.ToUpper(string=clean_2)
code_block = CodeBlock { "-"; }
code_block_2 = CodeBlock()
# ---------- code_block_2.designscript (2 lines) ----------
// jedna lista wyjściowa
["GA","DET","STRUCT"];
# ----------------------------------------
code_block_3 = CodeBlock { 0; }
code_block_4 = CodeBlock { 1; }
code_block_5 = CodeBlock { 2; }

# group: Import/eksport plików CSV > Kontrola reguł (wielkie litery + separator)
# Generuje logiczne dane wyjściowe (boolean) dla każdej nazwy. Sprawdza, czy poszczególne nazwy są pisane wielkimi literami i czy zawierają wymagany ciąg separatora.
eq = clean_2 == toUpper
contains = String.Contains(string=clean_2, searchFor=code_block)

# group: Import/eksport plików CSV > Kontrola słów kluczowych (czy zawiera dowolne słowo kluczowe)
# Sprawdza, czy każda nazwa zawiera co najmniej jedno zatwierdzone słowo kluczowe. Generuje listę wartości logicznych (boolean), w której każdy element odpowiada pasującej nazwie.
getItemAtIndex_3 = List.GetItemAtIndex(list=code_block_2, index=code_block_3)
contains_2 = String.Contains(string=clean_2, searchFor=getItemAtIndex_3)
getItemAtIndex_4 = List.GetItemAtIndex(list=code_block_2, index=code_block_4)
contains_3 = String.Contains(string=clean_2, searchFor=getItemAtIndex_4)
lub = Or(bool0=contains_2, bool1=contains_3)
getItemAtIndex_5 = List.GetItemAtIndex(list=code_block_2, index=code_block_5)
contains_4 = String.Contains(string=clean_2, searchFor=getItemAtIndex_5)
lub_2 = Or(bool0=lub, bool1=contains_4)

# group: Import/eksport plików CSV > Łączenie kontroli w maskę końcową
# Łączy wszystkie dane wyjściowe reguł w jedną końcową maskę logiczną, używając sumy logicznej. Ta maska określa, czy poszczególne nazwy są prawidłowe, czy nie.
I = And(bool0=eq, bool1=contains)
I_2 = And(bool0=I, bool1=lub_2)

# group: Import/eksport plików CSV > Prawidłowe i nieprawidłowe nazwy
# Dane wyjściowe: dzieli listę nazw danych wejściowych na prawidłowe i nieprawidłowe wyniki na podstawie maski końcowej.
filterByBoolMask = List.FilterByBoolMask(list=clean_2, mask=I_2)

# group: Import/eksport plików CSV > Debugowanie i podsumowanie
# Kontrola wizualna w celu potwierdzenia danych wejściowych, reguł i danych wyjściowych
prawidłowe_nazwy = Watch(filterByBoolMask.in)
nieprawidłowe_nazwy = Watch(filterByBoolMask.out)

# group: Import/eksport plików CSV > Eksportuj do pliku CSV
# Eksportuje zestawy nazw do weryfikacji.
file_path_3 = Filename("Nie wybrano pliku.")
exportCSV = Data.ExportCSV(filePath=file_path_3, data=filterByBoolMask.in)

# group: Importowanie/eksportowanie plików programu Excel > Przegląd / Zgrupowane kondygnacje
# Podgląd zgrupowanych wartości kondygnacji po obliczeniu skupisk podobieństwa. Służy do sprawdzania poprawności spójności grupowania i nazewnictwa.
watch = Watch(groupBySimilarity.groupedValues)

# group: Importowanie/eksportowanie plików programu Excel > Przegląd / Zgrupowane kondygnacje
# Podgląd zgrupowanych wartości kondygnacji po obliczeniu skupisk podobieństwa. Służy do sprawdzania poprawności spójności grupowania i nazewnictwa.
watch_2 = Watch(groupBySimilarity.groupedIndices)

# group: Importowanie/eksportowanie plików programu Excel
# Ten skrypt importuje dane strukturalne z programu Excel, przetwarza je i reorganizuje w oparciu o zdefiniowane reguły, a następnie eksportuje przekształcony wynik do użytku zewnętrznego. W tym procesie roboczym lista pomieszczeń jest importowana, analizowana i zmieniana według położenia, aby pogrupować pomieszczenia w listy o określonej strukturze na podstawie kryteriów przestrzennych. Przetworzone dane są następnie eksportowane na potrzeby koordynacji i raportowania.
integer_slider = IntegerSlider(1, range=0..2 step 1)

# group: Importowanie/eksportowanie plików programu Excel > Wstaw nagłówki przed eksportem (opcjonalnie)
# Wstawia wiersz nagłówka na początku eksportowanych danych.
# note: Używa metody GroupedIndices do pobrania oryginalnych wierszy.
getItemAtIndex_6 = List.GetItemAtIndex(list=clean, index=groupBySimilarity.groupedIndices)
flatten = List.Flatten(list=getItemAtIndex_6, amount=integer_slider)
integer_slider_2 = IntegerSlider(0, range=0..2 step 1)
# note: Wstawia nagłówki w indeksie 0 przed eksportem.
insert = List.Insert(list=flatten, element=deconstruct.first, index=integer_slider_2)

# group: Importowanie/eksportowanie plików programu Excel > Przegląd / Zgrupowana struktura wierszy
# Kontroluje strukturę zagnieżdżonych wierszy przed spłaszczeniem i wyeksportowaniem.
watch_3 = Watch(insert)

# group: Importowanie/eksportowanie plików programu Excel > Eksportuj do programu Excel
# Eksportuje dane strukturalne dodatku Dynamo do pliku programu Excel (XLSX). Obsługuje dane wyjściowe na potrzeby przeglądu zewnętrznego i integracji z innymi narzędziami.
# note: Nazwa eksportowanego pliku musi kończyć się ciągiem „.xlsx”.
# Jeśli plik o tej samej nazwie już istnieje, a opcja Nadpisz ma wartość false, eksport kończy się niepowodzeniem i nie powstaje nowy plik.
# Aby zastąpić istniejący plik, musi być włączona opcja Nadpisz.
ścieżka_pliku = Filename("Nie wybrano pliku.")
string_2 = StringInput("Arkusz eksportu")
integer_slider_3 = IntegerSlider(0, range=0..100 step 1)
boolean_6 = BoolSelector(true)
openXMLExportExcel = Data.OpenXMLExportExcel(filePath=ścieżka_pliku, sheetName=string_2, data=insert, startRow=integer_slider_3, startColumn=integer_slider_3, writeAsString=boolean_6)

# group: Import/eksport geometrii > Import geometrii
# Importuje geometrię z pliku SAT do dodatku Dynamo i przekształca ją w edytowalne krzywe, powierzchnie oraz bryły na potrzeby procesów roboczych transformacji.
# note: Przed uruchomieniem tego wykresu kliknij przycisk Przeglądaj i wybierz własny plik SAT (.sat)
file_path_4 = Filename("Nie wybrano pliku.")
plik_ze_ścieżki = FileObject(path=file_path_4)
jednostki = Units("Meters")
# note: Importuje plik jako bryły/powierzchnie/krzywe dodatku Dynamo.
importFromSATWithUnits = Geometry.ImportFromSATWithUnits(file_filePath=plik_ze_ścieżki, dynamoUnit=jednostki)
obserwacja_3d_podgląd = Watch3D(importFromSATWithUnits)  # "Obserwacja 3D (podgląd zaimportowanej geometrii)"

# group: Import/eksport geometrii > Debugowanie / Grupa szkoleniowa
# Pokazuje, czym według dodatku Dynamo są poszczególne elementy (bryła, powierzchnia, krzywa itp.).
# Jest to przydatne w przypadku nieoczekiwanego zachowania przy imporcie.
type = Object.Type(object=importFromSATWithUnits)
watch_4 = Watch(type)

# group: Import/eksport geometrii > Przekształcenie
# Skaluje zaimportowaną geometrię o równomierny współczynnik.
XY = Plane.XY()
code_block_6 = CodeBlock { 5; }
scale = Geometry.Scale(geometry=importFromSATWithUnits, plane=XY, xamount=code_block_6, yamount=code_block_6, zamount=code_block_6)

# group: Import/eksport geometrii > Eksportuj do pliku SAT
# Eksportuje zaktualizowaną geometrię jako plik SAT, który można zaimportować do programów AutoCAD, Revit itp.
file_path_5 = Filename("Nie wybrano pliku.")
exportToSAT = Geometry.ExportToSAT(geometry=scale, filePath=file_path_5)
obserwacja_3d_podgląd_skalowanej = Watch3D(scale)  # "Obserwacja 3D (podgląd skalowanej geometrii)"
