# Dynamo custom node ProduceChild.dyf (Dynamo 0.6.3.41115)
# category: Misc

parent_xyz = Input()
goal_xyz = Input()
# note: parent fitness
xyz_distance = XyzDistance(parent_xyz, goal_xyz, lacing=Longest)
number = DoubleInput(10)
# note: if this is true then we are in the base case and we return an empty list,
less_than = LessThan(xyz_distance, number)
# note: this is our evaluation function, it returns a new parent - that parent is either the old parent or the new child we just generated, depending on who is more "fit"
number_2 = DoubleInput(0)
list = NewList(index0=number_2)
number_3 = DoubleInput(1)
# note: random number from -1 to 1, python node
random_number_list = RandomList(number_3)
number_4 = DoubleInput(0.5)
subtract = Subtraction(random_number_list, number_4, lacing=Longest)
number_5 = DoubleInput(2)
# note: create a random vector
multiply = Multiplication(subtract, number_5, lacing=Longest)
first_of_list = First(multiply)
# note: only connect to python node to force execution
number_6 = DoubleInput(100)
multiply_2 = Multiplication(first_of_list, number_6, lacing=Longest)
# note: move pt by that vector
XYZ = Xyz(multiply_2, multiply_2, multiply_2, lacing=Longest)
add_xyzs = XyzAdd(parent_xyz, XYZ, lacing=Longest)
# note: child fitness
xyz_distance_2 = XyzDistance(add_xyzs, goal_xyz, lacing=Longest)
decideNewParent = Custom[DecideNewParent](child_fit=xyz_distance_2, parent_fit=xyz_distance, child=add_xyzs, parent=parent_xyz)
# note: recursive call to this node produces another child... THIS IS ACTUALLY THE LIST, since the base case of this node returns an empty list, in all other cases it adds an item to the list and returns the list.
produceChild = Custom[ProduceChild](parent_xyz=decideNewParent.new_parent, goal_xyz=goal_xyz)
add_to_list = List(decideNewParent.new_parent, produceChild)
if_ = Conditional(less_than, list, add_to_list)
child_xyz = Output(if_)
