# Dynamo graph AdaptiveComponent.dyn (Dynamo 0.6.3.20519)

create_list = List.Create()
select_model_element = DSModelElementSelection()  # 1 picked in the model
curve = CurveElement.Curve(select_model_element)
double_slider = DoubleSlider(5, range=0..5)
code_block = CodeBlock(x=double_slider) { 0..1..#x; }
pointAtParameter = Curve.PointAtParameter(curve, code_block, lacing=CrossProduct)
select_model_element_2 = DSModelElementSelection()  # 1 picked in the model
curve_2 = CurveElement.Curve(select_model_element_2)
code_block_2 = CodeBlock(x=double_slider) { 0..1..#x; }
pointAtParameter_2 = Curve.PointAtParameter(curve_2, code_block_2, lacing=CrossProduct)
select_model_element_3 = DSModelElementSelection()  # 1 picked in the model
curve_3 = CurveElement.Curve(select_model_element_3)
code_block_3 = CodeBlock(x=double_slider) { 0..1..#x; }
pointAtParameter_3 = Curve.PointAtParameter(curve_3, code_block_3, lacing=CrossProduct)
combine = Combine(create_list, pointAtParameter, pointAtParameter_2, pointAtParameter_3)
family_types = FamilyTypes(index=2)
byPoints = AdaptiveComponent.ByPoints(combine, family_types, lacing=Longest)
watch = Watch(combine)
