# Dynamo graph AdaptiveComponentByFace.dyn (Dynamo 0.6.3.20519)

select_face = DSFaceSelection()  # 1 picked in the model
surface_domain = DummyNode(select_face, inputCount=1, outputCount=1, legacyNodeName=Dynamo.Nodes.SurfaceDomain, nodeNature=Unresolved)
number = DoubleInput(10)
uv_grid = DummyNode(surface_domain, number, number, inputCount=3, outputCount=1, legacyNodeName=Dynamo.Nodes.UvGrid, nodeNature=Deprecated)
create_list = List.Create()
list_map = Map(uv_grid, create_list)
family_types = FamilyTypes(index=0)
byParametersOnFace = AdaptiveComponent.ByParametersOnFace(list_map, select_face, family_types, lacing=CrossProduct)
watch = Watch(surface_domain)
