# Dynamo graph SurfaceAnalysisDisplay_ByViewAndPointsAndValues.dyn (Dynamo 0.7.2.27088)

views = Views("PointAnalysisDisplay")
select_face = DSFaceSelection()  # 1 picked in the model
code_block = CodeBlock { 0..1..0.05; }
byCoordinates = UV.ByCoordinates(code_block, code_block, lacing=CrossProduct)
number = DoubleInput(1)
count = Count(byCoordinates)
number_range = NumberRange(number, count, number)
string = StringInput("\"Test Point Analysis Display\"")
string_2 = StringInput("\"A test set of values.\"")
unit_types = UnitTypes("Insolation")
byViewFacePointsAndValues = Revit.AnalysisDisplay.FaceAnalysisDisplay.ByViewFacePointsAndValues(views, select_face, byCoordinates, number_range, string, string_2, unit_types)
