# Dynamo graph TestCNWithInput.dyn (Dynamo 1.0.1.1743)

number = DoubleInput(1)
number_2 = DoubleInput(2)
CNWithInput = Custom[CNWithInput](a=number, b=number_2)
code_block = CodeBlock(d=CNWithInput) { d; }
