# Dynamo graph Defect_MAGN_1905.dyn (Dynamo 1.0.1.1743)

boolean = BoolSelector(false)
number = DoubleInput(1)
number_2 = DoubleInput(2)
add = number + number_2  # lacing=Longest
number_3 = DoubleInput(5)
number_4 = DoubleInput(6)
add_2 = number_3 + number_4  # lacing=Longest
if_ = If(test=boolean, true=add, false=add_2)
