# Dynamo graph Defect_MAGN_2555.dyn (Dynamo 0.7.0.26682)

code_block = CodeBlock { Point.ByCoordinates(10,10,0); 5; }
byCenterPointRadius = Sphere.ByCenterPointRadius(code_block.out0, code_block.out1)
code_block_2 = CodeBlock { Vector.ByCoordinates(10,10,10); }
translate = Geometry.Translate(byCenterPointRadius, code_block_2)
