# Dynamo graph Defect_MAGN_3648.dyn (Dynamo 0.7.0.20826)

code_block = CodeBlock { foo(); }
byCoordinates = Point.ByCoordinates(code_block)
code_block_2 = CodeBlock()
# ---------- code_block_2.designscript (6 lines) ----------
def foo()
{
 return = 1;
}

3;
# ----------------------------------------
byCenterPointRadius = Sphere.ByCenterPointRadius(byCoordinates, code_block_2)
