# Dynamo graph Defect_MAGN_3726.dyn (Dynamo 0.7.5.3233)

number = DoubleInput(0..54..10)
string_from_object = FromObject(number)
string = StringInput("a")
concat = String.Concat(arg1=string)
map = List.Map(string_from_object, concat)
