# Dynamo graph Defect_MAGN_942_LessThan.dyn (Dynamo 0.6.3.5252)

number = DoubleInput(4)
less_than = LessThan(arg1=number)
number_2 = DoubleInput(0)
number_3 = DoubleInput(5)
number_4 = DoubleInput(-1)
number_sequence = NumberSeq(number_2, number_3, number_4, lacing=Longest)
watch = Watch(number_sequence)
map = Map(less_than, watch)
watch_2 = Watch(map)
