# Dynamo graph Arc.ByCenterPointRadiusAngle.Array.dyn (Dynamo 1.0.1.1743)

code_block = CodeBlock { 1..100..10; 0; 90; 180; radius=2; }
byCoordinates = Point.ByCoordinates(x=code_block.out0, y=code_block.out1)
code_block_2 = CodeBlock { normal = 1; }
byCoordinates_2 = Vector.ByCoordinates(x=code_block.out1, y=code_block_2, z=code_block.out1)
byCenterPointRadiusAngle = Arc.ByCenterPointRadiusAngle(center=byCoordinates, radius=code_block.radius, startAngle=code_block.out2, endAngle=code_block.out3, normal=byCoordinates_2)
