# Dynamo graph Arc.ByCenterPointStartPointSweepAngle.Array.dyn (Dynamo 1.0.1.1743)

code_block = CodeBlock { 10..100..10; 5; 0; }
byCoordinates = Point.ByCoordinates(x=code_block.out0, y=code_block.out2)
byCoordinates_2 = Point.ByCoordinates(x=code_block.out2, y=code_block.out2)
code_block_2 = CodeBlock { 180; }
byCenterPointStartPointSweepAngle = Arc.ByCenterPointStartPointSweepAngle(byCoordinates, byCoordinates_2, code_block_2)
getSweepAngle = Arc.SweepAngle(byCenterPointStartPointSweepAngle)  # "Arc.getSweepAngle"
getCenterPoint = Arc.CenterPoint(byCenterPointStartPointSweepAngle)  # "Arc.getCenterPoint"
getRadius = Arc.Radius(byCenterPointStartPointSweepAngle)  # "Arc.getRadius"
