# Dynamo graph Arc.ByCenterPointStartPointSweepAngle.Simple.dyn (Dynamo 1.0.1.1743)

code_block = CodeBlock { 0; 5; }
byCoordinates = Point.ByCoordinates(x=code_block.out0, y=code_block.out0)
byCoordinates_2 = Point.ByCoordinates(x=code_block.out1, y=code_block.out0)
code_block_2 = CodeBlock { 180; }
byCenterPointStartPointSweepAngle = Arc.ByCenterPointStartPointSweepAngle(byCoordinates, byCoordinates_2, code_block_2)
getCenterPoint = Arc.CenterPoint(byCenterPointStartPointSweepAngle)  # "Arc.getCenterPoint"
getRadius = Arc.Radius(byCenterPointStartPointSweepAngle)  # "Arc.getRadius"
getSweepAngle = Arc.SweepAngle(byCenterPointStartPointSweepAngle)  # "Arc.getSweepAngle"
