# Dynamo graph BSplineCurve.ByControlVertices.Degree.Simple.dyn (Dynamo 0.6.3.33767)

code_block = CodeBlock { 0; 5; }
byCoordinates = Point.ByCoordinates(code_block.out0, code_block.out0, code_block.out0)
byCoordinates_2 = Point.ByCoordinates(code_block.out1, code_block.out0, code_block.out0)
byCoordinates_3 = Point.ByCoordinates(code_block.out1, code_block.out1, code_block.out0)
byCoordinates_4 = Point.ByCoordinates(code_block.out0, code_block.out1, code_block.out0)
code_block_2 = CodeBlock(p1=byCoordinates, p2=byCoordinates_2, p3=byCoordinates_3, p4=byCoordinates_4) { arrayOfPoints  = {p1,p2,p3,p4}; degree = 2; }
byControlVertices = NurbsCurve.ByControlVertices(code_block_2.arrayOfPoints, code_block_2.degree)
