# Dynamo graph Circle.By2Points.Simple.dyn (Dynamo 0.6.3.21749)

code_block = CodeBlock { Point.ByCoordinates(00,0,0); }
code_block_2 = CodeBlock { 5; 0; }
byCoordinates = Point.ByCoordinates(code_block_2.out0, code_block_2.out0, code_block_2.out1)
code_block_3 = CodeBlock { normal = Vector.ByCoordinates(0,0,1); }
by2Points = Circle.By2Points(code_block, byCoordinates, code_block_3)
