# Dynamo graph Circle.CenterPointRadius.Simple.dyn (Dynamo 0.6.3.21749)

code_block = CodeBlock { p1 = Point.ByCoordinates(00,0,0); }
code_block_2 = CodeBlock { 5; 0; }
byCenterPointRadius = Circle.ByCenterPointRadius(code_block, code_block_2.out0)
