# Dynamo graph Circle.CenterPointRadiusNormal.Simple.dyn (Dynamo 1.0.1.1743)

code_block = CodeBlock { p1 = Point.ByCoordinates(00,0,0); }
code_block_2 = CodeBlock { 5; normal = Vector.ByCoordinates(0,0,1); }
byCenterPointRadius = Circle.ByCenterPointRadius(centerPoint=code_block, radius=code_block_2.out0)
