# Dynamo graph Circle.PropertyCheck.Simple.dyn (Dynamo 0.6.3.21749)

code_block = CodeBlock { Point.ByCoordinates(00,0,0); }
code_block_2 = CodeBlock { 5; 0; }
byCoordinates = Point.ByCoordinates(code_block_2.out0, code_block_2.out0, code_block_2.out1)
code_block_3 = CodeBlock { 10; 0; }
byCoordinates_2 = Point.ByCoordinates(code_block_3.out0, code_block_3.out1, code_block_3.out1)
byPointsOnCurve = Circle.ByPointsOnCurve(code_block, byCoordinates, byCoordinates_2)
centerPoint = Circle.CenterPoint(byPointsOnCurve)
firstPoint = Circle.FirstPoint(byPointsOnCurve)
normal = Circle.Normal(byPointsOnCurve)
pointOnCurve = Circle.PointOnCurve(byPointsOnCurve)
radius = Circle.Radius(byPointsOnCurve)
secondPoint = Circle.SecondPoint(byPointsOnCurve)
thirdPoint = Circle.ThirdPoint(byPointsOnCurve)
