# Dynamo graph CoordinateSystem.ByCylindricalCoordinates.Simple.dyn (Dynamo 0.6.3.12415)

code_block = CodeBlock { Point.ByCoordinates(0,0,0); Vector.ByCoordinates(1,0,0); Vector.ByCoordinates(0,1,0); }
byOriginVectors = CoordinateSystem.ByOriginVectors(code_block.out0, code_block.out1, code_block.out2)
code_block_2 = CodeBlock { radius = 1; theta  = 0..180..60; height = 1; }
byCylindricalCoordinates = CoordinateSystem.ByCylindricalCoordinates(byOriginVectors, code_block_2.radius, code_block_2.theta, code_block_2.height)
