# Dynamo graph Curve.PlaneAtDistance.Simple.dyn (Dynamo 2.0.0.4093)

code_block = CodeBlock()
# ---------- code_block.designscript (4 lines) ----------
point1              = Point.ByCoordinates(0,0,0);
point2              = Point.ByCoordinates(0,10,0);
curve               = Line.ByStartPointEndPoint(point1, point2);
distanceForPlane    = 8;
# ----------------------------------------
planeAtParameter = Curve.PlaneAtParameter(curve=code_block.curve, param=code_block.distanceForPlane)
watch = Watch(planeAtParameter)
origin = Plane.Origin(planeAtParameter)
watch_2 = Watch(origin)
normal = Plane.Normal(planeAtParameter)
watch_3 = Watch(normal)
