# Dynamo graph Curve.PointAtParameter.Surface.dyn (Dynamo 0.6.3.12415)

code_block = CodeBlock()
# ---------- code_block.designscript (3 lines) ----------
l1 = Line.ByStartPointDirectionLength(Point.ByCoordinates(0,0,0), Vector.ByCoordinates(1,0,0), 10);
v1 = Vector.ByCoordinates(0,0,1);
10;
# ----------------------------------------
extrude = Curve.Extrude(code_block.l1, code_block.out2, code_block.v1)
code_block_2 = CodeBlock { 0..1..0.25; }
pointAtParameter = Surface.PointAtParameter(extrude, code_block_2, code_block_2)
