# Dynamo graph Curve.RevolveAsSolid.StartSweep.dyn (Dynamo 0.6.3.33767)

code_block = CodeBlock { 1; 0; 2; 10; }
byCoordinates = Point.ByCoordinates(code_block.out3, code_block.out1, code_block.out1)
byCoordinates_2 = Vector.ByCoordinates(code_block.out1, code_block.out0, code_block.out1)
byCenterPointRadius = Circle.ByCenterPointRadius(byCoordinates, code_block.out2, byCoordinates_2)
byCoordinates_3 = Point.ByCoordinates(code_block.out1, code_block.out1, code_block.out1)
code_block_2 = CodeBlock { Vector.ByCoordinates(0,0,1); 10; }
byStartPointDirectionLength = Line.ByStartPointDirectionLength(byCoordinates_3, code_block_2.out0, code_block_2.out1)
code_block_3 = CodeBlock { 0; 180; }
revolveAsSolid = Curve.RevolveAsSolid(byCenterPointRadius, byStartPointDirectionLength, code_block_3.out0, code_block_3.out1)
