# Dynamo graph Curve.SweepAsSolidAndSurface.dyn (Dynamo 0.6.3.39524)

code_block = CodeBlock { Point.ByCoordinates(0,0,0); Point.ByCoordinates(5,0,5); Point.ByCoordinates(10,0,0); radius = 1; }
byCenterPointRadius = Circle.ByCenterPointRadius(code_block.out0, code_block.radius)
byPointsOnCurve = Arc.ByPointsOnCurve(code_block.out0, code_block.out1, code_block.out2)
sweepAsSolid = Curve.SweepAsSolid(byCenterPointRadius, byPointsOnCurve)
sweepAsSurface = Curve.SweepAsSurface(byCenterPointRadius, byPointsOnCurve)
