# Dynamo graph Geometry.Transform.Simple.dyn (Dynamo 0.6.3.27769)

WCS = CoordinateSystem.WCS()
origin = CoordinateSystem.Origin(WCS)
code_block = CodeBlock { 1; }
byCenterPointRadius = Circle.ByCenterPointRadius(origin, code_block)
code_block_2 = CodeBlock { 3; 10; 0; }
ZAxis = CoordinateSystem.ZAxis(WCS)
extrude = Curve.Extrude(byCenterPointRadius, code_block_2.out0, ZAxis)
scale = CoordinateSystem.Scale(WCS, code_block_2.out0)
translate = Geometry.Translate(scale, code_block_2.out1, code_block_2.out2, code_block_2.out2)
transform = Geometry.Transform(extrude, WCS, translate)
