# Dynamo graph Plane.Offset.Simple.dyn (Dynamo 0.6.3.39524)

code_block = CodeBlock { direction = Vector.ByCoordinates(0,0,1); offset= 10; Point.ByCoordinates(0,0,0); }
byOriginNormal = Plane.ByOriginNormal(code_block.out2, code_block.direction)
offset = Plane.Offset(byOriginNormal, code_block.offset)
visible = Geometry.Visible(offset)
