# Dynamo graph Point.Project.OnSolid.Direction.dyn (Dynamo 0.6.3.33167)

code_block = CodeBlock { Point.ByCoordinates(5,0,0); }
WCS = CoordinateSystem.WCS()
code_block_2 = CodeBlock { 5; }
byLengths = Cuboid.ByLengths(WCS, code_block_2, code_block_2, code_block_2)
project = Point.Project(code_block, byLengths)
code_block_3 = CodeBlock { Vector.ByCoordinates(-1,0,0); }
project_2 = Point.Project(code_block, byLengths, code_block_3)
byStartPointDirectionLength = Line.ByStartPointDirectionLength(code_block, code_block_3, code_block_2)
