# Dynamo graph Point.Project.OnSurface.Direction.dyn (Dynamo 0.6.3.33167)

code_block = CodeBlock { Point.ByCoordinates(3,0,10); Vector.ByCoordinates(0,0,-1); }
WCS = CoordinateSystem.WCS()
origin = CoordinateSystem.Origin(WCS)
code_block_2 = CodeBlock { 3; }
XAxis = CoordinateSystem.XAxis(WCS)
byCenterPointRadius = Circle.ByCenterPointRadius(origin, code_block_2, XAxis)
code_block_3 = CodeBlock { 10; 0; 6; }
translate = Geometry.Translate(origin, code_block_3.out0, code_block_3.out1, code_block_3.out1)
byCenterPointRadius_2 = Circle.ByCenterPointRadius(translate, code_block_3.out2, XAxis)
code_block_4 = CodeBlock(cs1=byCenterPointRadius, cs2=byCenterPointRadius_2) { crossSections = {cs1,cs2}; }
fromCrossSections = LoftedSurface.FromCrossSections(code_block_4)
project = Point.Project(code_block.out0, fromCrossSections)
project_2 = Point.Project(code_block.out0, fromCrossSections, code_block.out1)
