# Dynamo graph Solid.IntersectDifference.dyn (Dynamo 0.6.3.33167)

code_block = CodeBlock()
# ---------- code_block.designscript (4 lines) ----------
WCS = CoordinateSystem.Identity();
//======Establish the context for creating Solid================
firstSolid = Cylinder.ByRadiusHeight(WCS, 50, 2.5);
secondSolid = Cuboid.ByLengths(WCS, 30, 30, 30);
# ----------------------------------------
difference = Solid.Difference(code_block.firstSolid, code_block.secondSolid)
code_block_2 = CodeBlock { 100; 0; -100; }
translate = Geometry.Translate(difference, code_block_2.out0, code_block_2.out1, code_block_2.out1)
intersect = Solid.Intersect(code_block.firstSolid, code_block.secondSolid)
translate_2 = Geometry.Translate(intersect, code_block_2.out2, code_block_2.out1, code_block_2.out1)
