# Dynamo graph Solid.LoftFromCrossSections.Simple.dyn (Dynamo 0.6.3.33167)

code_block = CodeBlock()
# ---------- code_block.designscript (10 lines) ----------
crossSection1 = Circle.By2Points(Point.ByCoordinates(0, 0, 0),
                               Point.ByCoordinates(10, 10, 0),
                               Vector.ByCoordinates(0, 0, 1));
crossSection2 = Circle.By2Points(Point.ByCoordinates(3, 3, 25),
                               Point.ByCoordinates(7, 7, 25),
                               Vector.ByCoordinates(0, 0, 1));
crossSection3 = Circle.By2Points(Point.ByCoordinates(5, 6, 30),
                               Point.ByCoordinates(5, 12, 30),
                               Vector.ByCoordinates(0, 1, 0));
crossSections = { crossSection1, crossSection2, crossSection3 };
# ----------------------------------------
loftFromCrossSections = Solid.LoftFromCrossSections(code_block.crossSections)
code_block_2 = CodeBlock { 0.5; 0; }
pointAtParameter = Curve.PointAtParameter(code_block.crossSection1, code_block_2.out0)
pointAtParameter_2 = Curve.PointAtParameter(code_block.crossSection3, code_block_2.out1)
byStartPointEndPoint = Line.ByStartPointEndPoint(pointAtParameter, pointAtParameter_2)
loftFromCrossSectionsGuides = Solid.LoftFromCrossSectionsGuides(code_block.crossSections, byStartPointEndPoint)
pointAtParameter_3 = Curve.PointAtParameter(code_block.crossSection2, code_block_2.out0)
