# Dynamo graph Solid.Revolve.AxisPointDirection.Simple.dyn (Dynamo 0.6.3.27769)

code_block = CodeBlock { t_5 = 0; t_6 = 10; t_1 = 32; t_2 = 20; t_3 = 1; t_4 = 4; }
byCoordinates = Point.ByCoordinates(code_block.t_1, code_block.t_2, code_block.t_6)
byCoordinates_2 = Vector.ByCoordinates(code_block.t_5, code_block.t_3, code_block.t_3)
byCenterPointRadius = Circle.ByCenterPointRadius(byCoordinates, code_block.t_4, byCoordinates_2)
byCoordinates_3 = Point.ByCoordinates(code_block.t_5, code_block.t_5, code_block.t_5)
byCoordinates_4 = Vector.ByCoordinates(code_block.t_6, code_block.t_6, code_block.t_6)
revolve = Solid.Revolve(byCenterPointRadius, byCoordinates_3, byCoordinates_4)
edges = Solid.Edges(revolve)
