# Dynamo graph Solid.Sweep.Simple.dyn (Dynamo 0.6.3.27769)

WCS = CoordinateSystem.WCS()
origin = CoordinateSystem.Origin(WCS)
code_block = CodeBlock { 2; }
ZAxis = CoordinateSystem.ZAxis(WCS)
byCenterPointRadius = Circle.ByCenterPointRadius(origin, code_block, ZAxis)
code_block_2 = CodeBlock(profile=byCenterPointRadius)
# ---------- code_block_2.designscript (8 lines) ----------
arrayOfPoints   =
{
    profile.CenterPoint,
    profile.CenterPoint.Translate(12, 14, 13),
    profile.CenterPoint.Translate(24, 26, 27),
    Point.ByCoordinates(40, 40, 40)
};
path = NurbsCurve.ByPoints(arrayOfPoints);
# ----------------------------------------
sweep = Solid.Sweep(byCenterPointRadius, code_block_2.path)
sweep_2 = Surface.Sweep(byCenterPointRadius, code_block_2.path)
