# Dynamo graph Solid.Trim.ArrayOfPlanes.Simple.dyn (Dynamo 0.6.3.27769)

WCS = CoordinateSystem.WCS()
code_block = CodeBlock { 3; 10; }
byRadiusHeight = Cylinder.ByRadiusHeight(WCS, code_block.out0, code_block.out1)
code_block_2 = CodeBlock { 0; 2; }
byCoordinates = Point.ByCoordinates(code_block_2.out0, code_block_2.out1, code_block_2.out0)
XAxis = CoordinateSystem.XAxis(WCS)
byOriginNormal = Plane.ByOriginNormal(byCoordinates, XAxis)
byCoordinates_2 = Point.ByCoordinates(code_block_2.out0, code_block_2.out0, code_block_2.out1)
YAxis = CoordinateSystem.YAxis(WCS)
byOriginNormal_2 = Plane.ByOriginNormal(byCoordinates_2, YAxis)
byCoordinates_3 = Point.ByCoordinates(code_block_2.out1, code_block_2.out0, code_block_2.out0)
ZAxis = CoordinateSystem.ZAxis(WCS)
byOriginNormal_3 = Plane.ByOriginNormal(byCoordinates_3, ZAxis)
code_block_3 = CodeBlock(plane1=byOriginNormal, plane2=byOriginNormal_2, plane3=byOriginNormal_3) { planes = {plane1, plane2, plane3}; }
code_block_4 = CodeBlock { 5; -3; }
byCoordinates_4 = Point.ByCoordinates(code_block_4.out0, code_block_4.out1, code_block_4.out0)
# note: Trimming using array of Planes.
trim = Solid.Trim(byRadiusHeight, code_block_3, byCoordinates_4)
# note: Trimming using Single plane
trim_2 = Solid.Trim(byRadiusHeight, byOriginNormal, byCoordinates_4)
