# Dynamo graph Solid.Union.NonManifolSolid.Cells.dyn (Dynamo 0.6.3.27769)

WCS = CoordinateSystem.WCS()
code_block = CodeBlock { 10; 5; }
byLengths = Cuboid.ByLengths(WCS, code_block.out0, code_block.out0, code_block.out0)
translate = Geometry.Translate(WCS, code_block.out1, code_block.out1, code_block.out1)
byLengths_2 = Cuboid.ByLengths(translate, code_block.out0, code_block.out0, code_block.out0)
code_block_2 = CodeBlock { false; }
union = Solid.Union(byLengths, byLengths_2, code_block_2)
cells = NonManifoldSolid.Cells(union)
