# Dynamo graph Solid.Union.NonManifold.Simple.dyn (Dynamo 0.6.3.27769)

code_block = CodeBlock()
# ---------- code_block.designscript (12 lines) ----------
WCS = CoordinateSystem.Identity();
firstSolid = Cylinder.ByRadiusHeight(WCS.Translate(15, 15, 0), 2.5, 50);
ArrayOfSolids   =
{
    firstSolid,
    firstSolid.Translate(-30, 0, 0),
    firstSolid.Translate(-30, -30, 0),
    firstSolid.Translate(0, -30, 0)
};
secondSolid     = Cuboid.ByLengths(WCS, 30, 30, 30);
myUnionSolid = secondSolid.Union(ArrayOfSolids, false);
false;
# ----------------------------------------
union = Solid.Union(code_block.secondSolid, code_block.ArrayOfSolids, code_block.out5)
code_block_2 = CodeBlock { 50; }
translate = Geometry.Translate(union, code_block_2, code_block_2, code_block_2)
