# Dynamo graph Solid.VerticesPropertyCheck.dyn (Dynamo 0.6.3.33767)

code_block = CodeBlock { Point.ByCoordinates(0,0,0); 10; }
byCenterPointRadius = Sphere.ByCenterPointRadius(code_block.out0, code_block.out1)
vertices = Solid.Vertices(byCenterPointRadius)
WCS = CoordinateSystem.WCS()
code_block_2 = CodeBlock { 10; 2; }
byRadiusHeight = Cylinder.ByRadiusHeight(WCS, code_block_2.out1, code_block_2.out0)
vertices_2 = Solid.Vertices(byRadiusHeight)
byLengths = Cuboid.ByLengths(WCS, code_block_2.out0, code_block_2.out0, code_block_2.out0)
vertices_3 = Solid.Vertices(byLengths)
