# Dynamo graph Surface.LoftFromCrossSections.Simple.dyn (Dynamo 0.6.3.27769)

code_block = CodeBlock { 0; 5; rad1 =3; Vector.ByCoordinates(1,0,0); 10; rad2 = 6; param = 0.5; 1; }
byCoordinates = Point.ByCoordinates(code_block.out0, code_block.out0, code_block.out1)
byCenterPointRadius = Circle.ByCenterPointRadius(byCoordinates, code_block.rad1, code_block.out3)
byCoordinates_2 = Point.ByCoordinates(code_block.out4, code_block.out0, code_block.out1)
byCenterPointRadius_2 = Circle.ByCenterPointRadius(byCoordinates_2, code_block.rad2, code_block.out3)
code_block_2 = CodeBlock(cros1=byCenterPointRadius, cross2=byCenterPointRadius_2) { corss = {cros1, cross2}; }
pointAtParameter = Curve.PointAtParameter(byCenterPointRadius, code_block.param)
pointAtParameter_2 = Curve.PointAtParameter(byCenterPointRadius_2, code_block.param)
byStartPointEndPoint = Line.ByStartPointEndPoint(pointAtParameter, pointAtParameter_2)
loftFromCrossSectionsGuides = Surface.LoftFromCrossSectionsGuides(code_block_2, byStartPointEndPoint)
loftFromCrossSections = Surface.LoftFromCrossSections(code_block_2)
