# Dynamo graph Surface.SelectTrim.UsingArrayOfSolids.dyn (Dynamo 0.6.3.27769)

code_block = CodeBlock { 0..5..0.5; 0; 10; }
byCoordinates = Point.ByCoordinates(code_block.out1, code_block.out1, code_block.out1)
byCoordinates_2 = Point.ByCoordinates(code_block.out2, code_block.out1, code_block.out1)
byStartPointEndPoint = Line.ByStartPointEndPoint(byCoordinates, byCoordinates_2)
code_block_2 = CodeBlock { Vector.ByCoordinates(0,1,0); }
extrude = Curve.Extrude(byStartPointEndPoint, code_block.out2, code_block_2)
translate = Geometry.Translate(extrude, code_block.out1, code_block.out1, code_block.out0)
WCS = CoordinateSystem.WCS()
code_block_3 = CodeBlock(WCS)
# ---------- code_block_3.designscript (2 lines) ----------
trimmingSolid   = Cylinder.ByRadiusHeight(WCS.Translate
                                             (3.75..6..#2, 3.75..6..#2, 2.5), 2, 7);
# ----------------------------------------
code_block_4 = CodeBlock { true; false; }
selectTrim = Surface.SelectTrim(translate, code_block_3, code_block_4.out1)
