# Dynamo graph Surface.Trim.ArrayOfCurves.dyn (Dynamo 0.6.3.27769)

code_block = CodeBlock { true; }
WCS = CoordinateSystem.WCS()
origin = CoordinateSystem.Origin(WCS)
XAxis = CoordinateSystem.XAxis(WCS)
code_block_2 = CodeBlock { 10; 2; }
byStartPointDirectionLength = Line.ByStartPointDirectionLength(origin, XAxis, code_block_2.out0)
YAxis = CoordinateSystem.YAxis(WCS)
extrude = Curve.Extrude(byStartPointDirectionLength, code_block_2.out0, YAxis)
code_block_3 = CodeBlock()
# ---------- code_block_3.designscript (5 lines) ----------
curve1 = Circle.ByCenterPointRadius(Point.ByCoordinates(3.75, 3.75, 0), 2);
curve2 = Circle.ByCenterPointRadius(Point.ByCoordinates(6, 6, 0), 2);
arrayOfCurves   = { curve1, curve2 };
selectPoint1 = Point.ByCoordinates(2, 0, 0);
selectPoint2 = Point.ByCoordinates(5, 5, 0);
# ----------------------------------------
code_block_4 = CodeBlock { true; false; }
trim = Surface.Trim(extrude, code_block_3.arrayOfCurves, code_block_3.selectPoint1, code_block_4.out0)
