# Dynamo graph BSplineCurve_AllPointsAreArSamePosition.dyn (Dynamo 1.0.1.1743)

number = DoubleInput(0)
point = Point3DNode(number, lacing=Longest)
create_list = List.Create(point, point, point, point)
BSplineCurve = BSplineCurveNode(create_list, lacing=Longest)
