# Dynamo graph CircleTest.dyn

number = DoubleInput(0)
point = Point3DNode(number, number, number, lacing=Longest)
number_slider = DoubleSliderInput(50, range=0..100)
number_2 = DoubleInput(1)
vector = VectorNode(number, number, number_2, lacing=Longest)
circle_libg = CircleNode(point, number_slider, vector, lacing=Longest)
watch_3d = Watch3D(circle_libg)
