# Dynamo graph CuboidTest.dyn (Dynamo 1.0.1.1743)

number = DoubleInput(1)
vector = VectorNode(number, lacing=Longest)
number_2 = DoubleInput(0)
vector_2 = VectorNode(number_2, lacing=Longest)
number_3 = DoubleInput(0..100..#10)
point = Point3DNode(number_3, lacing=Longest)
coordinateSystem = CoordinateSystemNode(point, lacing=Longest)
cuboid = CuboidNode(coordinateSystem, lacing=Longest)
number_4 = DoubleInput(5)
getItemAtIndex = List.GetItemAtIndex(list=cuboid, index=number_4)
