# Dynamo graph ExtrudCurveTest.dyn (Dynamo 0.6.3.29004)

pi = Pi()
number = DoubleInput(2)
multiply = Multiplication(pi, number, lacing=Longest)
number_2 = DoubleInput(0.01..2..0.01)
multiply_2 = Multiplication(multiply, number_2, lacing=Longest)
sine = Sin(multiply_2, lacing=Longest)
number_3 = DoubleInput(1)
multiply_3 = Multiplication(sine, number_3, lacing=Longest)
watch = Watch(multiply_3)
number_4 = DoubleInput(0)
number_5 = DoubleInput(0)
point = Point3DNode(multiply_3, multiply_3, number_5, lacing=Longest)
get_from_list = GetFromList(number_4, point)
number_6 = DoubleInput(20)
get_from_list_2 = GetFromList(number_6, point)
list = NewList(index0=get_from_list, index1=get_from_list_2)
BSplineCurve = BSplineCurveNode(list, lacing=Longest)
watch_3d = Watch3D(BSplineCurve)
number_7 = DoubleInput(0)
number_8 = DoubleInput(1)
vector = VectorNode(number_7, number_7, number_8, lacing=Longest)
number_9 = DoubleInput(1)
extrude_curve = ExtrudeNode(BSplineCurve, vector, number_9, lacing=Longest)
thicken_surface = ThickenSurfaceNode(extrude_curve, number_9, lacing=Longest)
