# Dynamo graph ExtrudeArrayOfClosedCurves.dyn (Dynamo 1.0.1.1743)

number = DoubleInput(0)
vector = VectorNode(number, lacing=Longest)
number_2 = DoubleInput(0..20..5)
point = Point3DNode(number_2, lacing=Longest)
circle_libg = CircleNode(point, lacing=Longest)
extrude_curve = ExtrudeNode(circle_libg, lacing=Longest)
number_3 = DoubleInput(0)
getItemAtIndex = List.GetItemAtIndex(list=extrude_curve, index=number_3)
number_4 = DoubleInput(1)
number_5 = DoubleInput(2)
number_6 = DoubleInput(10)
