# Dynamo graph ExtrudeArrayOfOpenCurves.dyn (Dynamo 1.0.1.1743)

number = DoubleInput(0)
number_2 = DoubleInput(1..2)
point = Point3DNode(number_2, lacing=CrossProduct)
flatten = Flatten(point)
BSplineCurve = BSplineCurveNode(flatten, lacing=Longest)
extrude_curve = ExtrudeNode(BSplineCurve, lacing=Longest)
watch_3d = Watch3D(extrude_curve)
number_3 = DoubleInput(0)
vector = VectorNode(number_3, lacing=Longest)
number_4 = DoubleInput(3)
number_5 = DoubleInput(1)
