# Dynamo graph Intersect_CuboidAndCuboid.dyn (Dynamo 1.0.1.1743)

number = DoubleInput(0)
vector = VectorNode(number, lacing=Longest)
number_2 = DoubleInput(1)
number_3 = DoubleInput(1)
vector_2 = VectorNode(number_3, lacing=Longest)
number_4 = DoubleInput(0)
number_5 = DoubleInput(4)
number_6 = DoubleInput(0)
vector_3 = VectorNode(number_6, lacing=Longest)
number_7 = DoubleInput(5)
number_8 = DoubleInput(0)
point = Point3DNode(number_8, lacing=Longest)
coordinateSystem = CoordinateSystemNode(point, lacing=Longest)
cuboid = CuboidNode(coordinateSystem, lacing=Longest)
intersect = IntersectNode(cuboid, lacing=Longest)
translate = TranslateNode(intersect, lacing=Longest)
watch_3d = Watch3D(translate)
number_9 = DoubleInput(2)
point_2 = Point3DNode(number_9, lacing=Longest)
coordinateSystem_2 = CoordinateSystemNode(point_2, lacing=Longest)
cuboid_2 = CuboidNode(coordinateSystem_2, lacing=Longest)
number_10 = DoubleInput(0)
vector_4 = VectorNode(number_10, lacing=Longest)
number_11 = DoubleInput(1)
vector_5 = VectorNode(number_11, lacing=Longest)
number_12 = DoubleInput(4)
number_13 = DoubleInput(0)
number_14 = DoubleInput(0)
number_15 = DoubleInput(1)
