# Dynamo graph Intersect_SurfaceAndCuboid.dyn (Dynamo 1.0.1.1743)

number = DoubleInput(3)
point = Point3DNode(number, lacing=Longest)
number_2 = DoubleInput(0)
vector = VectorNode(number_2, lacing=Longest)
number_3 = DoubleInput(0)
number_4 = DoubleInput(1)
number_5 = DoubleInput(0)
point_2 = Point3DNode(number_5, lacing=Longest)
coordinateSystem = CoordinateSystemNode(point_2, lacing=Longest)
cuboid = CuboidNode(coordinateSystem, lacing=Longest)
number_6 = DoubleInput(1)
vector_2 = VectorNode(number_6, lacing=Longest)
number_7 = DoubleInput(0)
number_8 = DoubleInput(4)
number_9 = DoubleInput(0)
number_10 = DoubleInput(4)
number_11 = DoubleInput(-3)
point_3 = Point3DNode(number_11, lacing=Longest)
line_libg = LineNode(point_3, lacing=Longest)
extrude_curve = ExtrudeNode(line_libg, lacing=Longest)
intersect = IntersectNode(extrude_curve, lacing=Longest)
translate = TranslateNode(intersect, lacing=Longest)
number_12 = DoubleInput(0)
vector_3 = VectorNode(number_12, lacing=Longest)
number_13 = DoubleInput(5)
