# Dynamo graph LineArray.dyn

number = DoubleInput(10..100..10)
number_2 = DoubleInput(0)
point = Point3DNode(number, number_2, number_2, lacing=Longest)
number_3 = DoubleInput(10)
point_2 = Point3DNode(number, number_2, number_3, lacing=Longest)
line_libg = LineNode(point, point_2, lacing=Longest)
watch_3d = Watch3D(line_libg)
