# Dynamo graph LoftTest.dyn (Dynamo 1.0.1.1743)

number = DoubleInput(5)
number_2 = DoubleInput(5)
number_3 = DoubleInput(1)
number_4 = DoubleInput(3)
point = Point3DNode(number_4, lacing=Longest)
number_5 = DoubleInput(1..3)
point_2 = Point3DNode(number_5, lacing=Longest)
number_6 = DoubleInput(1)
removeItemAtIndex = List.RemoveItemAtIndex(list=point_2, indices=number_6)
addItemToFront = List.AddItemToFront(item=point, list=removeItemAtIndex)
BSplineCurve = BSplineCurveNode(addItemToFront, lacing=Longest)
number_7 = DoubleInput(1)
point_3 = Point3DNode(number_7, lacing=Longest)
line_libg = LineNode(point_3, lacing=Longest)
create_list = List.Create(BSplineCurve, line_libg)
loftOpenCurve = LoftNode(create_list, lacing=Longest)
watch_3d = Watch3D(loftOpenCurve)
number_8 = DoubleInput(0)
number_9 = DoubleInput(3)
point_4 = Point3DNode(number_9, lacing=Longest)
number_10 = DoubleInput(0)
vector = VectorNode(number_10, lacing=Longest)
closed_bsplinecurve = ClosedBSplineCurveNode(addItemToFront, lacing=Longest)
circle_libg = CircleNode(point_3, lacing=Longest)
create_list_2 = List.Create(closed_bsplinecurve, circle_libg)
loftClosedCurve = LoftNode(create_list_2, lacing=Longest)
watch_3d_2 = Watch3D(loftClosedCurve)
