# Dynamo graph Loft_NegativeScenario.dyn (Dynamo 1.0.1.1743)

number = DoubleInput(0)
point = Point3DNode(number, lacing=Longest)
number_2 = DoubleInput(10)
number_3 = DoubleInput(1)
number_4 = DoubleInput(2)
number_5 = DoubleInput(0)
vector = VectorNode(number_5, lacing=Longest)
point_2 = Point3DNode(number, lacing=Longest)
circle_libg = CircleNode(point_2, lacing=Longest)
line_libg = LineNode(point_2, lacing=Longest)
create_list = List.Create(circle_libg, line_libg)
loft = LoftNode(create_list, lacing=Longest)
