# Dynamo graph Point2D_ArrayOfPoint.dyn (Dynamo 0.7.0.29004)

number = DoubleInput(0)
number_2 = DoubleInput(1..10)
number_3 = DoubleInput(1..10)
point_2d = Point2DNode(number_2, number_3, lacing=Longest)
get_from_list = GetFromList(number, point_2d)
watch = Watch(get_from_list)
