# Dynamo graph Point3DTest.dyn (Dynamo 1.0.1.1743)

number = DoubleInput(0)
point = Point3DNode(number, lacing=Longest)
point_x = PointXNode(point, lacing=Longest)
point_y = PointYNode(point, lacing=Longest)
point_z = PointZNode(point, lacing=Longest)
PI = Math.PI()
