# Dynamo graph PointAtDistanceTest.dyn (Dynamo 1.0.1.1743)

number = DoubleInput(-3)
number_2 = DoubleInput(3)
number_3 = DoubleInput(6)
number_4 = DoubleInput(9)
number_5 = DoubleInput(0)
point = Point3DNode(number_5, lacing=Longest)
number_6 = DoubleInput(0)
point_2 = Point3DNode(number_6, lacing=Longest)
number_7 = DoubleInput(0)
point_3 = Point3DNode(number_7, lacing=Longest)
number_8 = DoubleInput(0)
point_4 = Point3DNode(number_8, lacing=Longest)
create_list = List.Create(point, point_2, point_3, point_4)
BSplineCurve = BSplineCurveNode(create_list, lacing=Longest)
watch_3d = Watch3D(BSplineCurve)
number_9 = DoubleInput(10)
vector = VectorNode(number_9, lacing=Longest)
number_10 = DoubleInput(0)
length_libg = LengthNode(BSplineCurve, lacing=Longest)
number_11 = DoubleInput(0..x..#10, length_libg, lacing=Longest)
translate = TranslateNode(BSplineCurve, lacing=Longest)
point_at_distance = PointAtDistanceNode(translate, lacing=Longest)
number_12 = DoubleInput(6)
getItemAtIndex = List.GetItemAtIndex(list=point_at_distance, index=number_12)
line_libg = LineNode(getItemAtIndex, lacing=Longest)
watch_3d_2 = Watch3D(line_libg)
point_at_distance_2 = PointAtDistanceNode(BSplineCurve, lacing=Longest)
number_13 = DoubleInput(3)
getItemAtIndex_2 = List.GetItemAtIndex(list=point_at_distance_2, index=number_13)
