# Dynamo graph PointAtParameter_SimpleTest.dyn (Dynamo 0.6.2.25053)

number = DoubleInput(0)
number_2 = DoubleInput(0)
formula = Formula("270+30", lacing=Longest)
number_3 = DoubleInput(5)
number_range = NumberRange(number_2, formula, number_3, lacing=Longest)
number_4 = DoubleInput(3)
multiply = Multiplication(number_range, number_4, lacing=Longest)
formula_2 = Formula("x*0.017453", x=multiply, lacing=Longest)
sine = Sin(formula_2, lacing=Longest)
number_5 = DoubleInput(-5)
multiply_2 = Multiplication(sine, number_5, lacing=Longest)
number_6 = DoubleInput(0)
point = Point3DNode(number_range, multiply_2, number_6, lacing=Longest)
BSplineCurve = BSplineCurveNode(point, lacing=Longest)
number_7 = DoubleInput(0..1..#20)
point_at_parameter = PointAtParameterNode(BSplineCurve, number_7, lacing=Longest)
get_from_list = GetFromList(number, point_at_parameter)
number_8 = DoubleInput(18)
get_from_list_2 = GetFromList(number_8, point_at_parameter)
line_libg = LineNode(get_from_list, get_from_list_2, lacing=Longest)
length_libg = LengthNode(line_libg, lacing=Longest)
