# Dynamo graph Polygon_AllPointsAreLinear.dyn (Dynamo 1.0.1.1743)

number = DoubleInput(0)
point = Point3DNode(number, lacing=Longest)
number_2 = DoubleInput(10)
point_2 = Point3DNode(number_2, lacing=Longest)
number_3 = DoubleInput(5)
point_3 = Point3DNode(number_3, lacing=Longest)
create_list = List.Create(point, point_2, point_3)
polygon = PolygonNode(create_list, lacing=Longest)
