# Dynamo graph PropertycheckTest.dyn (Dynamo 1.0.1.1743)

number = DoubleInput(-5)
number_2 = DoubleInput(0)
point = Point3DNode(number_2, lacing=Longest)
circle_libg = CircleNode(point, lacing=Longest)
number_3 = DoubleInput(1)
vector = VectorNode(number_2, lacing=Longest)
number_4 = DoubleInput(5)
point_2 = Point3DNode(number_4, lacing=Longest)
number_5 = DoubleInput(10)
point_3 = Point3DNode(number_5, lacing=Longest)
number_6 = DoubleInput(15)
point_4 = Point3DNode(number_6, lacing=Longest)
number_7 = DoubleInput(20)
point_5 = Point3DNode(number_7, lacing=Longest)
create_list = List.Create(point, point_2, point_3, point_4, point_5)
BSplineCurve = BSplineCurveNode(create_list, lacing=Longest)
sweep_as_surface = SweepAsSurfaceNode(BSplineCurve, lacing=Longest)
area = AreaNode(sweep_as_surface, lacing=Longest)
length_libg = LengthNode(BSplineCurve, lacing=Longest)
