# Dynamo graph SweeAsSurface_AnotherTest.dyn (Dynamo 1.0.1.1743)

number = DoubleInput(0)
point = Point3DNode(number, lacing=Longest)
number_2 = DoubleInput(1)
number_3 = DoubleInput(10)
number_4 = DoubleInput(0)
point_2 = Point3DNode(number_4, lacing=Longest)
circle_libg = CircleNode(point_2, lacing=Longest)
number_5 = DoubleInput(0)
vector = VectorNode(number_5, lacing=Longest)
number_6 = DoubleInput(1)
number_7 = DoubleInput(5)
point_3 = Point3DNode(number, lacing=Longest)
line_libg = LineNode(point_3, lacing=Longest)
sweep_as_surface = SweepAsSurfaceNode(line_libg, lacing=Longest)
watch_3d = Watch3D(sweep_as_surface)
