# Dynamo graph SweepAsSolidTest.dyn (Dynamo 1.0.1.1743)

number = DoubleInput(-5)
number_2 = DoubleInput(0)
point = Point3DNode(number_2, lacing=Longest)
number_3 = DoubleInput(5)
point_2 = Point3DNode(number_3, lacing=Longest)
number_4 = DoubleInput(10)
point_3 = Point3DNode(number_4, lacing=Longest)
number_5 = DoubleInput(15)
point_4 = Point3DNode(number_5, lacing=Longest)
number_6 = DoubleInput(20)
point_5 = Point3DNode(number_6, lacing=Longest)
create_list = List.Create(point, point_2, point_3, point_4, point_5)
BSplineCurve = BSplineCurveNode(create_list, lacing=Longest)
watch_3d = Watch3D(BSplineCurve)
circle_libg = CircleNode(point, lacing=Longest)
number_7 = DoubleInput(1)
vector = VectorNode(number_2, lacing=Longest)
watch_3d_2 = Watch3D(create_list)
sweep_as_solid = SweepAsSolidNode(BSplineCurve, lacing=Longest)
watch_3d_3 = Watch3D(sweep_as_solid)
length_libg = LengthNode(BSplineCurve, lacing=Longest)
