# Dynamo graph Sweep_NegativeScenario.dyn (Dynamo 1.0.1.1743)

number = DoubleInput(0)
point = Point3DNode(number, lacing=Longest)
circle_libg = CircleNode(point, lacing=Longest)
number_2 = DoubleInput(2)
number_3 = DoubleInput(0)
number_4 = DoubleInput(1)
vector = VectorNode(number_4, lacing=Longest)
number_5 = DoubleInput(2)
number_6 = DoubleInput(1)
number_7 = DoubleInput(0)
vector_2 = VectorNode(number_7, lacing=Longest)
number_8 = DoubleInput(0)
point_2 = Point3DNode(number_8, lacing=Longest)
circle_libg_2 = CircleNode(point_2, lacing=Longest)
sweep_as_surface = SweepAsSurfaceNode(circle_libg_2, lacing=Longest)
