# Dynamo graph ThickenSurface_InputIncorrectGeometry.dyn (Dynamo 1.0.1.1743)

number = DoubleInput(0)
vector = VectorNode(number, lacing=Longest)
number_2 = DoubleInput(1)
vector_2 = VectorNode(number_2, lacing=Longest)
number_3 = DoubleInput(0)
point = Point3DNode(number_3, lacing=Longest)
coordinateSystem = CoordinateSystemNode(point, lacing=Longest)
cuboid = CuboidNode(coordinateSystem, lacing=Longest)
thicken_surface = ThickenSurfaceNode(cuboid, lacing=Longest)
number_4 = DoubleInput(0.1)
number_5 = DoubleInput(10)
