# Dynamo graph TranslateTest_SingleObject.dyn (Dynamo 1.0.1.1743)

number = DoubleInput(-5)
number_2 = DoubleInput(0)
point = Point3DNode(number_2, lacing=Longest)
circle_libg = CircleNode(point, lacing=Longest)
number_3 = DoubleInput(1)
vector = VectorNode(number_2, lacing=Longest)
number_4 = DoubleInput(0)
vector_2 = VectorNode(number_4, lacing=Longest)
number_5 = DoubleInput(2)
number_6 = DoubleInput(5)
point_2 = Point3DNode(number_6, lacing=Longest)
number_7 = DoubleInput(10)
point_3 = Point3DNode(number_7, lacing=Longest)
number_8 = DoubleInput(15)
point_4 = Point3DNode(number_8, lacing=Longest)
number_9 = DoubleInput(20)
point_5 = Point3DNode(number_9, lacing=Longest)
create_list = List.Create(point, point_2, point_3, point_4, point_5)
BSplineCurve = BSplineCurveNode(create_list, lacing=Longest)
sweep_as_solid = SweepAsSolidNode(BSplineCurve, lacing=Longest)
translate = TranslateNode(sweep_as_solid, lacing=Longest)
watch_3d = Watch3D(translate)
