# Dynamo graph TrimTest_UsingTwoSurface.dyn (Dynamo 1.0.1.1743)

number = DoubleInput(0)
point = Point3DNode(number, lacing=Longest)
circle_libg = CircleNode(point, lacing=Longest)
extrude_curve = ExtrudeNode(circle_libg, lacing=Longest)
number_2 = DoubleInput(1)
number_3 = DoubleInput(0)
vector = VectorNode(number_3, lacing=Longest)
number_4 = DoubleInput(1)
number_5 = DoubleInput(10)
number_6 = DoubleInput(-3..6..#2)
point_2 = Point3DNode(number_6, lacing=Longest)
BSplineCurve = BSplineCurveNode(point_2, lacing=Longest)
number_7 = DoubleInput(-3..6..#2)
point_3 = Point3DNode(number_7, lacing=Longest)
BSplineCurve_2 = BSplineCurveNode(point_3, lacing=Longest)
create_list = List.Create(BSplineCurve, BSplineCurve_2)
patch = PatchNode(create_list, lacing=Longest)
trim = TrimNode(patch, lacing=Longest)
translate = TranslateNode(trim, lacing=Longest)
watch_3d = Watch3D(translate)
number_8 = DoubleInput(-5)
number_9 = DoubleInput(0)
number_10 = DoubleInput(-5)
number_11 = DoubleInput(0)
number_12 = DoubleInput(5)
number_13 = DoubleInput(2)
point_4 = Point3DNode(number_13, lacing=Longest)
number_14 = DoubleInput(0)
number_15 = DoubleInput(0)
number_16 = DoubleInput(10)
vector_2 = VectorNode(number_16, lacing=Longest)
