# Dynamo graph VectorTest.dyn (Dynamo 1.0.1.1743)

number = DoubleInput(1)
vector = VectorNode(number, lacing=Longest)
number_2 = DoubleInput(1)
number_3 = DoubleInput(0)
point = Point3DNode(number_3, lacing=Longest)
coordinateSystem = CoordinateSystemNode(point, lacing=Longest)
number_4 = DoubleInput(0)
vector_2 = VectorNode(number_4, lacing=Longest)
# note: Vector property check
vector_x = VectorXNode(vector_2, lacing=Longest)
vector_y = VectorYNode(vector_2, lacing=Longest)
vector_z = VectorZNode(vector_2, lacing=Longest)
