# Dynamo graph Vector_UsingCrossProduct.dyn (Dynamo 1.0.1.1743)

number = DoubleInput(0)
number_2 = DoubleInput(0)
point = Point3DNode(number_2, lacing=Longest)
circle_libg = CircleNode(point, lacing=Longest)
number_3 = DoubleInput(0.5)
number_4 = DoubleInput(1..2)
vector = VectorNode(number_4, lacing=CrossProduct)
number_5 = DoubleInput(1)
getItemAtIndex = List.GetItemAtIndex(list=vector, index=number_5)
