# Dynamo graph ZeroLengthLine.dyn (Dynamo 1.0.1.1743)

number = DoubleInput(0)
point = Point3DNode(number, lacing=Longest)
line_libg = LineNode(point, lacing=Longest)
point_2 = Point3DNode(number, lacing=Longest)
