# Dynamo graph longest_shortest_lacing.dyn (Dynamo 2.17.0.2655)

code_block = CodeBlock { 1..20; 3..100; }
byCoordinates = Point.ByCoordinates(x=code_block.out0, y=code_block.out1, lacing=Longest)
count = List.Count(list=byCoordinates)
byCoordinates_2 = Point.ByCoordinates(x=code_block.out0, y=code_block.out1, lacing=Shortest)
count_2 = List.Count(list=byCoordinates_2)
code_block_2 = CodeBlock { 5; }
chop = List.Chop(list=byCoordinates_2, lengths=code_block_2)
firstItem = List.FirstItem(list=chop, lacing=Shortest)
chop_2 = List.Chop(list=byCoordinates, lengths=code_block_2)
firstItem_2 = List.FirstItem(list=chop_2, lacing=Longest)
code_block_3 = CodeBlock(t1=chop_2, t3=chop) { t2 = DSCore.List.FirstItem(t1<1L>); t4 = DSCore.List.FirstItem(t3<1>); }
firstItem_3 = List.FirstItem(list=chop)
