# Dynamo graph lotsofcoloredstuff-simplified.dyn (Dynamo 2.17.0.2705)

code_block = CodeBlock { 0..50..2; }
byCoordinates = Point.ByCoordinates(x=code_block, y=code_block, z=code_block, lacing=CrossProduct)
code_block_2 = CodeBlock { 0.7; }
byCenterPointRadius = Sphere.ByCenterPointRadius(centerPoint=byCoordinates, radius=code_block_2)
byLengths = Cuboid.ByLengths(origin=byCoordinates)
edges = Topology.Edges(topology=byLengths)
curveGeometry = Edge.CurveGeometry(edge=edges)
byCenterPointRadius_2 = Circle.ByCenterPointRadius(centerPoint=byCoordinates, radius=code_block_2)
