# Dynamo graph WatchTree.dyn "dyn-4843-2" (Dynamo 2.15.0.4991)

watch = Watch()  # unwired: arg0
code_block = CodeBlock { 1; }
watch_2 = Watch(code_block)
code_block_2 = CodeBlock { "I'm a really long string that forms a single entry to a watch node and stuff"; }
watch_3 = Watch(code_block_2)
code_block_3 = CodeBlock()
# ---------- code_block_3.designscript (8 lines) ----------
[
	"Hi",
	"Hola",
	"Kia ora",
	"Privyet",
	"Salut",
	"Ciao"
];
# ----------------------------------------
watch_4 = Watch(code_block_3)
code_block_4 = CodeBlock { 1; }
color_rangex = ColorRange(value=code_block_4)  # unwired: colors, indices
