# Dynamo graph MAGN_5155_CrashCurveDivideByLengthFromParameter.dyn (Dynamo 0.7.4.3191)

number = DoubleInput(5)
byCoordinates = Point.ByCoordinates(number)
byCoordinates_2 = Point.ByCoordinates(arg1=number)
number_2 = DoubleInput(10)
byCoordinates_3 = Point.ByCoordinates(number_2, number_2)
byThreePoints = Arc.ByThreePoints(byCoordinates, byCoordinates_2, byCoordinates_3)
number_3 = DoubleInput(25)
byCoordinates_4 = Point.ByCoordinates(number_3)
code_block = CodeBlock { 1; }
tangentAtParameter = Curve.TangentAtParameter(byThreePoints, code_block)
byStartPointEndPointStartTangent = Arc.ByStartPointEndPointStartTangent(byCoordinates_3, byCoordinates_4, tangentAtParameter)
create = List.Create(byThreePoints, byStartPointEndPointStartTangent)
byJoinedCurves = PolyCurve.ByJoinedCurves(create)
divideByLengthFromParameter = Curve.DivideByLengthFromParameter(byJoinedCurves)
