# Dynamo graph Transpose.dyn (Dynamo 0.7.5.3327)

# note: Transpose switches the "rows" and "columns" of a two dimensional list.
number = DoubleInput(0..10)
byCoordinates = Point.ByCoordinates(number, number, lacing=CrossProduct)
byPoints = NurbsCurve.ByPoints(byCoordinates)
transpose = List.Transpose(byCoordinates)
