# Dynamo graph SmileyFace.dyn (Dynamo 0.7.6.4190)

code_block = CodeBlock()
# ---------- code_block.designscript (5 lines) ----------
def Remap(value,oldMin,oldMax,newMin,newMax)
{
a = (value - oldMin) / (oldMax - oldMin);
return = a * (newMax - newMin) + newMin;
};
# ----------------------------------------
code_block_2 = CodeBlock { Point.ByCoordinates(40,0,40); Point.ByCoordinates(-40,0,40); 50; }
byCenterPointRadius = Sphere.ByCenterPointRadius(code_block_2.out0, code_block_2.out2)
byCenterPointRadius_2 = Sphere.ByCenterPointRadius(code_block_2.out1, code_block_2.out2)
difference = Solid.Difference(byCenterPointRadius, byCenterPointRadius_2)
explode = Geometry.Explode(difference)
difference_2 = Solid.Difference(byCenterPointRadius_2, byCenterPointRadius)
explode_2 = Geometry.Explode(difference_2)
code_block_3 = CodeBlock(x=explode, y=explode_2) { {x[0],y[0]}; }
byJoinedSurfaces = Solid.ByJoinedSurfaces(code_block_3)
code_block_4 = CodeBlock { Point.ByCoordinates(10,11,48); Point.ByCoordinates(10,-11,48); 6; }
code_block_5 = CodeBlock(pt1=code_block_4.out0, pt2=code_block_4.out1) { vec = Vector.ByCoordinates(-20,0,0); pt1.Add(vec); pt2.Add(vec); }
byPointsRadius = Cylinder.ByPointsRadius(code_block_4.out0, code_block_5.out1, code_block_4.out2)
byPointsRadius_2 = Cylinder.ByPointsRadius(code_block_4.out1, code_block_5.out2, code_block_4.out2)
happy_sad = DoubleSlider(1, range=-1..1 step 0.1)
code_block_6 = CodeBlock(x=happy_sad)
# ---------- code_block_6.designscript (18 lines) ----------
// top point
top = Point.ByCoordinates(10,0,30);

// bottom point
botFactor = Remap(x,-1,1,3,0);
bot = Point.ByCoordinates(10,0,22+botFactor);

// Circle for mouth corners to travel along
center = Point.ByCoordinates(10,0,40);
cir = Circle.ByCenterPointRadiusNormal(center,21,Vector.XAxis());

// left point
leftParam = Remap(x,-1,1,0.82,0.95);
left = cir.PointAtParameter(leftParam);

// right point
rightParam = Remap(x,-1,1,0.68,0.55);
right = cir.PointAtParameter(rightParam);
# ----------------------------------------
create = List.Create(code_block_6.left, code_block_6.bot, code_block_6.right)
byPoints = NurbsCurve.ByPoints(create)
create_2 = List.Create(code_block_6.left, code_block_6.top, code_block_6.right)
byPoints_2 = NurbsCurve.ByPoints(create_2)
create_3 = List.Create(byPoints, byPoints_2)
byJoinedCurves = PolyCurve.ByJoinedCurves(create_3)
extrudeAsSolid = Curve.ExtrudeAsSolid(byJoinedCurves, code_block_5.vec)
create_4 = List.Create(byPointsRadius, byPointsRadius_2, extrudeAsSolid)
unionAll = Solid.UnionAll(byJoinedSurfaces, create_4)
