# Dynamo graph RandomModel_V3.dyn (Dynamo 0.7.0.3446)

code_block = CodeBlock { 0; 25; -10; -15; -20; -25; 50; }
byCoordinates = Point.ByCoordinates(code_block.out0, code_block.out0, code_block.out0)
code_block_2 = CodeBlock { 0; 0.5; }
byCoordinates_2 = Point.ByCoordinates(code_block.out2, code_block.out1, code_block.out0)
byCoordinates_3 = Point.ByCoordinates(code_block.out0, code_block.out6, code_block.out0)
code_block_3 = CodeBlock(p1=byCoordinates, p2=byCoordinates_2, p3=byCoordinates_3) { arrayOfPoints = {p1,p2,p3}; }
byPoints = NurbsCurve.ByPoints(code_block_3)
byCoordinates_4 = Point.ByCoordinates(code_block.out3, code_block.out1, code_block.out0)
code_block_4 = CodeBlock(p11=byCoordinates, p12=byCoordinates_4, p13=byCoordinates_3) { arrayOfPoints1 = {p11,p12,p13}; }
byPoints_2 = NurbsCurve.ByPoints(code_block_4)
byCoordinates_5 = Point.ByCoordinates(code_block.out5, code_block.out1, code_block.out0)
code_block_5 = CodeBlock(p31=byCoordinates, p32=byCoordinates_5, p33=byCoordinates_3) { arrayOfPoints3 = {p31,p32,p33}; }
byPoints_3 = NurbsCurve.ByPoints(code_block_5)
byCoordinates_6 = Point.ByCoordinates(code_block.out4, code_block.out1, code_block.out0)
code_block_6 = CodeBlock(p21=byCoordinates, p22=byCoordinates_6, p23=byCoordinates_3) { arrayOfPoints2 = {p21,p22,p23}; }
byPoints_4 = NurbsCurve.ByPoints(code_block_6)
code_block_7 = CodeBlock(ar1=byPoints, ar2=byPoints_2, ar3=byPoints_3, ar4=byPoints_4) { arcs = {ar1,ar2,ar3,ar4}; angles = {70,40,115,145}; }
byCoordinates_7 = Point.ByCoordinates(code_block.out0, code_block.out1, code_block.out0)
code_block_8 = CodeBlock { Vector.ByCoordinates(0,1,0); 70; 40; 115; 145; }
rotate = Geometry.Rotate(code_block_7.arcs, byCoordinates_7, code_block_8.out0, code_block_7.angles)
tangentAtParameter = Curve.TangentAtParameter(rotate, code_block_2.out0)
byCenterPointRadiusNormal = Circle.ByCenterPointRadiusNormal(byCoordinates, code_block_2.out1, tangentAtParameter)
bySweep = Solid.BySweep(byCenterPointRadiusNormal, rotate)
code_block_9 = CodeBlock(array=rotate) { array; array[0]; array[1]; array[2]; array[3]; }
integer_slider = IntegerSlider(68, range=10..100)
code_block_10 = CodeBlock(x=integer_slider) { 0..1..#x; }
pointAtParameter = Curve.PointAtParameter(code_block_9.out2, code_block_10)
code_block_11 = CodeBlock(y=integer_slider) { {0, y-1}; }
removeItemAtIndex = List.RemoveItemAtIndex(pointAtParameter, code_block_11)
code_block_12 = CodeBlock { 0.15; }
byCenterPointRadius = Circle.ByCenterPointRadius(removeItemAtIndex, code_block_12)
pointAtParameter_2 = Curve.PointAtParameter(code_block_9.out1, code_block_10)
removeItemAtIndex_2 = List.RemoveItemAtIndex(pointAtParameter_2, code_block_11)
pointAtParameter_3 = Curve.PointAtParameter(code_block_9.out3, code_block_10)
removeItemAtIndex_3 = List.RemoveItemAtIndex(pointAtParameter_3, code_block_11)
pointAtParameter_4 = Curve.PointAtParameter(code_block_9.out4, code_block_10)
removeItemAtIndex_4 = List.RemoveItemAtIndex(pointAtParameter_4, code_block_11)
code_block_13 = CodeBlock(b2=removeItemAtIndex, b1=removeItemAtIndex_2, b3=removeItemAtIndex_3, b4=removeItemAtIndex_4) { arrayOfPoints123 = {b2,b1,b3,b4}; }
transpose = Transpose(code_block_13)
byPoints_5 = NurbsCurve.ByPoints(transpose)
bySweep_2 = Solid.BySweep(byCenterPointRadius, byPoints_5)
code_block_14 = CodeBlock { 1; }
byCenterPointRadius_2 = Sphere.ByCenterPointRadius(byCoordinates, code_block_14)
byCenterPointRadius_3 = Sphere.ByCenterPointRadius(byCoordinates_3, code_block_14)
code_block_15 = CodeBlock(curve1=rotate) { surf = {curve1[1],curve1[0],curve1[2],curve1[3]}; }
byLoft = Surface.ByLoft(code_block_15)
