# Dynamo graph TestSurface.Join.dyn (Dynamo 1.0.1.1581)

code_block = CodeBlock { Point.ByCoordinates(0,0,0); Point.ByCoordinates(1,0,0); Point.ByCoordinates(1,1,0); Point.ByCoordinates(0,1,0); }
create = List.Create(code_block.out0, code_block.out1, code_block.out2, code_block.out3)
byPerimeterPoints = Surface.ByPerimeterPoints(create)
YZ = Plane.YZ()
mirror = Geometry.Mirror(geometry=byPerimeterPoints, mirrorPlane=YZ)
byJoinedSurfaces = PolySurface.ByJoinedSurfaces(mirror)
join = Surface.Join(byJoinedSurfaces, byPerimeterPoints)
code_block_2 = CodeBlock { Point.ByCoordinates(1,0,0); Point.ByCoordinates(2,0,0); Point.ByCoordinates(2,1,0); Point.ByCoordinates(1,1,0); }
create_2 = List.Create(code_block_2.out0, code_block_2.out1, code_block_2.out2, code_block_2.out3)
byPerimeterPoints_2 = Surface.ByPerimeterPoints(create_2)
create_3 = List.Create(byPerimeterPoints, byPerimeterPoints_2)
byJoinedSurfaces_2 = PolySurface.ByJoinedSurfaces(create_3)
join_2 = Surface.Join(byJoinedSurfaces, byJoinedSurfaces_2)
