# Dynamo graph Vignette-01-Plane-Offset.dyn (Dynamo 0.8.0.950)

# note: Designate origin on the ground plane
XY = Plane.XY()
width = IntegerSlider(14, range=0..100 step 1)
length = IntegerSlider(22, range=0..100 step 1)
# note: Draw ground rectangle
byWidthHeight = Rectangle.ByWidthHeight(XY, width, length)
height = IntegerSlider(20, range=0..100 step 1)
# note: Offset plane in its +Z direction create roof plane
# note: Draw roof rectangle
offset = Plane.Offset(XY, height)
byWidthHeight_2 = Rectangle.ByWidthHeight(offset, width, length)
