# Dynamo graph multiinputs.dyn (Dynamo 1.0.1.1743)

n1 = CodeBlock { x = 1; }  # "1"
n2 = CodeBlock { y = 2; }  # "2"
n3 = CodeBlock { z=3; }  # "3"
n4 = CodeBlock(x=n1, y=n2, z=n3) { a = x + y + z; }  # "4"
