# Dynamo graph nodes.dyn (Dynamo 1.0.1.1743)

number = DoubleInput(3)
code_block = CodeBlock { a = 1; }
number_2 = DoubleInput(1..10)
code_block_2 = CodeBlock(b=number_2) { x = b; }
cos = Math.Cos(code_block_2)
