# Dynamo graph RebindingMultiDimension.dyn (Dynamo 0.8.1.1161)

string = StringInput("tywin")
string_2 = StringInput("cersei")
string_3 = StringInput("hodor")
join = List.Join(string, string_2, string_3)
number = DoubleInput(0..2)
add = join + number  # lacing=CrossProduct
byString = SampleLibraryZeroTouch.TraceExampleWrapper.ByString(add)
