# Dynamo graph element_binding_customNodes_modified.dyn (Dynamo 3.0.0.5795)

code_block = CodeBlock { 100; }
wrapperObject = FFITarget.WrapperObject.WrapperObject(x=code_block)
ID = FFITarget.WrapperObject.ID(wrapperObject=wrapperObject)
element_binding_nested = Custom[element_binding_nested](someInput=ID)  # testing nested element binding
ID_2 = FFITarget.WrapperObject.ID(wrapperObject=element_binding_nested.out1)
ID_3 = FFITarget.WrapperObject.ID(wrapperObject=element_binding_nested.out2)
