# Dynamo graph TestImperativeWhileLoop.dyn (Dynamo 2.0.0.3900)

code_block = CodeBlock()
# ---------- code_block.designscript (14 lines) ----------
a = 1;
sum = 0;

r = [Imperative]
{
    while (a <= 10)
    {
        sum = sum + a;
        a = a + 1;
    }
    return = sum;
}

x = r;
# ----------------------------------------
watch = Watch(code_block.out3)
