# Dynamo custom node Sequence_Json.dyf "Sequence2" (Dynamo 2.0.0.4397)
# category: Misc

start = Input(start: var[]..[])
end = Input(end: var[]..[])
formula = Formula("x-1", x=end)
step = Input(step: var[]..[])
range = Range(start=start, end=formula, step=step)
Output = Output(range)  # ""
