# Dynamo custom node GraphFunction.dyf (Dynamo 1.0.1.1743)
# category: Logic.Math

number = DoubleInput(0)
byCoordinates = Point.ByCoordinates(z=number, lacing=Longest)
xStart = Input()
xEnd = Input()
xStep = Input()
range = Range(start=xStart, end=xEnd, step=xStep, lacing=Longest)
y = Input(y = f(x))
map = List.Map(list=range, f_x=y)
combine = List.Combine(byCoordinates, range, map)
