# Dynamo graph begin-test.dyn (Dynamo 1.0.1.1743)

string = StringInput("test.txt")
writeText = File.WriteText(string, string)
readText = File.ReadText(string)
perform_all = Begin(expr1=writeText, expr2=readText)
watch = Watch(perform_all)
