# Dynamo graph Dictionary.Values2.dyn (Dynamo 2.15.0.5383)

code_block = CodeBlock { {"a":"foo"}; }
values = DesignScript.Builtin.Dictionary.Values(dictionary=code_block)
code_block_2 = CodeBlock { ["a", "b"]; [1,[1,2]]; }
byKeysValues = DesignScript.Builtin.Dictionary.ByKeysValues(keys=code_block_2.out0, values=code_block_2.out1)
values_2 = DesignScript.Builtin.Dictionary.Values(dictionary=byKeysValues)
