# Dynamo graph CBNWithFormula.dyn (Dynamo 0.7.0.32497)

code_block = CodeBlock { a = 1; b = a; c = b; m = a + b + c; }
formula = Formula("a+b+c", a=code_block.a, b=code_block.b, c=code_block.c)
code_block_2 = CodeBlock(m=formula) { n = m; }
