# Dynamo graph DefaultValue.dyn (Dynamo 0.7.0.32927)

identity = CoordinateSystem.Identity()
double_slider = DoubleSlider(5, range=0..100)
byCoordinates = Vector.ByCoordinates(double_slider, double_slider, double_slider)
translate = CoordinateSystem.Translate(identity, byCoordinates)
origin = CoordinateSystem.Origin(translate)
X = Point.X(origin)
