# Dynamo custom node NestedIFRecursion.dyf (Dynamo 0.7.1.17276)
# category: testCN

x = Input()
code_block = CodeBlock(x=x) { x+1; }
y = Input()
lt = code_block < y
nestedIFRecursion = Custom[NestedIFRecursion](x=code_block, y=y)
if_ = If(lt, nestedIFRecursion, code_block)
code_block_2 = CodeBlock { 2; }
mod = if_ % code_block_2
code_block_3 = CodeBlock { 0; }
eq = mod == code_block_3
code_block_4 = CodeBlock { "even"; }
code_block_5 = CodeBlock { "Odd"; }
if_2 = If(eq, code_block_4, code_block_5)
result = Output(if_2)
