# Dynamo custom node Pass+Nothing+Below+1.dyf "Pass Nothing Below 1" (Dynamo 0.6.3.7993)
# category: buildz
# Takes inputs and only passes 1 or values above 1

x = Input()
number = DoubleInput(1)
less_than = LessThan(x, number)
if_ = Conditional(less_than, number, x)
