# Dynamo custom node SingleIFRecursion.dyf (Dynamo 0.7.1.17276)
# category: CustomNode

a = Input()
code_block = CodeBlock(a=a) { a+1; }
code_block_2 = CodeBlock(a=code_block) { a<5; }
singleIFRecursion = Custom[SingleIFRecursion](a=code_block)
if_ = If(code_block_2, singleIFRecursion, a)
