# Dynamo graph apply_property.dyn (Dynamo 0.7.0.19653)

X = Point.X()
code_block = CodeBlock { 42; }
code_block_2 = CodeBlock { 23; }
byCoordinates = Point.ByCoordinates(code_block, code_block_2)
apply = Apply(X, byCoordinates)
