# Dynamo graph githubissue_3446.dyn (Dynamo 1.0.1.1791)

string = StringInput("""1
2
3
4
5
6""")
string_2 = StringInput("\n")
split = String.Split(string, string_2)
watch = Watch(split)
code_block = CodeBlock()
# ---------- code_block.designscript (2 lines) ----------
"
";
# ----------------------------------------
split_2 = String.Split(string, code_block)
watch_2 = Watch(split_2)
