# Dynamo graph removekey.dyn (Dynamo 1.0.0.413)

code_block = CodeBlock { 1..5; }
code_block_2 = CodeBlock { 4; }
removeKey = RemoveKey(code_block, code_block_2)
code_block_3 = CodeBlock { null; }
removeKey_2 = RemoveKey(code_block_3, code_block_2)
