# Dynamo graph dsfunctions.dyn (Dynamo 0.7.0.18405)

number = DoubleInput(0)
count = DSFunction(number)
add = DSFunction(number, number)
mul = DSFunction()
cos = DSFunction(number)  # "Math.Cos"
PI = DSFunction()  # "Math.PI"
byCoordinates = DSFunction(number, number, number)  # "Point.ByCoordinates"
X = DSFunction(byCoordinates)  # "Point.X"
