# Dynamo graph DataFromFile_2Dimensional.dyn (Dynamo 0.7.0.19361)

file_path = Filename("E:\Github\Dynamo\Dynamo\test\core\excel\2Dimensional.xlsx")
readExcelFile = Excel.ReadExcelFile(file_path)
getWorksheetsFromExcelWorkbook = Excel.GetWorksheetsFromExcelWorkbook(readExcelFile)
firstItem = List.FirstItem(getWorksheetsFromExcelWorkbook)
getDataFromExcelWorksheet = Excel.GetDataFromExcelWorksheet(firstItem)
watch = Watch(getDataFromExcelWorksheet)
