# Dynamo graph DataFromFile_mixedNumbersAndStrings.dyn (Dynamo 0.7.0.17491)

file_path = StringFilename("..\..\..\test\core\excel\mixedNumbersAndStrings.xlsx")
open_excel_workbook = ReadExcelFile(file_path)
get_worksheets_from_excel = GetWorksheetsFromExcelWorkbook(open_excel_workbook)
first_of_list = First(get_worksheets_from_excel)
get_data_from_excel_worksheet = GetDataFromExcelWorksheet(first_of_list)
watch = Watch(get_data_from_excel_worksheet)
