# Dynamo graph Defect_MAGN_883.dyn (Dynamo 0.6.2.20018)

file_path = StringFilename("..\..\..\test\core\excel\Defect_MAGN_883.xlsx")
open_excel_workbook = ReadExcelFile(file_path)
string = StringInput("Z")
get_excel_worksheet_by_name = GetExcelWorksheetByName(open_excel_workbook, string)
get_data_from_excel_worksheet = GetDataFromExcelWorksheet(get_excel_worksheet_by_name)
watch = Watch(get_data_from_excel_worksheet)
