# Dynamo graph Excel_MAGN6872.dyn (Dynamo 0.8.1.1440)

string = StringInput("")
code_block = CodeBlock { "Sheet1"; }
number = DoubleInput(0)
code_block_2 = CodeBlock { 1..3; }
code_block_3 = CodeBlock { 1..5; }
code_block_4 = CodeBlock { 1..7; }
code_block_5 = CodeBlock { 1..5; }
create = List.Create(code_block_2, code_block_3, code_block_4, code_block_5)
writeToFile = Excel.WriteToFile(string, code_block, number, number, create)
