# Dynamo graph ExistingWorkbook_AddWorksheet.dyn (Dynamo 0.7.0.17491)

file_path = StringFilename("..\..\..\test\core\excel\mixedNumbersAndStrings.xlsx")
open_excel_workbook = ReadExcelFile(file_path)
string = StringInput("CoolNewWorksheet")
add_excel_worksheet_to_workbook = AddExcelWorksheetToWorkbook(open_excel_workbook, string)
get_excel_worksheet_by_name = GetExcelWorksheetByName(open_excel_workbook, string)
perform_all = Begin(expr1=add_excel_worksheet_to_workbook, expr2=get_excel_worksheet_by_name)
watch = Watch(perform_all)
