# Dynamo graph HammersmithCSVFile_Open.dyn (Dynamo 0.6.3.32432)

string_to_number = String2Num(lacing=Longest)
number = DoubleInput(0)
string = StringInput(",")
split_string = SplitString(arg1=string)
file_path = StringFilename("C:\Users\boyerp\Dropbox\Github\Autodesk\Dynamo\test\core\excel\Hammersmith_Copy.csv")
read_text_file = FileReader(file_path)
string_2 = StringInput("\n")
split_string_2 = SplitString(read_text_file, string_2)
map = Map(split_string, split_string_2)
remove_from_list = RemoveFromList(number, map)
map_2 = Map(string_to_number, remove_from_list)
