# Dynamo graph HammersmithExcelFile_Open.dyn (Dynamo 1.0.1.1743)

file_path = Filename("..\..\..\test\core\excel\Hammersmith_Copy.csv")
readExcelFile = Excel.ReadExcelFile(file_path)
string = StringInput("Hammersmith_Copy")
getExcelWorksheetByName = Excel.GetExcelWorksheetByName(readExcelFile, string)
getDataFromExcelWorksheet = Excel.GetDataFromExcelWorksheet(getExcelWorksheetByName)
