# Dynamo graph MAGN6872_OpenXml.dyn (Dynamo 2.12.0.4615)

string = StringInput("")
code_block = CodeBlock { "Sheet1"; [1..3,1..5,1..7,1..5]; }
exportOpenXml = Data.ExportOpenXml(filePath=string, sheetName=code_block.out0, data=code_block.out1)
code_block_2 = CodeBlock(a=exportOpenXml) { a; "Sheet1"; }
importOpenXml = Data.ImportOpenXml(filePath=string, sheetName=code_block_2.out1)
