# Dynamo graph MixedNumbersAndStrings_OpenXml.dyn (Dynamo 2.12.0.4564)

file_path = Filename(".\mixedNumbersAndStrings.xlsx")
code_block = CodeBlock { "Sheet1"; }
importOpenXml = Data.ImportOpenXml(filePath=file_path, sheetName=code_block)
