# Dynamo graph MultiColumn_OpenXml.dyn (Dynamo 2.12.0.4557)

file_path = Filename(".\2Dimensional.xlsx")
code_block = CodeBlock { "Sheet1"; }
importOpenXml = Data.ImportOpenXml(filePath=file_path, sheetName=code_block)
