# Dynamo graph NewWorkbook_AddMixed1DData.dyn (Dynamo 0.6.3.21066)

new_excel_workbook = NewExcelWorkbook()
get_worksheets_from_excel = GetWorksheetsFromExcelWorkbook(new_excel_workbook)
first_of_list = First(get_worksheets_from_excel)
string = StringInput("doodle")
number = DoubleInput(0)
number_2 = DoubleInput(21029)
string_2 = StringInput("")
number_3 = DoubleInput(-90)
list = NewList(index0=string, index1=number, index2=number_2, index3=string_2, index4=number_3)
write_data_to_excel_worksheet = WriteDataToExcelWorksheet(first_of_list, arg3=list)
get_data_from_excel_worksheet = GetDataFromExcelWorksheet(write_data_to_excel_worksheet)
watch = Watch(get_data_from_excel_worksheet)
