# Dynamo graph NewWorkbook_AddSingleItemData.dyn (Dynamo 0.6.3.17491)

new_excel_workbook = NewExcelWorkbook()
get_worksheets_from_excel = GetWorksheetsFromExcelWorkbook(new_excel_workbook)
first_of_list = First(get_worksheets_from_excel)
number = DoubleInput(0)
number_2 = DoubleInput(100)
write_data_to_excel_worksheet = WriteDataToExcelWorksheet(first_of_list, number, number, number_2)
get_data_from_excel_worksheet = GetDataFromExcelWorksheet(write_data_to_excel_worksheet)
watch = Watch(get_data_from_excel_worksheet)
