# Dynamo graph NewWorkbook_AddWorksheet.dyn (Dynamo 0.7.0.17491)

new_excel_workbook = NewExcelWorkbook()
string = StringInput("CoolWorksheet")
add_excel_worksheet_to_workbook = AddExcelWorksheetToWorkbook(new_excel_workbook, string)
get_excel_worksheet_by_name = GetExcelWorksheetByName(add_excel_worksheet_to_workbook, string)
watch = Watch(get_excel_worksheet_by_name)
