# Dynamo graph OverWriteExcelSheet_OpenXml.dyn (Dynamo 2.12.0.4626)

string = StringInput("")
code_block = CodeBlock { "Sheet1"; [[999,999,999],[999,999,999],[999,999,999]]; 1; true; }
exportOpenXml = Data.ExportOpenXml(filePath=string, sheetName=code_block.out0, data=code_block.out1, startRow=code_block.out2, startColumn=code_block.out2, overWrite=code_block.out3)
code_block_2 = CodeBlock(a=exportOpenXml) { a; 1; }
importOpenXml = Data.ImportOpenXml(filePath=string, sheetName=code_block.out0, startRow=code_block_2.out1, startColumn=code_block_2.out1)
