# Dynamo graph ReadAndWriteExcel.dyn (Dynamo 0.7.0.24656)

string = StringInput("")
code_block = CodeBlock { "mysheet2"; }
code_block_2 = CodeBlock { 1; }
file_path = Filename("..\..\..\test\core\excel\mixedNumbersAndStrings.xlsx")
code_block_3 = CodeBlock { "Sheet1"; }
read = Excel.Read(file_path, code_block_3)
write = Excel.Write(string, code_block, code_block_2, code_block_2, read)
watch = Watch(read)
