# Dynamo graph ReadNonExistingFile.dyn (Dynamo 0.8.1.1345)

file_path = Filename("..\..\..\test\core\excel\NonExistingFile.xlsx")
string = StringInput("Sheet1")
readFromFile = Excel.ReadFromFile(file_path, string)
watch = Watch(readFromFile)
