# Dynamo graph ReadOnlyFile_OpenXml.dyn (Dynamo 2.12.0.4564)

file_path = Filename(".\ReadOnlyFile.xlsx")
code_block = CodeBlock { "Sheet1"; }
importOpenXml = Data.ImportOpenXml(filePath=file_path, sheetName=code_block)
