# Dynamo graph WorksheetByName_InvalidInput.dyn (Dynamo 0.6.3.17491)

file_path = StringFilename("..\..\..\test\core\excel\mixedNumbersAndStrings.xlsx")
open_excel_workbook = ReadExcelFile(file_path)
string = StringInput("NotAWorksheet")
get_excel_worksheet_by_name = GetExcelWorksheetByName(open_excel_workbook, string)
watch = Watch(get_excel_worksheet_by_name)
