# Dynamo graph WorksheetByName_ValidInput.dyn (Dynamo 1.0.1.1743)

file_path = Filename("..\..\..\test\core\excel\mixedNumbersAndStrings.xlsx")
readExcelFile = Excel.ReadExcelFile(file_path)
string = StringInput("Sheet2")
getExcelWorksheetByName = Excel.GetExcelWorksheetByName(readExcelFile, string)
watch = Watch(getExcelWorksheetByName)
