# Dynamo graph WorksheetsFromFile.dyn (Dynamo 0.7.0.17491)

file_path = StringFilename("..\..\..\test\core\excel\mixedNumbersAndStrings.xlsx")
open_excel_workbook = ReadExcelFile(file_path)
get_worksheets_from_excel = GetWorksheetsFromExcelWorkbook(open_excel_workbook)
watch = Watch(get_worksheets_from_excel)
