# Dynamo graph WriteEmptyArrayToExcel_OpenXml.DYN "WriteEmptyArrayToExcel_OpenXml.DYN" (Dynamo 2.12.0.4625)

string = StringInput("")
code_block = CodeBlock { "mySheet"; 1; [2, [], 3]; }
exportOpenXml = Data.ExportOpenXml(filePath=string, sheetName=code_block.out0, data=code_block.out2, startRow=code_block.out1, startColumn=code_block.out1)
code_block_2 = CodeBlock(a=exportOpenXml) { a; 1; }
importOpenXml = Data.ImportOpenXml(filePath=string, sheetName=code_block.out0, startRow=code_block_2.out1, startColumn=code_block_2.out1)
