# Dynamo graph WriteEmptyListToExcel_OpenXml.DYN "WriteEmptyListToExcel_OpenXml.DYN" (Dynamo 2.12.0.4626)

string = StringInput("")
code_block = CodeBlock { "test"; []; }
exportOpenXml = Data.ExportOpenXml(filePath=string, sheetName=code_block.out0, data=code_block.out1)
code_block_2 = CodeBlock(a=exportOpenXml) { a; "test"; }
importOpenXml = Data.ImportOpenXml(filePath=string, sheetName=code_block_2.out1)
