# Dynamo graph WriteJaggedArrayToExcel_OpenXml.dyn (Dynamo 2.12.0.4625)

string = StringInput("")
code_block = CodeBlock { "mySheet"; 1; }
code_block_2 = CodeBlock { [[1,2,3,null], [1,2,3,4], [null,2,3]]; }
transpose = List.Transpose(lists=code_block_2)
exportOpenXml = Data.ExportOpenXml(filePath=string, sheetName=code_block.out0, data=transpose, startRow=code_block.out1, startColumn=code_block.out1)
code_block_3 = CodeBlock(a=exportOpenXml) { a; "mySheet"; 1; }
importOpenXml = Data.ImportOpenXml(filePath=string, sheetName=code_block_3.out1, startRow=code_block_3.out2, startColumn=code_block_3.out2)
