# Dynamo graph WriteModifyGraph_2.dyn (Dynamo 0.8.1.1345)

file_path = Filename("..\..\..\test\core\excel\WriteModifyGraph_2.xlsx")
code_block = CodeBlock { "Sheet1"; }
code_block_2 = CodeBlock { 0; }
code_block_3 = CodeBlock { 5..10; }
writeToFile = Excel.WriteToFile(file_path, code_block, code_block_2, code_block_2, code_block_3)
watch = Watch(writeToFile)
fromPath = FileObject(file_path)  # "File.FromPath"
readFromFile = Excel.ReadFromFile(fromPath, code_block)
code_block_4 = CodeBlock { 2..5; }
