# Dynamo graph WriteNestedEmptyListToExcel_OpenXml.DYN "WriteNestedEmptyListToExcel_OpenXml.DYN" (Dynamo 2.12.0.4625)

string = StringInput("")
code_block = CodeBlock { "test"; [[],[],[]]; 2; 1; }
exportOpenXml = Data.ExportOpenXml(filePath=string, sheetName=code_block.out0, data=code_block.out1, startRow=code_block.out2, startColumn=code_block.out3)
code_block_2 = CodeBlock(a=exportOpenXml) { a; "test"; }
importOpenXml = Data.ImportOpenXml(filePath=string, sheetName=code_block_2.out1)
