# Dynamo graph WriteNodeAndUpdateData.dyn (Dynamo 0.7.0.24656)

string = StringInput("")
code_block = CodeBlock { "mySheet"; }
code_block_2 = CodeBlock { 1; }
string_2 = StringInput("BBB")
write = Excel.Write(string, code_block, code_block_2, code_block_2, string_2)
