# Dynamo graph WriteNodewithError.dyn (Dynamo 0.8.1.1345)

file_path = Filename("..\..\..\test\core\excel\WriteNodeWithError.xlsx")
code_block = CodeBlock { "Sheet1"; }
code_block_2 = CodeBlock { 0; }
writeToFile = Excel.WriteToFile(file_path, code_block, code_block_2, code_block_2)
code_block_3 = CodeBlock { true; }
code_block_4 = CodeBlock(a=code_block_3) { Autodesk.Point.ByCoordinates(1,a,1); }
