# Dynamo graph WriteNonExistingSheet_OpenXml.dyn (Dynamo 2.12.0.4627)

string = StringInput("")
code_block = CodeBlock { "newSheet"; 1..5; }
exportOpenXml = Data.ExportOpenXml(filePath=string, sheetName=code_block.out0, data=code_block.out1)
code_block_2 = CodeBlock(a=exportOpenXml) { a; "newSheet"; }
importOpenXml = Data.ImportOpenXml(filePath=string, sheetName=code_block_2.out1)
