# Dynamo graph WriteNullValuesToExcel1_OpenXml.DYN "WriteNullValuesToExcel1_OpenXml.DYN" (Dynamo 2.12.0.4626)

string = StringInput("")
code_block = CodeBlock { "mySheet"; [2, null, 3]; }
exportOpenXml = Data.ExportOpenXml(filePath=string, sheetName=code_block.out0, data=code_block.out1)
code_block_2 = CodeBlock(a=exportOpenXml) { a; "mySheet"; }
importOpenXml = Data.ImportOpenXml(filePath=string, sheetName=code_block_2.out1)
