# Dynamo graph ImageFileWriter.dyn (Dynamo 0.7.4.3075)

string = StringInput("test.png")
string_2 = StringInput("..\..\..\test\core\files\ImageFile.png")
fromPath = FileObject(string_2)  # "File.FromPath"
readFromFile = Image.ReadFromFile(fromPath)
writeToFile = Image.WriteToFile(string, readFromFile)
