# Dynamo graph TestExportToCSVFile.dyn (Dynamo 0.7.4.3075)

file_path = Filename("No file selected.")
code_block = CodeBlock { {{1,2,3,4,5},{-2,2.6,9},{0}}; }
writeToFile = CSV.WriteToFile(file_path, code_block)
