# Dynamo graph fileTests_post6_0.dyn

number = DoubleInput(0)
number_slider = DoubleSliderInput(41.28440367, range=0..100)
add = Addition(number, number_slider, lacing=Longest)
number_2 = DoubleInput(0)
add_2 = Addition(add, number_2, lacing=Longest)
watch = Watch(add)
