# Dynamo graph fileTests_pre6_0.dyn

number = DoubleInput(0)
number_slider = DoubleSliderInput(41.28440367, range=0..100)
add = Addition(number, number_slider)
number_2 = DoubleInput(0)
add_2 = Addition(add, number_2)
watch = Watch(add)
