# Dynamo graph readImageFileTest.dyn

file_path = StringFilename("No file selected.")
number = DoubleInput(5)
read_image_file = ImageFileReader(file_path, number, number)
list_length = Length(read_image_file)
watch = Watch(list_length)
