# Dynamo graph filter-example.dyn (Dynamo 1.0.1.1743)

number = DoubleInput(1)
number_2 = DoubleInput(5)
range = Range(start=number, end=number_2, step=number)
isodd = Custom[IsOdd?]()
filter = Filter(range, isodd)
watch = Watch(filter)
