# Dynamo graph formula-if.dyn (Dynamo 1.0.1.1743)

boolean = BoolSelector(false)
code_block = CodeBlock { 1; 2; }
formula = Formula("if(test, t, f)", test=boolean, t=code_block.out0, f=code_block.out1)
