# Dynamo graph formula-inputWithUnit-test.dyn (Dynamo 1.0.1.1743)

code_block = CodeBlock { 1; }
fromDouble = DynamoUnits.Length.FromDouble(code_block)
formula = Formula("x/y", x=fromDouble, y=fromDouble)
watch = Watch(formula)
