# Dynamo graph formula-test.dyn (Dynamo 0.7.1.23670)

formula = Formula("3*(10/2)+4", lacing=Longest)
watch = Watch(formula)
number = DoubleInput(3)
number_2 = DoubleInput(2)
formula_2 = Formula("x*(10/y)+4", x=number, y=number_2, lacing=Longest)
watch_2 = Watch(formula_2)
