# Dynamo graph Abstract_BoundingBox_JSONParsing.dyn (Dynamo 3.0.0.5795)

code_block = CodeBlock { 9; 0; 10; 3; 5; 7; }
randomList = Math.RandomList(amount=code_block.out0, value1=code_block.out1, value2=code_block.out2, seed=code_block.out3)
randomList_2 = Math.RandomList(amount=code_block.out0, value1=code_block.out1, value2=code_block.out2, seed=code_block.out4)
randomList_3 = Math.RandomList(amount=code_block.out0, value1=code_block.out1, value2=code_block.out2, seed=code_block.out5)
byCoordinates = Point.ByCoordinates(x=randomList, y=randomList_2, z=randomList_3)
byGeometry = BoundingBox.ByGeometry(geom=byCoordinates)
contextCoordinateSystem = BoundingBox.ContextCoordinateSystem(boundingBox=byGeometry)
stringifyJSON = Data.StringifyJSON(values=byGeometry)
parseJSON = Data.ParseJSON(json=stringifyJSON)
contextCoordinateSystem_2 = BoundingBox.ContextCoordinateSystem(boundingBox=parseJSON)
isEqualTo = CoordinateSystem.IsEqualTo(coordinateSystem=contextCoordinateSystem, other=contextCoordinateSystem_2)
minPoint = BoundingBox.MinPoint(boundingBox=byGeometry)
maxPoint = BoundingBox.MaxPoint(boundingBox=byGeometry)
list_create = List.Create(item0=minPoint, item1=maxPoint)
minPoint_2 = BoundingBox.MinPoint(boundingBox=parseJSON)
maxPoint_2 = BoundingBox.MaxPoint(boundingBox=parseJSON)
list_create_2 = List.Create(item0=minPoint_2, item1=maxPoint_2)
isAlmostEqualTo = Geometry.IsAlmostEqualTo(geometry=list_create, other=list_create_2)
type = Object.Type(object=byGeometry)
type_2 = Object.Type(object=parseJSON)
eq = type == type_2
list_create_3 = List.Create(item0=isEqualTo, item1=isAlmostEqualTo, item2=eq)
flatten = List.Flatten(list=list_create_3)

# group: All True
allTrue = List.AllTrue(list=flatten)

byMinimumVolume = BoundingBox.ByMinimumVolume(geom=byCoordinates)
stringifyJSON_2 = Data.StringifyJSON(values=byMinimumVolume)
isNull = Object.IsNull(object=stringifyJSON_2)
