# Dynamo graph PrimitiveType.dyn (Dynamo 0.7.0.25519)

code_block = CodeBlock { 1; }
differentPrimitiveType = FFITarget.OverloadTarget.DifferentPrimitiveType(code_block)
code_block_2 = CodeBlock(r1=differentPrimitiveType) { r1; }
differentPrimitiveType_2 = FFITarget.OverloadTarget.DifferentPrimitiveType(code_block)
code_block_3 = CodeBlock(r2=differentPrimitiveType_2) { r2; }
