# Dynamo graph AddToList_Complex.dyn

number = DoubleInput(0..10)
string = StringInput("Dynamo")
list = NewList(index0=number, index1=string)
number_2 = DoubleInput(3)
build_sublists = Sublists("3", number, number_2, lacing=Longest)
watch = Watch(build_sublists)
split_list = DeCons(build_sublists)
watch_2 = Watch(split_list.out0)
watch_3 = Watch(split_list.out1)
add_to_list = List(watch_2, watch_3)
watch_4 = Watch(add_to_list)
