# Dynamo graph AddToList_ContainingNull.dyn (Dynamo 0.7.0.19105)

code_block = CodeBlock { 2; }
code_block_2 = CodeBlock { {3,4,null,6}; }
addItemToFront = List.AddItemToFront(code_block, code_block_2)
watch = Watch(addItemToFront)
