# Dynamo graph AddToList_Negative.dyn

empty_list = Empty()
string = StringInput("")
number = DoubleInput(0)
list = NewList(index0=string, index1=number)
add_to_list = List(empty_list, list)
watch = Watch(add_to_list)
