# Dynamo graph AddToList_SimpleTest.dyn

string = StringInput("Design")
string_2 = StringInput("Dynamo")
number = DoubleInput(-10..-1..3)
string_3 = StringInput("Script")
number_2 = DoubleInput(10)
list = NewList(index0=string_2, index1=number, index2=string, index3=string_3, index4=number_2)
add_to_list = List(string, list)
watch = Watch(add_to_list)
