# Dynamo graph Average_NegativeInputTest.dyn (Dynamo 1.0.1.1743)

number = DoubleInput(5)
number_2 = DoubleInput(8)
string = StringInput("Dynamo")
create_list = List.Create(number, number_2, number, string)
average = Math.Average(create_list, lacing=Longest)
