# Dynamo graph Combine_ComplexTest.dyn (Dynamo 0.6.3.27696)

number = DoubleInput(3)
number_2 = DoubleInput(1)
number_3 = DoubleInput(0)
string = StringInput(",")
split_string = SplitString(arg1=string)
string_2 = StringInput("""x,y,z,x,y,z,x,y,z,x,y,z
6450,3250,36242.5,6450,3250,40142.5,7950,3250,40142.5,7950,3250,36242.5
10950,-1250,16742.5,10950,-1250,20642.5,12450,-1250,20642.5,12450,-1250,16742.5""")
string_3 = StringInput("\n")
split_string_2 = SplitString(string_2, string_3)
map = Map(split_string, split_string_2)
get_from_list = GetFromList(number_3, map)
number_4 = DoubleInput(0.003)
multiply = Multiplication(arg1=number_4, lacing=Longest)
string_to_number = String2Num(lacing=Longest)
remove_from_list = RemoveFromList(number_3, map)
map_2 = Map(string_to_number, remove_from_list)
map_3 = Map(multiply, map_2)
add_to_list = List(get_from_list, map_3)
get_from_list_2 = GetFromList(number_2, add_to_list)
shift_list_indeces = ShiftList(number, get_from_list_2)
watch = Watch(shift_list_indeces)
remove_from_list_2 = RemoveFromList(number_2, add_to_list)
watch_2 = Watch(remove_from_list_2)
add = Addition(lacing=Longest)
number_5 = DoubleInput(2)
get_from_list_3 = GetFromList(number_5, add_to_list)
combine = Combine(add, get_from_list_3, shift_list_indeces)
