# Dynamo graph Combine_SimpleTest.dyn (Dynamo 0.6.3.5265)

divide = Division(lacing=Longest)
number = DoubleInput(20..200..#20)
number_2 = DoubleInput(5..24)
combine = Combine(divide, number, number_2)
