# Dynamo graph DropEveryNth_ComplexTest.dyn (Dynamo 0.6.3.27696)

number_slider = DoubleSliderInput(2.003873824, range=1..3)
number = DoubleInput(0)
string = StringInput(",")
split_string = SplitString(arg1=string)
string_2 = StringInput("""x,y,z,x,y,z,x,y,z,x,y,z
6450,3250,36242.5,6450,3250,40142.5,7950,3250,40142.5,7950,3250,36242.5
10950,-1250,16742.5,10950,-1250,20642.5,12450,-1250,20642.5,12450,-1250,16742.5""")
string_3 = StringInput("\n")
split_string_2 = SplitString(string_2, string_3)
map = Map(split_string, split_string_2)
get_from_list = GetFromList(number, map)
number_2 = DoubleInput(0.003)
multiply = Multiplication(arg1=number_2, lacing=Longest)
string_to_number = String2Num(lacing=Longest)
remove_from_list = RemoveFromList(number, map)
map_2 = Map(string_to_number, remove_from_list)
map_3 = Map(multiply, map_2)
add_to_list = List(get_from_list, map_3)
number_3 = DoubleInput(0)
drop_every_nth = RemoveEveryNth(number_slider, add_to_list, number_3)
watch = Watch(drop_every_nth)
