# Dynamo graph DropEveryNth_InputEmptyList.dyn (Dynamo 0.7.0.35153)

number = DoubleInput(1)
empty_list = Empty()
number_2 = DoubleInput(1)
drop_every_nth = RemoveEveryNth(number, empty_list, number_2)
watch = Watch(drop_every_nth)
