# Dynamo graph DropEveryNth_SimpleTest.dyn (Dynamo 0.7.0.35153)

number = DoubleInput(5)
number_2 = DoubleInput(1..10)
drop_every_nth = RemoveEveryNth(number, number_2, number)
watch = Watch(drop_every_nth)
