# Dynamo graph FilterOut_Complex.dyn

number = DoubleInput(3)
less_than = LessThan(arg1=number)
number_2 = DoubleInput(1..10)
filter_out = FilterOut(less_than, number_2)
take_from_list = TakeList(number, filter_out)
watch = Watch(take_from_list)
greater_than = GreaterThan(arg1=number)
filter_out_2 = FilterOut(greater_than, number_2)
drop_from_list = DropList(number, filter_out_2)
watch_2 = Watch(drop_from_list)
add_to_list = List(number, filter_out)
