# Dynamo graph Filter_Complex.dyn

number = DoubleInput(5)
greater_than = GreaterThan(arg1=number)
number_2 = DoubleInput(0..10)
filter = Filter(greater_than, number_2)
watch = Watch(filter)
less_than = LessThan(arg1=number)
filter_2 = Filter(less_than, number_2)
watch_2 = Watch(filter_2)
formula = Formula("a/b", lacing=Longest)
combine = Combine(formula, filter, filter_2)
watch_3 = Watch(combine)
