# Dynamo graph Filter_SimpleTest.dyn

number = DoubleInput(5)
greater_than = GreaterThan(arg1=number)
number_2 = DoubleInput(0)
number_3 = DoubleInput(10)
number_4 = DoubleInput(1)
number_sequence = NumberRange(number_2, number_3, number_4)
filter = Filter(greater_than, number_sequence)
watch = Watch(filter)
watch_2 = Watch(number_sequence)
