# Dynamo graph GetFromList_Negative.dyn (Dynamo 0.6.3.27696)

number = DoubleInput(5)
number_2 = DoubleInput(0)
number_slider = DoubleSliderInput(9.724220624, range=0..50)
number_3 = DoubleInput(1)
number_range = NumberRange(number_2, number_slider, number_3, lacing=Longest)
number_4 = DoubleInput(3)
build_sublists = Sublists("3", number_range, number_4, lacing=Longest)
get_from_list = GetFromList(number, build_sublists)
watch = Watch(get_from_list)
