# Dynamo graph GetFromList_NegativeIntValue.dyn (Dynamo 0.7.0.35153)

number = DoubleInput(-1)
string = StringInput("Test ")
string_2 = StringInput("Take ")
string_3 = StringInput("From ")
string_4 = StringInput("List")
list = NewList(index0=string, index1=string_2, index2=string_3, index3=string_4)
get_from_list = GetFromList(number, list)
watch = Watch(get_from_list)
