# Dynamo graph LaceLongest_Simple.dyn

add = Addition(lacing=Longest)
number = DoubleInput(1..10)
number_2 = DoubleInput(-1..10)
lace_longest = LaceLongest(add, number, number_2)
number_3 = DoubleInput(3)
build_sublists = Sublists("1", lace_longest, number_3, lacing=Longest)
watch = Watch(build_sublists)
watch_2 = Watch(lace_longest)
