# Dynamo graph LaceShortest_Simple.dyn (Dynamo 0.6.2.29585)

add = Addition(lacing=Longest)
number = DoubleInput(1..5)
number_2 = DoubleInput(1..2)
lace_shortest = LaceShortest(add, number, number_2)
reverse = Reverse(lace_shortest)
watch = Watch(reverse)
divide = Division(lacing=Longest)
subtract = Subtraction(lacing=Longest)
number_3 = DoubleInput(1..5)
number_4 = DoubleInput(5..6)
lace_shortest_2 = LaceShortest(subtract, number_3, number_4)
combine = Combine(divide, lace_shortest, lace_shortest_2)
watch_2 = Watch(combine)
