# Dynamo graph LaceShortest_StringInput.dyn (Dynamo 1.0.1.1743)

concat = String.Concat()
string = StringInput("Dynamo")
string_2 = StringInput("Design")
string_3 = StringInput("Script")
create_list = List.Create(string, string_2, string_3)
laceShortest = List.LaceShortest(concat, create_list, create_list)
