# Dynamo graph ListMinimum_Complex.dyn

number = DoubleInput(5)
greater_than = GreaterThan(arg1=number)
less_than = LessThan(arg1=number)
number_2 = DoubleInput(-1)
number_slider = DoubleSliderInput(9.249743063, range=0..10)
number_3 = DoubleInput(1)
number_range = NumberRange(number_2, number_slider, number_3, lacing=Longest)
filter_out = FilterOut(less_than, number_range)
list_minimum = ListMin(greater_than, filter_out)
watch = Watch(list_minimum)
watch_2 = Watch(filter_out)
