# Dynamo graph NumberRange_LacingCrossProduct.dyn

number = DoubleInput(1..2)
number_2 = DoubleInput(10)
number_3 = DoubleInput(1..2)
number_range = NumberRange(number, number_2, number_3, lacing=CrossProduct)
list_length = Length(number_range)
watch = Watch(number_range)
