# Dynamo graph NumberRange_SimpleTest.dyn

number = DoubleInput(0)
number_slider = DoubleSliderInput(50, range=0..100)
number_2 = DoubleInput(1)
number_range = NumberRange(number, number_slider, number_2, lacing=Longest)
list_length = Length(number_range)
