# Dynamo graph RemoveFromList_Complex.dyn (Dynamo 0.6.3.35153)

number = DoubleInput(5)
number_2 = DoubleInput(5)
number_3 = DoubleInput(1)
number_4 = DoubleInput(1..10)
shift_list_indeces = ShiftList(number_3, number_4)
slice_list = SliceList(number, number_2, shift_list_indeces)
watch = Watch(slice_list)
number_5 = DoubleInput(2)
number_6 = DoubleInput(2..4)
get_from_list = GetFromList(number_6, slice_list)
remove_from_list = RemoveFromList(number_5, get_from_list)
watch_2 = Watch(remove_from_list)
watch_3 = Watch(shift_list_indeces)
