# Dynamo graph RemoveFromList_RangeExpnAsIndex.dyn (Dynamo 0.7.0.35153)

number = DoubleInput(1)
number_2 = DoubleInput(1..10)
shift_list_indeces = ShiftList(number, number_2)
watch = Watch(shift_list_indeces)
number_3 = DoubleInput(0..9)
remove_from_list = RemoveFromList(number_3, shift_list_indeces)
watch_2 = Watch(remove_from_list)
number_4 = DoubleInput(2..6)
remove_from_list_2 = RemoveFromList(number_4, shift_list_indeces)
watch_3 = Watch(remove_from_list_2)
