# Dynamo graph RemoveFromList_SimpleTest.dyn (Dynamo 0.6.3.27696)

number = DoubleInput(1)
string = StringInput("testRemoveFromList")
number_2 = DoubleInput(98.1564)
string_2 = StringInput("Dynamo")
number_3 = DoubleInput(10.689)
string_3 = StringInput("Design")
string_4 = StringInput("Script")
list = NewList(index0=string, index1=number_2, index2=string_2, index3=number_3, index4=string_3, index5=string_4)
remove_from_list = RemoveFromList(number, list)
watch = Watch(remove_from_list)
