# Dynamo graph Reverse_MixedList.dyn

string = StringInput("Dynamo")
number = DoubleInput(4.5)
string_2 = StringInput("Design")
string_3 = StringInput("Script")
number_slider = DoubleSliderInput(50, range=0..100)
add = Addition(number_slider, number, lacing=Longest)
list = NewList(index0=string, index1=number, index2=string_2, index3=string_3, index4=number_slider, index5=add)
reverse = Reverse(list)
watch = Watch(reverse)
watch_2 = Watch(list)
