# Dynamo graph Reverse_WithArrayInput.dyn

number = DoubleInput(0)
number_2 = DoubleInput(10)
number_3 = DoubleInput(1)
number_range = NumberRange(number, number_2, number_3, lacing=Longest)
number_4 = DoubleInput(1)
number_5 = DoubleInput(10)
number_6 = DoubleInput(2)
number_range_2 = NumberRange(number_4, number_5, number_6, lacing=Longest)
number_7 = DoubleInput(2)
number_8 = DoubleInput(10)
number_9 = DoubleInput(3)
number_range_3 = NumberRange(number_7, number_8, number_9, lacing=Longest)
list = NewList(index0=number_range, index1=number_range_2, index2=number_range_3)
watch = Watch(list)
reverse = Reverse(list)
watch_2 = Watch(reverse)
