# Dynamo graph Reverse_WithSingleInput.dyn

number = DoubleInput(10)
number_2 = DoubleInput(2)
number_3 = DoubleInput(3)
list = NewList(index0=number, index1=number_2, index2=number_3)
watch = Watch(list)
reverse = Reverse(list)
watch_2 = Watch(reverse)
