# Dynamo graph ShiftListIndeces_InputStringAsAmt.dyn (Dynamo 0.6.3.27696)

string = StringInput("Dynamo")
number = DoubleInput(1..10)
shift_list_indeces = ShiftList(string, number)
watch = Watch(shift_list_indeces)
