# Dynamo graph Smooth_InputListNode.dyn (Dynamo 1.0.1.1743)

number = DoubleInput(54.36)
number_2 = DoubleInput(2.5412)
number_3 = DoubleInput(8.549)
number_4 = DoubleInput(84.256987)
create_list = List.Create(number, number_2, number_3, number_4)
smooth = Smooth(create_list, lacing=Longest)
