# Dynamo graph Smooth_NegativeTest.dyn (Dynamo 1.0.1.1743)

string = StringInput("Dynamo")
string_2 = StringInput("DS")
number = DoubleInput(54.652)
create_list = List.Create(string, string_2, number)
smooth = Smooth(create_list, lacing=Longest)
