# Dynamo graph Sort_NumbersfFromDiffInput.dyn

angle_deg = AngleInput(0.7853981634)
sine = Sin(angle_deg, lacing=Longest)
angle_deg_2 = AngleInput(1.047197551)
cosine = Cos(angle_deg_2, lacing=Longest)
angle_deg_3 = AngleInput(0.5235987756)
tangent = Tan(angle_deg, lacing=Longest)
number = DoubleInput(1)
list = NewList(index0=angle_deg_3, index1=angle_deg)
get_from_list = GetFromList(number, list)
number_slider = DoubleSliderInput(-3.76498801, range=-10..10)
boolean = DoubleInput(0)
list_2 = NewList(index0=sine, index1=cosine, index2=angle_deg_3, index3=tangent, index4=number, index5=get_from_list, index6=number_slider, index7=boolean)
sort = Sort(list_2)
watch = Watch(sort)
watch_2 = Watch(list_2)
