# Dynamo graph Sort_Strings&Numbers.dyn

string = StringInput("dddd")
string_2 = StringInput("aa")
string_3 = StringInput("a")
number = DoubleInput(0)
string_4 = StringInput("bbbbbbbbbbbbb")
list = NewList(index0=string, index1=string_2, index2=string_3, index3=number, index4=string_4)
sort = Sort(list)
watch = Watch(sort)
