# Dynamo graph SplitList_FirstElementAsList.dyn

number = DoubleInput(0..1)
string = StringInput("Dynamo")
list = NewList(index0=number, index1=string)
split_list = DeCons(list)
watch = Watch(split_list.out1)
watch_2 = Watch(split_list.out0)
