# Dynamo graph SplitList_SimpleTest.dyn

string = StringInput("Dynamo")
number = DoubleInput(0..1)
list = NewList(index0=string, index1=number)
split_list = DeCons(list)
watch = Watch(split_list.out1)
watch_2 = Watch(split_list.out0)
