# Dynamo graph TakeEveryNth_Complex.dyn (Dynamo 1.0.1.1743)

number = DoubleInput(1)
number_2 = DoubleInput(5)
number_3 = DoubleInput(89.9)
number_4 = DoubleInput(34.56)
number_5 = DoubleInput(1)
number_6 = DoubleInput(0)
create_list = List.Create(number_2, number_3, number_4, number_5, number_6)
number_7 = DoubleInput(2.3)
string = StringInput("Dynamo")
string_2 = StringInput("Magneto")
string_3 = StringInput("Design")
string_4 = StringInput("Script")
create_list_2 = List.Create(string, string_2, string_3, string_4)
create_list_3 = List.Create(number, create_list, number_7, create_list_2)
number_8 = DoubleInput(2)
number_9 = DoubleInput(1)
takeEveryNthItem = List.TakeEveryNthItem(create_list_3, number_8, number_9)
watch = Watch(takeEveryNthItem)
