# Dynamo graph TakeEveryNth_NegativeTest.dyn (Dynamo 0.6.3.27696)

string = StringInput("Dynamo")
number = DoubleInput(5..20)
number_2 = DoubleInput(3)
take_every_nth = TakeEveryNth(string, number, number_2)
watch = Watch(take_every_nth)
