# Dynamo graph TakeEveryNth_SimpleTest.dyn (Dynamo 0.6.3.27696)

number = DoubleInput(3)
number_2 = DoubleInput(5..20)
number_3 = DoubleInput(3)
take_every_nth = TakeEveryNth(number, number_2, number_3)
watch = Watch(take_every_nth)
