# Dynamo graph TakeFromList_AmtAsRangeExpn.dyn

number = DoubleInput(1..2)
number_2 = DoubleInput(0)
number_slider = DoubleSliderInput(15, range=0..50)
number_3 = DoubleInput(1)
number_sequence = NumberSeq(number_2, number_slider, number_3, lacing=Longest)
number_4 = DoubleInput(3)
build_sublists = Sublists("3", number_sequence, number_4, lacing=Longest)
take_from_list = TakeList(number, build_sublists)
watch = Watch(take_from_list)
