# Dynamo graph TakeFromList_NegativeIntValue.dyn

number = DoubleInput(-1)
string = StringInput("Test ")
string_2 = StringInput("Take ")
string_3 = StringInput("From ")
string_4 = StringInput("List")
list = NewList(index0=string, index1=string_2, index2=string_3, index3=string_4)
take_from_list = TakeList(number, list)
watch = Watch(take_from_list)
