# Dynamo graph testConcatenateLists_normalInput.dyn (Dynamo 1.0.1.1743)

number = DoubleInput(10)
number_2 = DoubleInput(20)
number_3 = DoubleInput(10)
number_4 = DoubleInput(20)
number_5 = DoubleInput(10)
create_list = List.Create(number, number_2, number_3, number_4, number_5)
string = StringInput("a")
string_2 = StringInput("b")
string_3 = StringInput("a")
string_4 = StringInput("b")
create_list_2 = List.Create(string, string_2, string_3, string_4)
join = List.Join(create_list, create_list_2)
watch = Watch(join)
