# Dynamo graph testDiagonaLeftList_invalidInput.dyn

number = DoubleInput(20)
number_2 = DoubleInput(10)
diagonal_left_list = DiagonalLeftList(number, number_2, lacing=Longest)
watch = Watch(diagonal_left_list)
