# Dynamo graph testIntegration1.dyn

number = DoubleInput(1)
number_2 = DoubleInput(0)
number_3 = DoubleInput(99999999999999)
list = NewList(index0=number, index1=number_2, index2=number_3)
list_length = Length(list)
repeat = Repeat(list, list_length, lacing=Longest)
flatten = FlattenListAmt(repeat, number)
watch = Watch(flatten)
watch_2 = Watch(repeat)
is_empty_list = IsEmpty(watch_2)
watch_3 = Watch(is_empty_list)
first_of_list = First(flatten)
watch_4 = Watch(first_of_list)
