# Dynamo graph testIsEmptyList_numberInput.dyn (Dynamo 1.0.1.1743)

number = DoubleInput(2)
number_2 = DoubleInput(2)
number_3 = DoubleInput(2)
number_4 = DoubleInput(2)
number_5 = DoubleInput(2)
number_6 = DoubleInput(2)
number_7 = DoubleInput(2)
number_8 = DoubleInput(2)
number_9 = DoubleInput(2)
number_10 = DoubleInput(2)
create_list = List.Create(number, number_2, number_3, number_4, number_5, number_6, number_7, number_8, number_9, number_10)
isEmpty = List.IsEmpty(create_list)
watch = Watch(isEmpty)
