# Dynamo graph testCompare_BooleanBoolean.dyn (Dynamo 0.6.2.20018)

boolean = BoolSelector(true)
boolean_2 = BoolSelector(false)
less_than = LessThan(boolean, boolean_2)
watch = Watch(less_than)
less_than_2 = LessThan(boolean_2, boolean)
watch_2 = Watch(less_than_2)
greater_than_or_equal = GreaterThanEquals(boolean, boolean_2)
watch_3 = Watch(greater_than_or_equal)
greater_than_or_equal_2 = GreaterThanEquals(boolean_2, boolean)
watch_4 = Watch(greater_than_or_equal_2)
