# Dynamo graph testCompare_BooleanInteger.dyn (Dynamo 0.6.2.20018)

boolean = BoolSelector(true)
integer_slider = IntegerSliderInput(2, range=0..5)
less_than = LessThan(boolean, integer_slider)
watch = Watch(less_than)
less_than_2 = LessThan(integer_slider, boolean)
watch_2 = Watch(less_than_2)
greater_than_or_equal = GreaterThanEquals(boolean, integer_slider)
watch_3 = Watch(greater_than_or_equal)
greater_than_or_equal_2 = GreaterThanEquals(integer_slider, boolean)
watch_4 = Watch(greater_than_or_equal_2)
