# Dynamo graph testEqualStringInput.dyn

string = StringInput("a")
equal = Equal(string, string)
watch = Watch(equal)
string_2 = StringInput("b")
equal_2 = Equal(string, string_2)
watch_2 = Watch(equal_2)
