# Dynamo graph testGreaterThanNumberInput.dyn

number = DoubleInput(1)
number_2 = DoubleInput(2)
greater_than = GreaterThan(number, number_2)
watch = Watch(greater_than)
greater_than_2 = GreaterThan(number_2, number)
watch_2 = Watch(greater_than_2)
