# Dynamo graph testGreaterThanOrEqualInvalidInput.dyn

string = StringInput("a")
number = DoubleInput(1)
greater_than_or_equal = GreaterThanEquals(string, number)
watch = Watch(greater_than_or_equal)
