# Dynamo graph testGreaterThanOrEqualNumberInput.dyn

number = DoubleInput(1)
number_2 = DoubleInput(2)
greater_than_or_equal = GreaterThanEquals(number, number_2)
watch = Watch(greater_than_or_equal)
greater_than_or_equal_2 = GreaterThanEquals(number_2, number)
watch_2 = Watch(greater_than_or_equal_2)
greater_than_or_equal_3 = GreaterThanEquals(number_2, number)
watch_3 = Watch(greater_than_or_equal_3)
