# Dynamo graph testGreaterThanOrEqualStringInput.dyn

string = StringInput("a")
string_2 = StringInput("b")
greater_than_or_equal = GreaterThanEquals(string, string_2)
watch = Watch(greater_than_or_equal)
greater_than_or_equal_2 = GreaterThanEquals(string, string)
watch_2 = Watch(greater_than_or_equal_2)
greater_than_or_equal_3 = GreaterThanEquals(string_2, string)
watch_3 = Watch(greater_than_or_equal_3)
