# Dynamo graph testLessThanNumberInput.dyn

number = DoubleInput(5)
number_2 = DoubleInput(10)
less_than = LessThan(number, number_2)
watch = Watch(less_than)
number_3 = DoubleInput(10)
number_4 = DoubleInput(5)
less_than_2 = LessThan(number_3, number_4)
watch_2 = Watch(less_than_2)
