# Dynamo graph testLessThanOrEqualNumberInput.dyn

number = DoubleInput(5)
number_2 = DoubleInput(10)
less_than_or_equal = LessThanEquals(number, number_2)
watch = Watch(less_than_or_equal)
less_than_or_equal_2 = LessThanEquals(number, number)
watch_2 = Watch(less_than_or_equal_2)
less_than_or_equal_3 = LessThanEquals(number_2, number)
watch_3 = Watch(less_than_or_equal_3)
