# Dynamo graph testLessThanOrEqualStringInput.dyn

string = StringInput("a")
less_than_or_equal = LessThanEquals(string, string)
watch = Watch(less_than_or_equal)
string_2 = StringInput("b")
less_than_or_equal_2 = LessThanEquals(string_2, string)
watch_2 = Watch(less_than_or_equal_2)
less_than_or_equal_3 = LessThanEquals(string, string_2)
watch_3 = Watch(less_than_or_equal_3)
