# Dynamo graph testLessThanStringInput.dyn

string = StringInput("a")
string_2 = StringInput("b")
less_than = LessThan(string, string_2)
watch = Watch(less_than)
less_than_2 = LessThan(string_2, string)
watch_2 = Watch(less_than_2)
