# Dynamo graph testToleranceEquals_defaultTolerance.dyn (Dynamo 2.5.0.6324)

code_block = CodeBlock { 0.0; 0.00001; }
eq = code_block.out0 == code_block.out1
eq_2 = Equals(x=code_block.out0, y=code_block.out1)
