# Dynamo graph testToleranceEquals_map.dyn (Dynamo 2.5.0.6324)

code_block = CodeBlock { 1..2; 1..4; }
eq = Equals(x=code_block.out0, y=code_block.out1)
code_block_2 = CodeBlock { 0.00001; }
eq_2 = Equals(x=code_block.out0, y=code_block.out1)  # unwired: tolerance
map = List.Map(list=code_block_2, f_x=eq_2)
flatten = List.Flatten(list=map)
