# Dynamo graph testIFAsFunctionObject.dyn (Dynamo 0.7.0.28875)

code_block = CodeBlock { {true, false, false, true}; }
code_block_2 = CodeBlock { 43; }
code_block_3 = CodeBlock { 144; }
if_ = If(arg1=code_block_2, arg2=code_block_3)
map = List.Map(code_block, if_)
code_block_4 = CodeBlock { {1,2,3,4}; }
code_block_5 = CodeBlock { false; }
code_block_6 = CodeBlock { 42; }
if_2 = If(code_block_5, code_block_6)
map_2 = List.Map(code_block_4, if_2)
