# Dynamo graph testIFInCustomNode2.dyn (Dynamo 0.7.1.26709)

code_block = CodeBlock { -5; }
passNothingBelow1 = Custom[PassNothingBelow1](x=code_block)  # Takes inputs and only passes 1 or values above 1
code_block_2 = CodeBlock { 5; }
passNothingBelow1_2 = Custom[PassNothingBelow1](x=code_block_2)
