# Dynamo graph testIfBasic.dyn (Dynamo 0.7.0.30500)

double_slider = DoubleSlider(5, range=0..100)
code_block = CodeBlock { 1.0; }
lt = double_slider < code_block
if_ = If(lt, code_block, double_slider)
code_block_2 = CodeBlock { -3..3; }
code_block_3 = CodeBlock { 1.0; }
lt_2 = code_block_2 < code_block_3
if_2 = If(lt_2, code_block_3, code_block_2)
