# Dynamo graph testNewIf.dyn (Dynamo 2.11.0.4125)

boolean = BoolSelector(true)
code_block = CodeBlock { ["a1","b1","c1"]; [["a2"],"b2"]; [1,[2]]; []; }
if_ = RefactoredIf(test=boolean, true=code_block.out0, false=code_block.out1)
if_2 = RefactoredIf(test=boolean, true=code_block.out2, false=code_block.out3)
