# Dynamo graph map_reduce_filter.dyn (Dynamo 1.0.1.1743)

number = DoubleInput(2)
create_list = List.Create(number, number, number)
number_2 = DoubleInput(4)
add = _ + number_2
map = List.Map(list=create_list, f_x=add)
watch = Watch(map)
number_3 = DoubleInput(0)
number_4 = DoubleInput(10)
number_5 = DoubleInput(1)
range = Range(start=number_3, end=number_4, step=number_5)
number_6 = DoubleInput(5)
greaterThan = Compare.GreaterThan(arg1=number_6)
filter = Filter(range, greaterThan)
watch_2 = Watch(filter)
add_2 = _ + _
number_7 = DoubleInput(0)
number_8 = DoubleInput(2)
create_list_2 = List.Create(number_8, number_8, number_8)
reduce = Reduce(add_2, number_7, create_list_2)
watch_3 = Watch(reduce)
number_9 = DoubleInput(2)
number_10 = DoubleInput(5)
add_3 = number_9 + number_10
number_11 = DoubleInput(0)
number_12 = DoubleInput(10)
add_4 = number_11 + number_12
sub = add_3 - add_4
watch_4 = Watch(sub)
