# Dynamo graph AllExcelNodes_MAGN2343.dyn (Dynamo 0.7.0.25150)

file_path = Filename("D:\FromF\DynamoProject\Graphs\MigrationDYN\helix.xlsx")
readExcelFile = Excel.ReadExcelFile(file_path)
string = StringInput("helix")
getExcelWorksheetByName = Excel.GetExcelWorksheetByName(readExcelFile, string)
getDataFromExcelWorksheet = Excel.GetDataFromExcelWorksheet(getExcelWorksheetByName)
watch = Watch(getDataFromExcelWorksheet)
transpose = List.Transpose(getDataFromExcelWorksheet)
watch_2 = Watch(transpose)
number = DoubleInput(0)
getItemAtIndex = List.GetItemAtIndex(transpose, number)
number_2 = DoubleInput(1)
getItemAtIndex_2 = List.GetItemAtIndex(transpose, number_2)
number_3 = DoubleInput(2)
getItemAtIndex_3 = List.GetItemAtIndex(transpose, number_3)
byCoordinates = Point.ByCoordinates(getItemAtIndex, getItemAtIndex_2, getItemAtIndex_3, lacing=Longest)
watch_3d = Watch3D(byCoordinates)
watch_3 = Watch(getItemAtIndex)
