# Dynamo graph ColorRange_3065.dyn (Dynamo 0.6.3.7993)

number = DoubleInput(0)
number_2 = DoubleInput(255)
color = Color(number, number_2, number, number, lacing=Longest)
color_2 = Color(number, number, number_2, number_2, lacing=Longest)
list = NewList(index0=color, index1=color_2)
number_3 = DoubleInput(0)
number_4 = DoubleInput(100)
color_3 = Color(number_3, number_4, number_3, number_3, lacing=Longest)
color_4 = Color(number_3, number_3, number_4, number_3, lacing=Longest)
list_2 = NewList(index0=color_3, index1=color_4)
number_5 = DoubleInput(0..1..#25)
color_range = ColorRange(list, list_2, number_5)
