# Dynamo graph IsNull_3054.dyn (Dynamo 0.6.3.7993)

number = DoubleInput(0)
is_null = IsNull(number)
string = StringInput("a")
XYZ = Xyz(string, string, string, lacing=Longest)
is_null_2 = IsNull(XYZ)
