# Dynamo graph LibraryTestExcelRead.dyn (Dynamo 0.6.2.20018)

string = StringInput("C:\Excel.xls")
open_excel_workbook = ReadExcelFile(string)
string_2 = StringInput("Sheet2")
get_excel_worksheet_by_name = GetExcelWorksheetByName(open_excel_workbook, string_2)
get_data_from_excel_worksheet = GetDataFromExcelWorksheet(get_excel_worksheet_by_name)
watch = Watch(get_data_from_excel_worksheet)
get_worksheets_from_excel = GetWorksheetsFromExcelWorkbook(open_excel_workbook)
