# Dynamo graph LibraryTestPythonScript.dyn (Dynamo 0.6.2.14024)

number = DoubleInput(0)
XYZ = Xyz(number, number, number, lacing=Longest)
number_2 = DoubleInput(6)
python_script = Python(number_2)
# ---------- python_script.python (28 lines) ----------
# Default imports
import clr
clr.AddReference('RevitAPI')
clr.AddReference('RevitAPIUI')
from Autodesk.Revit.DB import *
import Autodesk
import sys
import clr
path = r'C:\Autodesk\Dynamo\Core'
exec_path = r'C:\Autodesk\Dynamo\Core\dll'
sys.path.append(path)
sys.path.append(exec_path)
clr.AddReference('LibGNet')
from Autodesk.LibG import *

#The input to this node will be stored in the IN variable.
dataEnteringNode = IN

#Processing
OUT = []
x, i = 1, 0
while i < IN:
	x += i
	OUT += [x]
	i += 1

#Assign your output to the OUT variable
OUT = OUT
# ----------------------------------------
circle = Circle(XYZ, python_script, lacing=Longest)
