# Dynamo graph ReadImageFile_2649.dyn (Dynamo 1.0.1.1743)

file_path = Filename("D:\FromF\DynamoProject\Graphs\MigrationDYN\StandAlone\MAGN-2649.png")
number = DoubleInput(5)
number_2 = DoubleInput(3)
readImage = File.ReadImage(file_path, number, number_2)
count = List.Count(readImage)
watch = Watch(count)
