# Dynamo graph TestAdd.dyn (Dynamo 1.0.1.1743)

number = DoubleInput(2)
number_2 = DoubleInput(5)
add = number + number_2  # lacing=Longest
number_3 = DoubleInput(-1)
add_2 = number + number_3  # lacing=Longest
number_4 = DoubleInput(2.5)
add_3 = number + number_4  # lacing=Longest
