# Dynamo graph TestAverage.dyn (Dynamo 1.0.0.541)

number = DoubleInput(1..10)
average = Math.Average(number)
number_2 = DoubleInput(0.5..10.5..1)
average_2 = Math.Average(number_2)
number_3 = DoubleInput(-10..-1)
average_3 = Math.Average(number_3)
number_4 = DoubleInput(5)
average_4 = Math.Average(number_4, lacing=Longest)
