# Dynamo graph TestCeiling.dyn (Dynamo 0.6.2.29585)

number = DoubleInput(3)
ceiling = Ceiling(number, lacing=Longest)
number_2 = DoubleInput(-2)
ceiling_2 = Ceiling(number_2, lacing=Longest)
number_3 = DoubleInput(2.5)
ceiling_3 = Ceiling(number_3, lacing=Longest)
number_4 = DoubleInput(2.3)
ceiling_4 = Ceiling(number_4, lacing=Longest)
number_5 = DoubleInput(2.8)
ceiling_5 = Ceiling(number_5, lacing=Longest)
number_6 = DoubleInput(-2.8)
ceiling_6 = Ceiling(number_6, lacing=Longest)
