# Dynamo graph TestDropFromList_ListOfListAsInput.dyn (Dynamo 1.0.1.1743)

number = DoubleInput(1..5)
create_list = List.Create(number, number, number, number)
number_2 = DoubleInput(2)
dropItems = List.DropItems(list=create_list, amount=number_2)
