# Dynamo graph TestFirstOfList.dyn (Dynamo 0.6.3.5265)

number = DoubleInput(1..10)
first_of_list = First(number)
empty_list = Empty()
first_of_list_2 = First(empty_list)
number_2 = DoubleInput(1)
first_of_list_3 = First(number_2)
