# Dynamo graph TestGetFromList_ListOfListAsInput.dyn (Dynamo 1.0.1.1743)

number = DoubleInput(1..2)
create_list = List.Create(number, number, number, number)
number_2 = DoubleInput(1)
getItemAtIndex = List.GetItemAtIndex(list=create_list, index=number_2)
