# Dynamo graph TestIf.dyn (Dynamo 0.6.3.5265)

boolean = BoolSelector(false)
number = DoubleInput(2)
number_2 = DoubleInput(3)
if_ = Conditional(boolean, number, number_2)
boolean_2 = BoolSelector(true)
if_2 = Conditional(boolean_2, number, number_2)
