# Dynamo graph TestLessThan.dyn (Dynamo 0.6.2.29585)

number = DoubleInput(2)
number_2 = DoubleInput(8)
less_than = LessThan(number, number_2)
less_than_2 = LessThan(number_2, number)
less_than_3 = LessThan(number_2, number_2)
