# Dynamo graph TestListLength.dyn (Dynamo 1.0.1.1743)

number = DoubleInput(0)
count = List.Count(number)
number_2 = DoubleInput(1..10)
count_2 = List.Count(number_2)
empty = List.Empty()
count_3 = List.Count(empty)
