# Dynamo graph TestMigration_Core_Scripting.dyn (Dynamo 1.0.1.1743)

python_script = Python()
# ---------- python_script.python (20 lines) ----------
# Default imports
import clr
clr.AddReference('RevitAPI')
clr.AddReference('RevitAPIUI')
from Autodesk.Revit.DB import *
import Autodesk
import sys
import clr
path = r'C:\Autodesk\Dynamo\Core'
exec_path = r'C:\Autodesk\Dynamo\Core\dll'
sys.path.append(path)
sys.path.append(exec_path)
clr.AddReference('LibGNet')
from Autodesk.LibG import *

#The input to this node will be stored in the IN[0] variable.
dataEnteringNode = IN[0]

#Assign your output to the OUT variable
OUT = 0
# ----------------------------------------
python_script_from_string = PythonStringNode()
python_script_2 = Python()
# ---------- python_script_2.python (20 lines) ----------
# Default imports
import clr
clr.AddReference('RevitAPI')
clr.AddReference('RevitAPIUI')
from Autodesk.Revit.DB import *
import Autodesk
import sys
import clr
path = r'C:\Autodesk\Dynamo\Core'
exec_path = r'C:\Autodesk\Dynamo\Core\dll'
sys.path.append(path)
sys.path.append(exec_path)
clr.AddReference('LibGNet')
from Autodesk.LibG import *

#The input to this node will be stored in the IN[0]...INX variable(s).
dataEnteringNode = IN[0]

#Assign your output to the OUT variable
OUT = 0
# ----------------------------------------
