# Dynamo graph TestMigration_Core_Strings.dyn (Dynamo 1.0.1.1743)

concat = String.Concat()
join = String.Join()
code_block = CodeBlock { 0; }
getItemAtIndex = List.GetItemAtIndex(list=join, index=code_block)
fromObject = String.FromObject(lacing=Longest)
split = String.Split()
changeCase = String.ChangeCase()
length = String.Length()
toNumber = String.ToNumber(lacing=Longest)
substring = String.Substring()
fromObject_2 = String.FromObject()
