# Dynamo graph TestNewList.dyn (Dynamo 1.0.1.1743)

number = DoubleInput(1)
number_2 = DoubleInput(-1)
number_3 = DoubleInput(2.5)
create_list = List.Create(number, number, number_2, number_3)
string = StringInput("hi,")
string_2 = StringInput("I am")
string_3 = StringInput("test")
create_list_2 = List.Create(string, string_2, number, string_3)
number_4 = DoubleInput(1..3)
create_list_3 = List.Create(number_4, number, number, number)
