# Dynamo graph TestPower.dyn (Dynamo 0.6.2.29585)

number = DoubleInput(3)
number_2 = DoubleInput(5)
power = Pow(number, number_2, lacing=Longest)
number_3 = DoubleInput(-2)
power_2 = Pow(number, number_3, lacing=Longest)
power_3 = Pow(number_3, number_2, lacing=Longest)
number_4 = DoubleInput(2.5)
power_4 = Pow(number, number_4, lacing=Longest)
