# Dynamo graph TestRandomSeed.dyn (Dynamo 1.0.1.1743)

number = DoubleInput(1)
random = Math.Random(number, lacing=Longest)
number_2 = DoubleInput(1.5)
random_2 = Math.Random(number_2, lacing=Longest)
