# Dynamo graph TestRound.dyn (Dynamo 0.6.2.29585)

number = DoubleInput(3)
round = Round(number, lacing=Longest)
number_2 = DoubleInput(-2)
round_2 = Round(number_2, lacing=Longest)
number_3 = DoubleInput(2.5)
round_3 = Round(number_3, lacing=Longest)
number_4 = DoubleInput(2.3)
round_4 = Round(number_4, lacing=Longest)
number_5 = DoubleInput(2.8)
round_5 = Round(number_5, lacing=Longest)
