# Dynamo graph TestShiftListIndices_ListOfListAsInput.dyn (Dynamo 1.0.1.1743)

number = DoubleInput(1..2)
create_list = List.Create(number, number, number, number)
number_2 = DoubleInput(5)
shiftIndices = List.ShiftIndices(list=create_list, amount=number_2)
