# Dynamo graph TestSortByKey.dyn (Dynamo 1.0.1.1743)

number = DoubleInput(2)
number_2 = DoubleInput(2.5)
number_3 = DoubleInput(-7)
number_4 = DoubleInput(2)
number_5 = DoubleInput(9)
number_6 = DoubleInput(0)
create_list = List.Create(number, number_2, number_3, number_4, number_5, number_6)
number_7 = DoubleInput(0)
greaterThan = Compare.GreaterThan(number_7)
sortByFunction = SortByFunction(create_list, greaterThan)
