# Dynamo graph TestTakeEveryNth_ListOfListAsInput.dyn (Dynamo 1.0.1.1743)

number = DoubleInput(1..2)
create_list = List.Create(number, number, number, number, number, number)
number_2 = DoubleInput(2)
number_3 = DoubleInput(1)
takeEveryNthItem = List.TakeEveryNthItem(create_list, number_2, number_3)
