# Dynamo graph TestTangent.dyn (Dynamo 0.6.2.29585)

number = DoubleInput(18.12)
tangent = Tan(number, lacing=Longest)
number_2 = DoubleInput(-5)
tangent_2 = Tan(number_2, lacing=Longest)
number_3 = DoubleInput(0)
tangent_3 = Tan(number_3, lacing=Longest)
number_4 = DoubleInput(3)
tangent_4 = Tan(number_4, lacing=Longest)
