# Dynamo graph TestThickenCurve.dyn (Dynamo 0.6.3.20001)

number = DoubleInput(10)
number_2 = DoubleInput(0)
XYZ = Xyz(number, number_2, number_2, lacing=Longest)
XYZ_2 = Xyz(number, number, number_2, lacing=Longest)
XYZ_3 = Xyz(number_2, number, number_2, lacing=Longest)
arc_by_start_middle_end = ArcStartMiddleEnd(XYZ, XYZ_2, XYZ_3, lacing=Longest)
number_3 = DoubleInput(1)
number_4 = DoubleInput(0)
number_5 = DoubleInput(0)
number_6 = DoubleInput(1)
XYZ_4 = Xyz(number_4, number_5, number_6, lacing=Longest)
thicken_curve = ThickenCurveLoop(arc_by_start_middle_end, number_3, XYZ_4, lacing=Longest)
