# Dynamo graph TestXor.dyn (Dynamo 0.6.2.29585)

boolean = BoolSelector(false)
boolean_2 = BoolSelector(true)
xor = Xor(boolean, boolean_2)
xor_2 = Xor(boolean, boolean)
xor_3 = Xor(boolean_2, boolean_2)
