# Dynamo graph TestXyPlane.dyn (Dynamo 0.6.3.20001)

number = DoubleInput(1)
number_2 = DoubleInput(-1)
XYZ = Xyz(number, number, number_2, lacing=Longest)
number_3 = DoubleInput(1)
XYZ_2 = Xyz(number, number, number_3, lacing=Longest)
line_by_endpoints = LineBound(XYZ, XYZ_2, lacing=Longest)
xy_plane = XyPlane(lacing=Longest)
curve_plane_intersection = CurvePlaneIntersection(line_by_endpoints, xy_plane, lacing=Longest)
xyz_x = XyzGetX(curve_plane_intersection, lacing=Longest)
xyz_y = XyzGetY(curve_plane_intersection, lacing=Longest)
xyz_z = XyzGetZ(curve_plane_intersection, lacing=Longest)
