# Dynamo graph TestXyzAverage.dyn (Dynamo 0.6.3.7993)

number = DoubleInput(0)
number_2 = DoubleInput(-2.5)
XYZ = Xyz(number, number_2, number, lacing=Longest)
XYZ_2 = Xyz(number_2, number_2, number, lacing=Longest)
number_3 = DoubleInput(2.5)
XYZ_3 = Xyz(number_3, number, number, lacing=Longest)
list = NewList(index0=XYZ, index1=XYZ_2, index2=XYZ_3)
average_xyzs = XyzAverage(list, lacing=Longest)
xyz_x = XyzGetX(average_xyzs, lacing=Longest)
watch = Watch(xyz_x)
xyz_y = XyzGetY(average_xyzs, lacing=Longest)
watch_2 = Watch(xyz_y)
xyz_z = XyzGetZ(average_xyzs, lacing=Longest)
watch_3 = Watch(xyz_z)
