# Dynamo graph TestXzPlane.dyn (Dynamo 0.6.3.20001)

number = DoubleInput(2)
number_2 = DoubleInput(-1)
XYZ = Xyz(number, number_2, number, lacing=Longest)
number_3 = DoubleInput(1)
XYZ_2 = Xyz(number, number_3, number, lacing=Longest)
line_by_endpoints = LineBound(XYZ, XYZ_2, lacing=Longest)
xz_plane = XzPlane(lacing=Longest)
curve_plane_intersection = CurvePlaneIntersection(line_by_endpoints, xz_plane, lacing=Longest)
xyz_x = XyzGetX(curve_plane_intersection, lacing=Longest)
xyz_y = XyzGetY(curve_plane_intersection, lacing=Longest)
xyz_z = XyzGetZ(curve_plane_intersection, lacing=Longest)
