# Dynamo graph TestYzPlane.dyn (Dynamo 0.6.3.20001)

number = DoubleInput(-1)
number_2 = DoubleInput(3)
XYZ = Xyz(number, number_2, number_2, lacing=Longest)
number_3 = DoubleInput(1)
XYZ_2 = Xyz(number_3, number_2, number_2, lacing=Longest)
line_by_endpoints = LineBound(XYZ, XYZ_2, lacing=Longest)
yz_plane = YzPlane(lacing=Longest)
curve_plane_intersection = CurvePlaneIntersection(line_by_endpoints, yz_plane, lacing=Longest)
xyz_x = XyzGetX(curve_plane_intersection, lacing=Longest)
xyz_y = XyzGetY(curve_plane_intersection, lacing=Longest)
xyz_z = XyzGetZ(curve_plane_intersection, lacing=Longest)
