# Dynamo graph Transpose_3061.dyn (Dynamo 1.0.1.1743)

number = DoubleInput(0)
number_2 = DoubleInput(10)
number_3 = DoubleInput(1)
range = Range(start=number, end=number_2, step=number_3, lacing=Longest)
number_4 = DoubleInput(11)
number_5 = DoubleInput(20)
number_6 = DoubleInput(1)
range_2 = Range(start=number_4, end=number_5, step=number_6, lacing=Longest)
create_list = List.Create(range, range_2)
transpose = List.Transpose(create_list)
