# Dynamo graph multi-custom.dyn (Dynamo 0.6.2.27679)

number = DoubleInput(0)
list = NewList(index0=number)
de_cons_list = Custom[De-Cons List](list=list)
watch = Watch(de_cons_list.first)
watch_2 = Watch(de_cons_list.rest)
