# Dynamo graph ResolveDummyNodesOnDownloadingPackage.dyn (Dynamo 2.5.0.6396)

code_block = CodeBlock { 5; }
create = Examples.NEWBasicExample.Create(x=code_block, y=code_block, z=code_block)
awesome = Examples.NEWBasicExample.Awesome(nEWBasicExample=create)
