# Dynamo graph BigIntegerToLong.dyn (Dynamo 2.5.0.6757)

python_script = Python()  # unwired: IN[0]
# ---------- python_script.python (11 lines) ----------
# Load the Python Standard and DesignScript Libraries
import sys
import clr

# The inputs to this node will be stored as a list in the IN variables.
dataEnteringNode = IN

# Place your code below this line

# Assign your output to the OUT variable.
OUT = [2059130726864, 2*10e13, int(2*10e13), -9223372036854775808, 9223372036854775808]
# ----------------------------------------
type = Object.Type(obj=python_script)
