# Dynamo graph DynamoPrint.dyn (Dynamo 2.8.0.2035)

string = StringInput("""import sys
DynamoPrint('Hello from Python' + str(sys.version_info.major) + '!!!')""")
greeting_cpython_node = Python()  # CPython3; unwired: IN[0]
# ---------- greeting_cpython_node.python (14 lines) ----------
# Load the Python Standard and DesignScript Libraries
import sys
import clr
clr.AddReference('ProtoGeometry')
from Autodesk.DesignScript.Geometry import *

# The inputs to this node will be stored as a list in the IN variables.
dataEnteringNode = IN

# Place your code below this line
DynamoPrint('Hello from Python' + str(sys.version_info.major) + '!!!')

# Assign your output to the OUT variable.
OUT = 0
# ----------------------------------------
greeting_ironpython_node = Python(IN[0]=greeting_cpython_node)  # IronPython2; same code as greeting_cpython_node
greeting_cpython_string_node = PythonStringNode(script=string, IN[0]=greeting_ironpython_node)  # CPython3
greeting_ironpython_string_node = PythonStringNode(script=string, IN[0]=greeting_cpython_string_node)  # IronPython2
