# Dynamo graph PythonCustomNodeHomeWorkspace.dyn "python custom node test home workspace" (Dynamo 2.3.0.6256)

number_slider = DoubleSlider(89.3, range=0..100 step 0.1)
pythonCustomNodeTest = Custom[PythonCustomNodeTest](IN=number_slider)  # test python in a custom node
watch = Watch(pythonCustomNodeTest)
