# Dynamo graph python_refDynamoServices.dyn (Dynamo 2.8.0.2036)

python_script = Python()  # IronPython2; unwired: IN[0]
# ---------- python_script.python (12 lines) ----------
# Load the Python Standard and DesignScript Libraries
import sys
import clr

clr.AddReference('DynamoServices')
from Dynamo.Events import ExecutionEvents
from Dynamo.Session import ParameterKeys


packagePathsKey = ParameterKeys.PackagePaths

OUT = ExecutionEvents.ActiveSession.GetParameterValue(packagePathsKey)
# ----------------------------------------
