# Dynamo custom node MyReduce.dyf
# category: Misc

list = Input()
is_empty_list = IsEmpty(list)
base = Input()
f_x_a = Input()  # "f(x, a)"
first_in_list = First(list)
list_rest = Rest(list)
myReduce = Custom[MyReduce](list=list_rest, f_x_a=f_x_a, base=base)
apply = Apply1(arg1=f_x_a, arg2=first_in_list, myReduce)
if_ = Conditional(is_empty_list, base, apply)
Output = Output(if_)  # ""
