# Dynamo custom node Sum Numbers.dyf
# category: Misc

numbers = Input()
is_empty_list = IsEmpty(numbers)
number = DoubleInput(0)
first_in_list = First(numbers)
list_rest = Rest(numbers)
sum_numbers = Custom[Sum Numbers](numbers=list_rest)
add = Addition(first_in_list, sum_numbers)
if_ = Conditional(is_empty_list, number, add)
Output = Output(if_)  # ""
