# Dynamo graph reduce-example.dyn (Dynamo 1.0.1.1743)

add = _ + _
number = DoubleInput(0)
number_2 = DoubleInput(1)
number_3 = DoubleInput(5)
range = Range(start=number_2, end=number_3, step=number_2)
reduce = Reduce(add, number, range)
watch = Watch(reduce)
myReduce = Custom[MyReduce](list=range, f_x_a=add, base=number)
watch_2 = Watch(myReduce)
sum_numbers = Custom[Sum Numbers](numbers=range)
watch_3 = Watch(sum_numbers)
