# Dynamo graph serialization.dyn (Dynamo 1.2.1.2821)

# group: This is a group.
number = DoubleInput(5)
number_slider = DoubleSlider(3, range=0..100 step 0.1)

add = number + number_slider
code_block = CodeBlock { a=42.0; b=cat; }  # unwired: cat
watch = Watch(code_block.a)
string = StringInput("foo")
create = List.Create(string, string, string)
number_2 = DoubleInput(1)
number_3 = DoubleInput(2)
gt = number_2 > number_3
and_ = And(gt, gt, gt, gt, gt, gt)
or_ = Or(gt, gt)
