# Dynamo graph TestConcatStringInListMap.dyn (Dynamo 0.7.5.3233)

code_block = CodeBlock { 0..54..10; }
string_from_object = FromObject(code_block)
code_block_2 = CodeBlock { "a"; }
concat = String.Concat(arg1=code_block_2)
map = List.Map(string_from_object, concat)
