# Dynamo graph TestConcatString_fromFunction.dyn

string = StringInput("yesterday ")
string_2 = StringInput("today.")
concat_strings = ConcatStrings(string, string_2)
string_3 = StringInput("tomorrow")
concat_strings_2 = ConcatStrings(concat_strings, string_3)
watch = Watch(concat_strings_2)
