# Dynamo graph TestConcatString_multipleInput.dyn (Dynamo 1.0.1.1743)

code_block = CodeBlock { {"ab","cd"}; {"ef","gh"}; }
concat = String.Concat(code_block.out0, code_block.out1)
watch = Watch(concat)
