# Dynamo graph TestConcatString_normal.dyn

string = StringInput("123")
string_2 = StringInput("abc ")
string_3 = StringInput("    !@#    ")
concat_strings = ConcatStrings(s3=string, string_2, string_3)
watch = Watch(concat_strings)
