# Dynamo graph TestNumberToString_fromFunction.dyn (Dynamo 0.7.4.3200)

number = DoubleInput(12)
number_2 = DoubleInput(13)
add = number + number_2  # lacing=Longest
fromObject = String.FromObject(add)
watch = Watch(fromObject)
