# Dynamo graph TestNumberToString_normal.dyn (Dynamo 0.7.5.3233)

number = DoubleInput(123456789)
string_from_object = FromObject(number)
toNumber = String.ToNumber(string_from_object)
watch = Watch(toNumber)
number_2 = DoubleInput(-123456789)
string_from_object_2 = FromObject(number_2)
toNumber_2 = String.ToNumber(string_from_object_2)
watch_2 = Watch(toNumber_2)
number_3 = DoubleInput(3.456)
string_from_object_3 = FromObject(number_3)
toNumber_3 = String.ToNumber(string_from_object_3)
watch_3 = Watch(toNumber_3)
number_4 = DoubleInput(-3.456)
string_from_object_4 = FromObject(number_4)
toNumber_4 = String.ToNumber(string_from_object_4)
watch_4 = Watch(toNumber_4)
