# Dynamo graph TestSplitString_fromFile.dyn

file_path = StringFilename("..\..\test\core\string\TestSplitString_fromFile.txt")
read_text_file = FileReader(file_path)
string = StringInput(".")
split_string = SplitString(read_text_file, string)
watch = Watch(split_string)
