# Dynamo graph TestSplitString_fromFunction.dyn

string = StringInput("1")
string_2 = StringInput(".2")
concat_strings = ConcatStrings(string, string_2)
string_3 = StringInput(".")
split_string = SplitString(concat_strings, string_3)
watch = Watch(split_string)
