# Dynamo graph TestStringCase_normal.dyn (Dynamo 0.6.3.7993)

string = StringInput("Rainy Day")
boolean = BoolSelector(true)
string_case = StringCase(string, boolean)
watch = Watch(string_case)
string_2 = StringInput("Rainy Day")
boolean_2 = BoolSelector(false)
string_case_2 = StringCase(string_2, boolean_2)
watch_2 = Watch(string_case_2)
