# Dynamo graph TestStringContains_invalidInput.dyn (Dynamo 0.7.0.26857)

code_block = CodeBlock { "This is the original string."; }
code_block_2 = CodeBlock { 123; }
boolean = BoolSelector(true)
contains = String.Contains(code_block, code_block_2, boolean)
watch = Watch(contains)
