# Dynamo graph TestStringContains_multipleInput.dyn (Dynamo 0.7.0.26857)

code_block = CodeBlock { "This is the original string."; }
code_block_2 = CodeBlock { {"String","Copy","Original"}; }
boolean = BoolSelector(true)
contains = String.Contains(code_block, code_block_2, boolean)
watch = Watch(contains)
code_block_3 = CodeBlock()
# ---------- code_block_3.designscript (2 lines) ----------
{"This is the original string,",
"and this is a string."};
# ----------------------------------------
code_block_4 = CodeBlock { "and"; }
boolean_2 = BoolSelector(true)
contains_2 = String.Contains(code_block_3, code_block_4, boolean_2)
watch_2 = Watch(contains_2)
