# Dynamo graph TestStringContains_normal.dyn (Dynamo 0.7.0.26857)

code_block = CodeBlock { "This is the original string."; }
code_block_2 = CodeBlock { "String"; }
boolean = BoolSelector(true)
contains = String.Contains(code_block, code_block_2, boolean)
watch = Watch(contains)
boolean_2 = BoolSelector(false)
contains_2 = String.Contains(code_block, code_block_2, boolean_2)
watch_2 = Watch(contains_2)
code_block_3 = CodeBlock { "This is the original string."; }
code_block_4 = CodeBlock { "Contains"; }
boolean_3 = BoolSelector(false)
contains_3 = String.Contains(code_block_3, code_block_4, boolean_3)
watch_3 = Watch(contains_3)
boolean_4 = BoolSelector(true)
contains_4 = String.Contains(code_block_3, code_block_4, boolean_4)
watch_4 = Watch(contains_4)
