# Dynamo graph TestStringFromArrayPreview_numericformat.dyn (Dynamo 3.0.0.6086)

code_block = CodeBlock { 1..3..#4; }
string_from_array = FromArray(arr=code_block)
watch1 = Watch(string_from_array)
string_from_array2 = StringFromArray(array=code_block)
watch2 = Watch(string_from_array2)
code_block_2 = CodeBlock { true; }
string_from_array2_2 = StringFromArray(array=code_block, useNumericFormat=code_block_2)
watch3 = Watch(string_from_array2_2)
string_from_array2_3 = StringFromArray(array=code_block)  # unwired: useNumericFormat
watch4 = Watch(string_from_array2_3)
