# Dynamo graph TestStringIndexOf_emptyString.dyn (Dynamo 0.7.0.26857)

code_block = CodeBlock { ""; }
code_block_2 = CodeBlock { "String"; }
boolean = BoolSelector(true)
indexOf = String.IndexOf(code_block, code_block_2, boolean)
watch = Watch(indexOf)
code_block_3 = CodeBlock { "This is the original string."; }
code_block_4 = CodeBlock { ""; }
boolean_2 = BoolSelector(true)
indexOf_2 = String.IndexOf(code_block_3, code_block_4, boolean_2)
watch_2 = Watch(indexOf_2)
