# Dynamo graph TestStringIndexOf_normal.dyn (Dynamo 0.7.0.26857)

code_block = CodeBlock { "This is the original string."; }
code_block_2 = CodeBlock { "TH"; }
boolean = BoolSelector(true)
indexOf = String.IndexOf(code_block, code_block_2, boolean)
watch = Watch(indexOf)
boolean_2 = BoolSelector(false)
indexOf_2 = String.IndexOf(code_block, code_block_2, boolean_2)
watch_2 = Watch(indexOf_2)
code_block_3 = CodeBlock { "This is the original string."; }
code_block_4 = CodeBlock { "IN"; }
boolean_3 = BoolSelector(false)
indexOf_3 = String.IndexOf(code_block_3, code_block_4, boolean_3)
watch_3 = Watch(indexOf_3)
boolean_4 = BoolSelector(true)
indexOf_4 = String.IndexOf(code_block_3, code_block_4, boolean_4)
watch_4 = Watch(indexOf_4)
