# Dynamo graph TestStringInsert_invalidInput.dyn (Dynamo 0.7.0.26857)

code_block = CodeBlock { "A string"; }
code_block_2 = CodeBlock { 20; }
code_block_3 = CodeBlock { " to insert."; }
insert = String.Insert(code_block, code_block_2, code_block_3)
watch = Watch(insert)
