# Dynamo graph TestStringInsert_multipleInput.dyn (Dynamo 0.7.0.26857)

code_block = CodeBlock { "My name is ."; }
code_block_2 = CodeBlock { 11; }
code_block_3 = CodeBlock { {"Jude","Bryan","Dave"}; }
insert = String.Insert(code_block, code_block_2, code_block_3)
watch = Watch(insert)
code_block_4 = CodeBlock { "Aaagh"; }
code_block_5 = CodeBlock { 1..3; }
code_block_6 = CodeBlock { "rrr"; }
insert_2 = String.Insert(code_block_4, code_block_5, code_block_6)
watch_2 = Watch(insert_2)
