# Dynamo graph TestStringInsert_normal.dyn (Dynamo 0.7.0.26857)

code_block = CodeBlock { "is a string."; }
code_block_2 = CodeBlock { 0; }
code_block_3 = CodeBlock { "This "; }
insert = String.Insert(code_block, code_block_2, code_block_3)
watch = Watch(insert)
code_block_4 = CodeBlock { 9; }
code_block_5 = CodeBlock { "nother"; }
insert_2 = String.Insert(insert, code_block_4, code_block_5)
watch_2 = Watch(insert_2)
