# Dynamo graph TestStringLength_multipleInput.dyn

string = StringInput("ab.cde")
string_2 = StringInput(".")
split_string = SplitString(string, string_2)
string_length = StringLen(split_string)
watch = Watch(string_length)
