# Dynamo graph TestStringReplace_multipleInput.dyn (Dynamo 0.7.0.26857)

code_block = CodeBlock { "I am going to meet Bryan and Dave."; }
code_block_2 = CodeBlock { {"Bryan","Dave"}; }
code_block_3 = CodeBlock { "him"; }
replace = String.Replace(code_block, code_block_2, code_block_3)
watch = Watch(replace)
code_block_4 = CodeBlock { {"My name is Bryan.","Bryan is my name."}; }
code_block_5 = CodeBlock { "Bryan"; }
code_block_6 = CodeBlock { "Dave"; }
replace_2 = String.Replace(code_block_4, code_block_5, code_block_6)
watch_2 = Watch(replace_2)
