# Dynamo graph TestStringStartsWith_normal.dyn (Dynamo 0.7.0.26857)

code_block = CodeBlock { "This is the original string."; }
code_block_2 = CodeBlock { "this is"; }
boolean = BoolSelector(true)
startsWith = String.StartsWith(code_block, code_block_2, boolean)
watch = Watch(startsWith)
boolean_2 = BoolSelector(false)
startsWith_2 = String.StartsWith(code_block, code_block_2, boolean_2)
watch_2 = Watch(startsWith_2)
code_block_3 = CodeBlock { "This is the original string."; }
code_block_4 = CodeBlock { "string."; }
boolean_3 = BoolSelector(false)
startsWith_3 = String.StartsWith(code_block_3, code_block_4, boolean_3)
watch_3 = Watch(startsWith_3)
boolean_4 = BoolSelector(true)
startsWith_4 = String.StartsWith(code_block_3, code_block_4, boolean_4)
watch_4 = Watch(startsWith_4)
