# Dynamo graph TestStringToNumber_fromFile.dyn

file_path = StringFilename("..\..\..\test\core\string\TestStringToNumber_fromFile.txt")
read_text_file = FileReader(file_path)
string_to_number = String2Num(read_text_file, lacing=Longest)
watch = Watch(string_to_number)
