# Dynamo graph TestStringToNumber_invalidInput.dyn

string = StringInput("abc")
string_2 = StringInput("b")
split_string = SplitString(string, string_2)
string_to_number = String2Num(split_string, lacing=Longest)
watch = Watch(string_to_number)
