# Dynamo graph TestStringToNumber_normal.dyn

string = StringInput("12")
string_to_number = String2Num(string, lacing=Longest)
watch = Watch(string_to_number)
string_2 = StringInput("12.3")
string_to_number_2 = String2Num(string_2, lacing=Longest)
watch_2 = Watch(string_to_number_2)
string_3 = StringInput("1,000")
string_to_number_3 = String2Num(string_3, lacing=Longest)
watch_3 = Watch(string_to_number_3)
string_4 = StringInput("123456789")
string_to_number_4 = String2Num(string_4, lacing=Longest)
watch_4 = Watch(string_to_number_4)
