# Dynamo graph TestSubstring_normal.dyn

string = StringInput("the rainbow")
number = DoubleInput(4)
number_2 = DoubleInput(7)
substring = Substring(string, number, number_2)
watch = Watch(substring)
