# Dynamo graph transpose.dyn (Dynamo 1.0.1.1743)

number = DoubleInput(0)
number_2 = DoubleInput(10)
number_3 = DoubleInput(1)
range = Range(start=number, end=number_2, step=number_3, lacing=Longest)
add = range + number_2  # lacing=Longest
number_4 = DoubleInput(2)
range_2 = Range(start=range, end=add, step=number_4, lacing=Longest)
watch = Watch(range_2)
transpose = List.Transpose(range_2)
watch_2 = Watch(transpose)
