# Dynamo graph map-numbers-to-units.dyn (Dynamo 0.7.0.33136)

code_block = CodeBlock { 1..5; }
fromDouble = DynamoUnits.Length.FromDouble()
map_length = Map(code_block, fromDouble)
fromDouble_2 = DynamoUnits.Volume.FromDouble()
map_volume = Map(code_block, fromDouble_2)
fromDouble_3 = DynamoUnits.Area.FromDouble()
map_area = Map(code_block, fromDouble_3)
fromDouble_4 = DynamoUnits.Volume.FromDouble(code_block)
fromDouble_5 = DynamoUnits.Area.FromDouble(code_block)
fromDouble_6 = DynamoUnits.Length.FromDouble(code_block)
