# Dynamo graph ASM_coordinateSystem.dyn (Dynamo 0.8.2.1957)

watch_3d = Watch3D()
code_block = CodeBlock { 0; }
code_block_2 = CodeBlock { 1; }
byOrigin = CoordinateSystem.ByOrigin(code_block, code_block_2, code_block_2)
