# Dynamo graph ASM_cuboid.dyn (Dynamo 0.7.0.39148)

code_block = CodeBlock { 5; }
watch_3d = Watch3D()
code_block_2 = CodeBlock { 0; }
byCoordinates = Point.ByCoordinates(code_block_2, code_block_2, code_block_2)
code_block_3 = CodeBlock { 1; }
byLengths = Cuboid.ByLengths(byCoordinates, code_block_3, code_block_3, code_block_3)
