# Dynamo graph ASM_points.dyn (Dynamo 0.7.2.2921)

number = DoubleInput(0..5)
number_2 = DoubleInput(0)
byCoordinates = Point.ByCoordinates(number, number_2, number_2)
watch_3d = Watch3D(byCoordinates)
