# Dynamo graph ASM_points_line.dyn (Dynamo 0.7.0.17876)

number = DoubleInput(0)
number_2 = DoubleInput(0..5)
point = Point3DNode(number, number, number_2, lacing=Longest)
number_3 = DoubleInput(2)
point_2 = Point3DNode(number, number_3, number, lacing=Longest)
line_libg = LineNode(point, point_2, lacing=Longest)
watch_3d = Watch3D(line_libg)
