# Dynamo graph ASM_points_line_noPreview.dyn (Dynamo 0.6.3.17876)

number = DoubleInput(0)
number_2 = DoubleInput(0..5)
many_points = Point3DNode(number, number, number_2, lacing=Longest)
number_3 = DoubleInput(2)
one_point = Point3DNode(number, number_3, number, lacing=Longest)
line_libg = LineNode(many_points, one_point, lacing=Longest)
watch_3d = Watch3D(line_libg)
