# Dynamo graph ASM_python.dyn (Dynamo 0.7.0.16336)

python_script = Python()
# ---------- python_script.python (18 lines) ----------
import clr
clr.AddReference('ProtoGeometry')
from Autodesk.DesignScript.Geometry import *

pts = []
cubes = []

for x in range (0,10):
	for y in range (0,10):
		row = []
		row_cubes = []
		for z in range (0,10):
			pt = Point.ByCoordinates(x,y,z)
			row.append(pt)
			row_cubes.append(Cuboid.ByLengths(pt,.1,.1,.1))
		pts.append(row)
		cubes.append(row_cubes)
OUT = [pts,cubes]
# ----------------------------------------
watch = Watch(python_script)
