# Dynamo graph ASM_thicken.dyn (Dynamo 0.7.0.39148)

origin = Point.Origin()
number = DoubleInput(2)
number_2 = DoubleInput(0)
number_3 = DoubleInput(120)
ZAxis = Vector.ZAxis()
byCenterPointRadiusAngle = Arc.ByCenterPointRadiusAngle(origin, number, number_2, number_3, ZAxis)
identity = CoordinateSystem.Identity()
code_block = CodeBlock { o1=Point.ByCoordinates(0,0,0); o2=Point.ByCoordinates(5,0,0); }
YAxis = Vector.YAxis()
byOriginVectors = CoordinateSystem.ByOriginVectors(code_block.o2, YAxis, ZAxis)
transform = Geometry.Transform(byCenterPointRadiusAngle, identity, byOriginVectors)
byOriginVectors_2 = CoordinateSystem.ByOriginVectors(code_block.o1, YAxis, ZAxis)
transform_2 = Geometry.Transform(byCenterPointRadiusAngle, identity, byOriginVectors_2)
create = List.Create(transform, transform_2)
byLoft = Surface.ByLoft(create)
number_4 = DoubleInput(0.05)
thicken = Surface.Thicken(byLoft, number_4)
