# Dynamo graph FirstRunWatch3D.dyn (Dynamo 1.0.0.343)

number = DoubleInput(10)
byCoordinates = Point.ByCoordinates(x=number, y=number, z=number)
byCorners = Cuboid.ByCorners(highPoint=byCoordinates)
watch_3d = Watch3D(byCorners)
