# Dynamo graph MAGN_3815.dyn (Dynamo 0.7.0.32659)

code_block = CodeBlock { 0..100..10; }
byCoordinates = Point.ByCoordinates(code_block, code_block, lacing=CrossProduct)
watch = Watch(byCoordinates)
