# Dynamo custom node Points.dyf (Dynamo 0.7.0.24595)
# category: Ian

number_of_points = Input()
number = DoubleInput(0..a, number_of_points, lacing=Longest)
code_block = CodeBlock { 0; }
byCoordinates = Point.ByCoordinates(number, code_block, code_block)
pts = Output(byCoordinates)
