# Dynamo graph WatchLiterals.dyn (Dynamo 0.6.3.22831)

number = DoubleInput(5)
numberWatch = Watch(number)
code_block = CodeBlock(x=numberWatch) { x % 2 > 0 ? false : true; }
booleanWatch = Watch(code_block)
byCoordinates = Point.ByCoordinates(number, number, number)
pointWatch = Watch(byCoordinates)
