# Dynamo custom node ANodeToModify.dyf (Dynamo 2.4.0.5577)
# category: Test
# Tells if a number in a range is even or odd

start = Input(start: var[]..[])
end = Input(end: var[]..[])
step = Input(step: var[]..[])
range = Range(start=start, end=end, step=step)
code_block = CodeBlock { 2; }
mod = range % code_block
code_block_2 = CodeBlock(x=mod) { x == 0 ? "even" : "odd"; }
Output = Output(code_block_2)  # ""
