# Dynamo graph OffsetCurves.dyn

number = DoubleInput(0)
XYZ = XYZ(number, number, number)
number_2 = DoubleInput(1)
XYZ_2 = XYZ(number_2, number, number_2)
number_3 = DoubleInput(2)
XYZ_3 = XYZ(number_3, number, number)
number_4 = DoubleInput(3)
XYZ_4 = XYZ(number_4, number, number_2)
list = NewList(item_s=XYZ, index1=XYZ_2, index2=XYZ_3, index3=XYZ_4)
nurbs_spline = GeometryCurveNurbSpline(list)
number_5 = DoubleInput(0.05)
number_sequence = BuildSeq(number, number_2, number_5)
compute_curve_derivatives = ComputeCurveDerivatives(nurbs_spline, number_sequence, lacing=Longest)
number_6 = DoubleInput(0.5)
offset_curve = OffsetCurve(nurbs_spline, number_6)
watch_3d = Watch3D(offset_curve)
xyz_zero = XYZZero()
number_7 = DoubleInput(3)
number_8 = DoubleInput(5)
ellipse = Ellipse(xyz_zero, number_7, number_8)
offset_curve_2 = OffsetCurve(ellipse, number_6)
watch_3d_2 = Watch3D(offset_curve_2)
pi = Pi()
number_9 = DoubleInput(1.5)
multiply = Multiplication(pi, number_9)
arc_by_ctr_pt = ArcCenter(xyz_zero, number_7, number, multiply)
offset_curve_3 = OffsetCurve(arc_by_ctr_pt, number_6)
watch_3d_3 = Watch3D(offset_curve_3)
