# Dynamo graph ReferenceCurve.dyn

xyz_zero = XYZZero()
number = DoubleInput(5)
number_2 = DoubleInput(0)
pi = Pi()
ellipse_arc = EllipticalArc(xyz_zero, number, number, number_2, pi)
reference_curve = ReferenceCurve(ellipse_arc)
