# Dynamo graph ReferencePlane.dyn (Dynamo 0.6.2.24371)

XYZ = Xyz(lacing=Longest)
number = DoubleInput(20)
integer_slider = IntegerSliderInput(17, range=0..20)
number_2 = DoubleInput(0..3.14..#div, integer_slider, lacing=Longest)
number_3 = DoubleInput(0)
xyz_by_polar_coordinates = XyzFromPolar(number, number_2, number_3, lacing=Longest)
line_by_endpoints = LineBound(XYZ, xyz_by_polar_coordinates, lacing=Longest)
reference_plane = ReferencePlane(line_by_endpoints, lacing=Longest)
