# Dynamo graph RevolveSolid.dyn

number = DoubleInput(50)
number_2 = DoubleInput(0)
XYZ = XYZ(number, number_2, number, lacing=Longest)
number_3 = DoubleInput(20)
number_4 = DoubleInput(25)
number_5 = DoubleInput(1.57)
ellipse_arc = EllipticalArc(XYZ, number_3, number_4, number_2, number_5, lacing=Longest)
xyz_zero = XYZZero(lacing=Longest)
number_6 = DoubleInput(1)
XYZ_2 = XYZ(number_6, number_2, number_2, lacing=Longest)
pi = Pi()
number_7 = DoubleInput(2)
divide = Division(pi, number_7, lacing=Longest)
rotate_transform = TransformRotation(xyz_zero, XYZ_2, divide, lacing=Longest)
transform_crv = CurveTransformed(ellipse_arc, rotate_transform, lacing=Longest)
number_8 = DoubleInput(2)
XYZ_3 = XYZ(number_2, number_6, number_2, lacing=Longest)
offset_curve = OffsetCrv(transform_crv, number_8, XYZ_3, lacing=Longest)
thicken_curve = ThickenCurveLoop(offset_curve, number_8, XYZ_3, lacing=Longest)
identity_transform = TransformIdentity(lacing=Longest)
create_revolved_geometry = CreateRevolvedGeometry(thicken_curve, identity_transform, number_2, pi, lacing=Longest)
watch = Watch(create_revolved_geometry)
