# Dynamo graph ViewSheet.dyn (Dynamo 0.7.0.17187)

concat_strings = ConcatStrings()
string = StringInput("sheet")
list = NewList(index0=string)
number = DoubleInput(0..10)
number_to_string = Num2String(number, lacing=Longest)
cartesian_product = CartProd(concat_strings, list, number_to_string)
select_family_type = FamilyTypeSelector(index=178)
drafting_view = DraftingView(number_to_string, lacing=Longest)
view_sheet = ViewSheet(cartesian_product, number_to_string, select_family_type, drafting_view, lacing=Longest)
