# Dynamo graph LotsOfStuff.dyn (Dynamo 1.1.1.2285)

code_block = CodeBlock { 0..20..2; }
byCoordinates = Point.ByCoordinates(x=code_block, y=code_block, z=code_block, lacing=CrossProduct)
number_slider = DoubleSlider(0.7, range=0..1 step 0.05)
byCenterPointRadius = Sphere.ByCenterPointRadius(centerPoint=byCoordinates, radius=number_slider)
byLengths = Cuboid.ByLengths(origin=byCoordinates)
edges = Topology.Edges(byLengths)
curveGeometry = Edge.CurveGeometry(edges)
number = DoubleInput(0.6)
byCenterPointRadius_2 = Circle.ByCenterPointRadius(centerPoint=byCoordinates, radius=number_slider)
