# Dynamo custom node PotteryCustom.dyf (Dynamo 0.9.1.3335)
# category: Core

number = DoubleInput(0)
number_2 = DoubleInput(0)
number_3 = DoubleInput(-0.25)
byCoordinates = Point.ByCoordinates(x=number, y=number_2, z=number_3)
code_block = CodeBlock { {3,4,5,5,4}; }
byCenterPointRadius = Circle.ByCenterPointRadius(centerPoint=byCoordinates, radius=code_block)
numberSides = Input(numberSides : int)
regularPolygon = Polygon.RegularPolygon(circle=byCenterPointRadius, numberSides=numberSides)
number_4 = DoubleInput(0)
H = Input()
number_5 = DoubleInput(5)
code_block_2 = CodeBlock(H=H, x=number_5) { 0..H..#x; }
byCoordinates_2 = Vector.ByCoordinates(x=number_4, y=number_4, z=code_block_2)
translate = Geometry.Translate(geometry=regularPolygon, direction=byCoordinates_2)
byLoft = Solid.ByLoft(translate)
ZAxis = Vector.ZAxis()
code_block_3 = CodeBlock(sides=numberSides, count=number_5) { 0..(360/sides)..#count; }
rotate = Geometry.Rotate(geometry=translate, origin=byCoordinates, axis=ZAxis, degrees=code_block_3)
byLoft_2 = Solid.ByLoft(rotate)
union = Solid.Union(byLoft, byLoft_2)
edges = Topology.Edges(union)
radius = Input(radius : double)
fillet = Solid.Fillet(union, edges, radius)
code_block_4 = CodeBlock { 0.25; }
thinShell = Solid.ThinShell(fillet, code_block_4, code_block_4)
byCoordinates_3 = Point.ByCoordinates(z=H)
code_block_5 = CodeBlock { 30; }
code_block_6 = CodeBlock(x=code_block_4) { 10*x; }
byLengths = Cuboid.ByLengths(origin=byCoordinates_3, width=code_block_5, length=code_block_5, height=code_block_6)
difference = Solid.Difference(solid=thinShell, other=byLengths)
Solid = Output(difference)
