# Dynamo graph UKDynUG_Sinuous_Tower.dyn (Dynamo 1.3.0.862)

# group: designtech.io <SINUOUS TOWER>
# note: Contact
# Please email all comments and errors to info@designtech.io
# note: Caveats
# - Always save and backup work before running
# - Use at own discretion
# - Please be aware this script may still execute successfully even with nodes turning yellow signifying an error
# note: Description
# This script will build a Sinuous Tower based on floor outline curves.
# note: Package Dependencies
# <Insert package dependencies here>
# note: Author
# Sol Amour
# Project BIM Manager
# designtech.io
# note: Version
# Script Version:  1.0.0
# Dynamo Version: 1.2.0.2690
# note: File Name
# UKDynUG_Sinuous_Tower.dyn

# group: Inputs
width = DoubleSlider(120000, range=75000..135000 step 1000)
# note: Variables / Inputs
# Green indicates Variables that can be altered per project and must be set accordingly before running the script.
length = DoubleSlider(60000, range=45000..75000 step 1000)
# note: Working / Functions
# Orange indicates the working of the script. No changes should be made in these groups unless advised.
resolution = DoubleSlider(25, range=20..60 step 1)
# note: Checking / Outputs
# Red indicates checking nodes to ensure the script has deployed correctly.
amplitude = DoubleSlider(250, range=200..300 step 5)
modifier = DoubleSlider(2, range=1.5..2.5 step 0.01)
floor_height = DoubleSlider(4000, range=3500..5500 step 50)
rotation = IntegerSlider(60, range=60..720 step 15)

# group: Creating a Points Distribution Grid and Adding in Z-Values based of Sine Graphs
code_block = CodeBlock(x=width, y=length, res=resolution) { ratio = x/y; resx = res; resy = res/ratio; (-x/2)..x/2..#resx; (-y/2)..y/2..#resy; -95..275..#resx; -95..275..#resy; }
byCoordinates = Point.ByCoordinates(x=code_block.out3, y=code_block.out4, lacing=CrossProduct)
transpose = List.Transpose(byCoordinates)
function_2 = CodeBlock(amplitude=amplitude, i=code_block.out6) { amplitude*Math.Sin(i)+amplitude; }
code_block_2 = CodeBlock(x=function_2, modifier=modifier) { x*modifier; }
function_1 = CodeBlock(amplitude=amplitude, i=code_block.out5) { amplitude*Math.Sin(i)+amplitude; }
mul = function_1 * _  # unwired: arg1
map = List.Map(list=code_block_2, f_x=mul)
code_block_3 = CodeBlock(X=map) { X+3500; }
byCoordinates_2 = Vector.ByCoordinates(z=code_block_3)
add = Point.Add(point=transpose, vectorToAdd=byCoordinates_2)

# group: Creating Curves based off these points, splitting the curves into points and drawing vertical lines to demarcate height
transpose_2 = List.Transpose(transpose)
flatten = Flatten(transpose_2)
byControlPoints = NurbsCurve.ByControlPoints(add)
code_block_4 = CodeBlock(num=code_block.resx) { 0..1..#num; }
pointAtParameter = Curve.PointAtParameter(curve=byControlPoints, param=code_block_4, lacing=CrossProduct)
transpose_3 = List.Transpose(pointAtParameter)
flatten_2 = Flatten(transpose_3)
byStartPointEndPoint = Line.ByStartPointEndPoint(startPoint=flatten, endPoint=flatten_2)

# group: Querying Height and building a range to dictate the placement of intersecting planes
length_2 = Curve.Length(byStartPointEndPoint)
code_block_5 = CodeBlock(length=length_2) { length*2; }
maximumItem = List.MaximumItem(code_block_5)
code_block_6 = CodeBlock(x=floor_height) { x*2; }
code_block_7 = CodeBlock(FloorToCeilingHeight=maximumItem, num=code_block_6) { calc=FloorToCeilingHeight/num; Math.Round(calc); }
code_block_8 = CodeBlock(height=maximumItem, num=code_block_7.out1) { 0..height..#num; }
code_block_9 = CodeBlock(x=code_block_8) { x/2; }
code_block_10 = CodeBlock { 1000; }
rounding_up_to_precision = CodeBlock(dbl=code_block_9, precision=code_block_10) { Math.Ceiling(dbl/precision)*precision; }
code_block_11 = CodeBlock(Z=rounding_up_to_precision) { Point.ByCoordinates(0,0,Z); }
ZAxis = Vector.ZAxis()
byOriginNormal = Plane.ByOriginNormal(origin=code_block_11, normal=ZAxis)

# group: Querying distance between points to build Cuboids from
code_block_12 = CodeBlock { 1; }
rounding_up_to_precision_2 = CodeBlock(dbl=code_block.resy, precision=code_block_12) { Math.Ceiling(dbl/precision)*precision; }
code_block_13 = CodeBlock(amount=rounding_up_to_precision_2, pn1=flatten) { count = amount+1; pn1[0]; pn1[count]; }
X = Point.X(code_block_13.out1)
X_2 = Point.X(code_block_13.out2)
Y = Point.Y(code_block_13.out1)
Y_2 = Point.Y(code_block_13.out2)
code_block_14 = CodeBlock(x1=X, x2=X_2, y1=Y, y2=Y_2) { x1-x2; y1-y2; }
code_block_15 = CodeBlock(valueX=code_block_14.out0, valueY=code_block_14.out1) { Math.Abs(valueX); Math.Abs(valueY); }

# group: Creating Cuboids and joining them with the Union method
byOrigin = CoordinateSystem.ByOrigin(flatten)
byLengths = Cuboid.ByLengths(byOrigin, code_block_15.out0, code_block_15.out1, code_block_5)
byUnion = Solid.ByUnion(byLengths)

# group: Clashing the Planes with the Solids to create external boundary curves
intersect = Geometry.Intersect(geometry=byUnion, other=byOriginNormal, lacing=CrossProduct)
perimeterCurves = Surface.PerimeterCurves(intersect)
flatten_3 = List.Flatten(list=perimeterCurves, amt=code_block_12)
byJoinedCurves = PolyCurve.ByJoinedCurves(flatten_3)

# group: Rotating the External Boundary curves
XY = Plane.XY()
count = List.Count(byJoinedCurves)
code_block_16 = CodeBlock(rot=rotation, num=count) { 0..rot..#num; }
rotate = Geometry.Rotate(byJoinedCurves, XY, code_block_16)

# group: Reporting Outputs
round = Math.Round(maximumItem)
byPatch = Surface.ByPatch(rotate)
area = Surface.Area(byPatch)
sum = Math.Sum(area)

# group: Reporting Outputs
height_of_tower = Watch(round)
surface_area_overall = Watch(sum)
