# Dynamo graph aniform03.dyn (Dynamo 0.8.0.1063)

code_block = CodeBlock { 10; }
byCoordinates = Point.ByCoordinates(y=code_block)
code_block_2 = CodeBlock { 5; }
byCenterPointRadius = Sphere.ByCenterPointRadius(centerPoint=byCoordinates, radius=code_block_2)
code_block_3 = CodeBlock { -5; }
byCoordinates_2 = Point.ByCoordinates(y=code_block_3)
byOrigin = CoordinateSystem.ByOrigin(byCoordinates_2)
code_block_4 = CodeBlock { 1; 1; 0.5; }
byCoordinateSystemHeightRadii = Cone.ByCoordinateSystemHeightRadii(byOrigin, code_block_4.out0, code_block_4.out1, code_block_4.out2)
byOrigin_2 = CoordinateSystem.ByOrigin(byCoordinates_2)
code_block_5 = CodeBlock { 3; 0.9; 0.5; }
byCoordinateSystemHeightRadii_2 = Cone.ByCoordinateSystemHeightRadii(byOrigin_2, code_block_5.out0, code_block_5.out1, code_block_5.out2)
code_block_6 = CodeBlock { -0.5; }
byCoordinates_3 = Vector.ByCoordinates(x=code_block_6)
translate = Geometry.Translate(geometry=byCoordinateSystemHeightRadii_2, direction=byCoordinates_3)
difference = Solid.Difference(solid=byCoordinateSystemHeightRadii, other=translate)
edges = Topology.Edges(difference)
code_block_7 = CodeBlock { 0.1; }
fillet = Solid.Fillet(difference, edges, code_block_7)
byOrigin_3 = CoordinateSystem.ByOrigin(byCoordinates)
integer_slider = IntegerSlider(100, range=0..300 step 1)
code_block_8 = CodeBlock(x=integer_slider) { 0..#x..137.50776; }
code_block_9 = CodeBlock(x=integer_slider) { 1..100..#x; }
bySphericalCoordinates = CoordinateSystem.BySphericalCoordinates(byOrigin_3, code_block_2, code_block_8, code_block_9)
transform = Geometry.Transform(geometry=fillet, fromCoordinateSystem=byOrigin, contextCoordinateSystem=bySphericalCoordinates)
XYPlane = CoordinateSystem.XYPlane(bySphericalCoordinates)
code_block_10 = CodeBlock { 0.3; 1.5; }
remapRange = Math.RemapRange(numbers=code_block_9, newMin=code_block_10.out0, newMax=code_block_10.out1)
scale = Geometry.Scale(transform, XYPlane, remapRange)
